# Grasshopper definition 160330_UDP_test.gh (Grasshopper 0.9.76)
# plug-ins: gHowl, HDTReference

panel = Panel("192.168.0.11")
panel_2 = Panel("2,-1,0")  # disabled
panel_3 = Panel("2,1,0")  # disabled
panel_4 = Panel("-2,-1,0")  # disabled
panel_5 = Panel("-2,1,0")  # disabled
panel_6 = Panel("2,-1,0")  # disabled
panel_7 = Panel("-2,-1,0")  # disabled
panel_8 = Panel("2,1,0")  # disabled
panel_9 = Panel("-2,1,0")  # disabled

# ---- group: \n
panel_10 = Panel("")

# ---- group: \t
panel_11 = Panel("\t")

# ----
netsource = NetworkSource()  # -> NetworkAdapterIsUp, AdapterProperties, LocalIpAddress; disabled
geo = Geometry([<curve referenced from the Rhino model> x2])  # disabled
txt = Text("192.168.126.1")
srf4pt = _4PointSurface(CornerA=panel_4, CornerB=panel_2, CornerC=panel_3, CornerD=panel_5)  # disabled
merge = Merge(Data1=panel_7, Data2=panel_6, Data3=panel_8, Data4=panel_9)  # disabled
quad = MeshQuad(CornerA=0, CornerB=1, CornerC=2, CornerD=3)  # disabled
area = Area(Geometry=geo)  # -> Area, Centroid; disabled
panel_12 = Panel("C:\Users\RYAN\Documents\GitHub\CityScope_PEV_Sim\Map\PEV_PSG AND PKG_300DPI.png")  # disabled
udp = UDPReceiver(Address="127.0.0.1", Port="7001", Pattern=0)  # -> Info, Data
txt_2 = Text(udp.Data)
split = TextSplit(Text=txt_2, Separators=panel_10)
split_2 = TextSplit(Text=split, Separators=",")
udp_2 = UDPSender(Address=txt, Port=6001, Pattern=0)  # disabled
panel_13 = Panel(txt)  # disabled
panel_14 = Panel(split_2)  # disabled
panel_15 = Panel(split)  # disabled
panel_16 = Panel("0.01")  # disabled
mesh = Mesh(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)  # disabled
swatch = ColourSwatch(SwatchColor=RGB(255, 255, 255))  # disabled
srf = Surface(srf4pt)  # disabled
panel_17 = Panel("C:\Users\RYAN\Documents\GitHub\CityScope_PEV_Sim\Map\PEV_PSG AND PKG_300DPI.png")
item = ListItem(List=area.Centroid, Index=0, Wrap=True)  # disabled
vec2pt = Vector2Pt(PointA=Point(0, 0, 0), PointB=item, Unitize=False)  # -> Vector, Length; disabled
conmesh = ConstructMesh(Vertices=merge, Faces=quad)  # disabled
panel_18 = Panel(udp.Info)  # disabled
panel_19 = Panel(udp.Data)  # disabled
mesh_2 = Mesh(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)
move = Move(Geometry=mesh, Motion=vec2pt.Vector)  # -> Geometry, Transform; disabled
mjoin = MeshJoin(Meshes=move.Geometry)  # disabled
previewmat = CustomPreviewMaterials(Geometry=mjoin, DiffuseColor=swatch, Transparency=panel_16, DiffuseBitmap=panel_12)  # disabled

# ---- group: PEV center pt
pt = Point(split)

# ----
vec2pt_2 = Vector2Pt(PointA=Point(0, 0, 0), PointB=pt, Unitize=False)  # -> Vector, Length
move_2 = Move(Geometry=mesh_2, Motion=vec2pt_2.Vector)  # -> Geometry, Transform
mjoin_2 = MeshJoin(Meshes=move_2.Geometry)
previewmat_2 = CustomPreviewMaterials(Geometry=mjoin_2, DiffuseColor=ColourSwatch(SwatchColor=RGB(255, 255, 255)), Transparency="0.01", DiffuseBitmap=panel_17)
