# Grasshopper definition 160405_ProjectionMapper_pythonOpenCV.gh (Grasshopper 0.9.76)
# plug-ins: Python Interpreter, Firefly.X, horsterCameraControl

panel = Panel("C:\Users\RYAN\Documents\GitHub\ProjectionMapper\Python\160405_openCV_test_01.py")
bmp = BitmapToDecompose()  # disabled

# ---- group: pt corner G
pt = Point(<point referenced from the Rhino model>)

# ---- group: pt corner R
pt_2 = Point(<point referenced from the Rhino model>)

# ---- group: pt corner W
pt_3 = Point(<point referenced from the Rhino model>)

# ---- group: pt corner B
pt_4 = Point(<point referenced from the Rhino model>)

# ----
pdecon = Deconstruct(Point=pt)  # -> XComponent, YComponent, ZComponent
pdecon_2 = Deconstruct(Point=pt_2)  # -> XComponent, YComponent, ZComponent
pdecon_3 = Deconstruct(Point=pt_4)  # -> XComponent, YComponent, ZComponent
pdecon_4 = Deconstruct(Point=pt_3)  # -> XComponent, YComponent, ZComponent
mesh = MeshFromImage(Bmp=bmp, Sx="640", Sy="480", Z=0, C=True)  # disabled
subtraction = Subtraction(A=pdecon.XComponent, B="-2000")
subtraction_2 = Subtraction(A=pdecon_2.XComponent, B="-2000")
subtraction_3 = Subtraction(A=pdecon_3.XComponent, B="-2000")
subtraction_4 = Subtraction(A=pdecon_4.XComponent, B="-2000")
X = UnitX(Factor="-2000")
panel_2 = Panel("293")
move = Move(Geometry=mesh, Motion=X)  # -> Geometry, Transform; disabled
division = Division(A=subtraction, B="640")
division_2 = Division(A=pdecon.YComponent, B="480")
division_3 = Division(A=subtraction_2, B="640")
division_4 = Division(A=subtraction_3, B="640")
division_5 = Division(A=pdecon_2.YComponent, B="480")
division_6 = Division(A=pdecon_3.YComponent, B="480")
division_7 = Division(A=subtraction_4, B="640")
division_8 = Division(A=pdecon_4.YComponent, B="480")
num = Number("165")
num_2 = Number("165")
panel_3 = Panel("0.75")
pt_5 = ConstructPoint(XCoordinate=division, YCoordinate=division_2, ZCoordinate=0)
pt_6 = ConstructPoint(XCoordinate=division_3, YCoordinate=division_5, ZCoordinate=0)
pt_7 = ConstructPoint(XCoordinate=division_4, YCoordinate=division_6, ZCoordinate=0)
pt_8 = ConstructPoint(XCoordinate=division_7, YCoordinate=division_8, ZCoordinate=0)

# ---- group: webcam mesh
mesh_2 = Mesh(move.Geometry)  # disabled

# ---- group: GA - target x y - fitness 0.22
number_slider = Slider(0.88453, range=-1..1)
number_slider_2 = Slider(0.24421, range=-1..1)

# ---- group: target x y - fitness 0.29
number_slider_3 = Slider(0, range=-1..1)
number_slider_4 = Slider(0, range=-1..1)

# ----
int = Integer("0")
num_3 = Number("1.0")
num_4 = Number("0.85")
num_5 = Number("1.0")

# ---- group: RGBW pts 0.0 to 1.0 - target
pt_9 = Point(pt_5)
pt_10 = Point(pt_6)
pt_11 = Point(pt_7)
pt_12 = Point(pt_8)

# ----
galapagos = Galapagos(
    fitness=num_7,
    gene=[number_slider_5, number_slider_6, number_slider_8, number_slider_7, number_slider_9, number_slider_10])
number_slider_5 = Slider(8.98178, range=-10..10)

# ---- group: Call OpenCV Python Script
python = PythonScript(active=Toggle(True), trigger=number_slider_5, pathPyOpenCV=panel)  # -> out, imgPath
# ---------- python: Python ----------
"""
ProjectionMapper

for MIT Media Lab, Changing Place Group, CityMatrix Project

by "Ryan" Yan Zhang <ryanz@mit.edu>
April.5th.2016
"""

#str01 = "x:"+str(x)+"; y:"+str(y)+"; z:"+str(z)
#print str01

if active: 
    from subprocess import call
    #call(["python", "C:\\Users\\RYAN\\Documents\\GitHub\\Realtime_Simulator\\Python\\\predictWithLR_YZ.py"])
    #print(pathPyPredict)
    call(["pythonw", pathPyOpenCV])
    # the print in called python script will not work
    imgPath = "C:\Users\RYAN\Documents\GitHub\ProjectionMapper\Data\img001.jpg"


"""
call os in gh, and pass input parameters, 
and use subprocess to call a python script with arguement, 
output to a file and have gh read csv. 
"""
# ---------- end python ----------

# ----
path = FilePath(python.imgPath)
panel_4 = Panel(path)
# ProjectionMapper
# 
# by "Ryan" Yan Zhang <ryanz@mit.edu>
# for MIT Media Lab, Changing Place Group
# April.3rd.2016
load_bitmap = LoadBitmap(FilePathToImageLocation=path)
resize = ResizeBitmap(BitmapToModify=load_bitmap, NewResolutionInXAxis="160", NewResolutionInYAxis="120")
painter = BitmapPainter(BitmapToPaint=resize)
bmp_2 = BitmapToDecompose(painter)
decompose = BitmapDecompose(BitmapToDecompose=bmp_2)  # -> RedChannel, GreenChannel, BlueChannel, AlphaChannel, XResolution, YResolution

# ---- group: purify RGBW
python_2 = PythonScript(R=decompose.RedChannel, G=decompose.GreenChannel, B=decompose.BlueChannel, sR=num_3, sG=num_4, sB=num_5)  # -> out, RM, GM, BM, WM; inputs R: list, G: list, B: list
# ---------- python_2: Python ----------
"""
ProjectionMapper

written by "Ryan" Yan Zhang <ryanz@mit.edu>
for MIT Media Lab, Changing Place Group
April.3rd.2016
"""


#import rhinoscriptsyntax as rs
#import scriptcontext as sc
#import clr
#clr.AddReference("Grasshopper")
#import Grasshopper as gh

RM = []
GM = []
BM = []
WM = []

for i in range(len(R)):
    Rf = float(R[i])
    Gf = float(G[i])
    Bf = float(B[i])
    
    RM.append(int(max(0, (Rf - Gf * sR - Bf * sR))))
    GM.append(int(max(0, (Gf - Rf * sG - Bf * sG))))
    BM.append(int(max(0, (Bf - Rf * sB - Gf * sB))))
    WM.append(int((Rf + Gf + Bf) / 3))
# ---------- end python_2 ----------

# ----
recompose = BitmapRecompose(
    RedChannel=python_2.RM,
    GreenChannel=python_2.GM,
    BlueChannel=python_2.BM,
    AlphaChannel=decompose.AlphaChannel,
    XResolution=decompose.XResolution,
    YResolution=decompose.YResolution)
painter_2 = BitmapPainter(BitmapToPaint=recompose)
average = VideoAverages(BitmapToModify=painter_2, MinimumPointOfBoundingArea=Point(0, 0, 0), MaximumPointOfBoundingArea=Point(1, 1, 0))  # -> AverageColor, AverageMovementVector, CentroidOfMovement, CentroidOfRedPixels, CentroidOfGreenPixels, CentroidOfBluePixels
recompose_2 = BitmapRecompose(
    RedChannel=python_2.WM,
    GreenChannel=python_2.WM,
    BlueChannel=python_2.WM,
    AlphaChannel=decompose.AlphaChannel,
    XResolution=decompose.XResolution,
    YResolution=decompose.YResolution)
number_slider_6 = Slider(4.13246, range=-10..10)
number_slider_7 = Slider(6.09456, range=-10..10)
number_slider_8 = Slider(-54.99881, range=-100..100)
number_slider_9 = Slider(-3.89045, range=-10..10)
threshold = BitmapThreshold(BitmapToModify=recompose_2, ThresholdValue=Slider(0.4292, range=0..1))
number_slider_10 = Slider(1.01, range=-15..15)
getcamera = GetCamera(GetCamera=Toggle(True))  # -> Location, Target, LensLength, UpDirection
decompose_2 = BitmapDecompose(BitmapToDecompose=threshold)  # -> RedChannel, GreenChannel, BlueChannel, AlphaChannel, XResolution, YResolution
vec = VectorXYZ(XComponent=number_slider_5, YComponent=number_slider_6, ZComponent=number_slider_8)  # -> Vector, Length
vec_2 = VectorXYZ(XComponent=number_slider_7, YComponent=number_slider_9, ZComponent=0)  # -> Vector, Length
recompose_3 = BitmapRecompose(
    RedChannel=decompose_2.RedChannel,
    GreenChannel=int,
    BlueChannel=int,
    AlphaChannel=decompose_2.AlphaChannel,
    XResolution=decompose_2.XResolution,
    YResolution=decompose_2.YResolution)
painter_3 = BitmapPainter(BitmapToPaint=recompose_3)
average_2 = VideoAverages(BitmapToModify=painter_3, MinimumPointOfBoundingArea=Point(0, 0, 0), MaximumPointOfBoundingArea=Point(1, 1, 0))  # -> AverageColor, AverageMovementVector, CentroidOfMovement, CentroidOfRedPixels, CentroidOfGreenPixels, CentroidOfBluePixels

# ---- group: RGBW pts 0.0 to 1.0 - current
pt_13 = Point(average_2.CentroidOfRedPixels)
pt_14 = Point(average.CentroidOfBluePixels)
pt_15 = Point(average.CentroidOfRedPixels)
pt_16 = Point(average.CentroidOfGreenPixels)

# ---- group: preview RGBW pts current location
scale_nu = ScaleNU(Geometry=pt_13, Plane=PlaneXY(0, 0, 0), ScaleX=num_2, ScaleY=num, ScaleZ=1)  # -> Geometry, Transform
scale_nu_2 = ScaleNU(Geometry=pt_15, Plane=PlaneXY(0, 0, 0), ScaleX=num_2, ScaleY=num, ScaleZ=1)  # -> Geometry, Transform
scale_nu_3 = ScaleNU(Geometry=pt_16, Plane=PlaneXY(0, 0, 0), ScaleX=num_2, ScaleY=num, ScaleZ=1)  # -> Geometry, Transform
scale_nu_4 = ScaleNU(Geometry=pt_14, Plane=PlaneXY(0, 0, 0), ScaleX=num_2, ScaleY=num, ScaleZ=1)  # -> Geometry, Transform
pt_17 = Point(scale_nu.Geometry)
pt_18 = Point(scale_nu_4.Geometry)
pt_19 = Point(scale_nu_2.Geometry)
pt_20 = Point(scale_nu_3.Geometry)
preview = CustomPreview(Geometry=pt_17, Shader=ColourSwatch(SwatchColor=RGB(48, 48, 48)))
preview_2 = CustomPreview(Geometry=pt_19, Shader=ColourSwatch(SwatchColor=RGB(64, 33, 33)))
preview_3 = CustomPreview(Geometry=pt_18, Shader=ColourSwatch(SwatchColor=RGB(36, 36, 71)))
preview_4 = CustomPreview(Geometry=pt_20, Shader=ColourSwatch(SwatchColor=RGB(27, 56, 27)))

# ----
dist = Distance(PointA=pt_16, PointB=pt_9)  # -> flatten(Distance)
dist_2 = Distance(PointA=pt_14, PointB=pt_11)  # -> flatten(Distance)
dist_3 = Distance(PointA=pt_13, PointB=pt_12)  # -> flatten(Distance)
dist_4 = Distance(PointA=pt_15, PointB=pt_10)  # -> flatten(Distance)
panel_5 = Panel(dist_4)
panel_6 = Panel(dist)
panel_7 = Panel(dist_2)
panel_8 = Panel(dist_3)
ma = MassAddition(Input=[dist_4, dist, dist_2, dist_3])  # -> Result, PartialResults
mm = MassMultiplication(Input=[dist_4, dist, dist_2, dist_3, "1000000"])  # -> Result, PartialResults

# ---- group: cam para pkl
num_6 = Number(50)
vec_3 = Vector(Vector(-0.9823992617, 0.01295774966, 0.1863431976))

# ----
addition = Addition(A=num_6, B=number_slider_10)
num_7 = Number(ma.Result)
num_8 = Number(mm.Result)
panel_9 = Panel(num_7)
panel_10 = Panel(num_8)
sec = Slider(1.5, range=0..1.5)  # disabled

# ---- group: delay
python_3 = PythonScript(sec=sec, trigger=number_slider_5)  # -> out, a; disabled
# ---------- python_3: Python ----------
import time
time.sleep(sec)
a = 0
# ---------- end python_3 ----------

# ---- group: show camera position
pt_21 = Point(Point(220.2248294, 136.7946031, 527.1816103))
pt_22 = Point(Point(119.9263107, 138.1175307, -1.683055473))

# ----
move_2 = Move(Geometry=pt_21, Motion=vec.Vector)  # -> Geometry, Transform
move_3 = Move(Geometry=pt_22, Motion=vec_2.Vector)  # -> Geometry, Transform

# ---- group: cam para modified
pt_23 = Point(move_2.Geometry)
pt_24 = Point(move_3.Geometry)
num_9 = Number(addition)
vec_4 = Vector(Vector(-0.9823992617, 0.01295774966, 0.1863431976))

# ---- group: show camera position (continued)
ln = Line(StartPoint=pt_23, EndPoint=pt_24)

# ----
setcam = SetCamera(CameraLocation=pt_23, TargetLocation=pt_24, LensLength=num_9, Activate=Toggle(True))
