# Grasshopper definition 160406_CityMatrix.gh (Grasshopper 0.9.76)
# plug-ins: DIVA.ForGrasshopper, Python Interpreter

# ---- group: original grid dimension
number_slider = Slider(34.331, range=1..100)

# ---- group: input method 1 - colortizer data
# CityMatrix
# 
# by Yan "Ryan" Zhang <ryanz@mit.edu>
# for MIT Media Lab, Changing Place Group, CityScope Project
# March.17th.2016
# Parsing Colortizer Data (CityMatrix 16x16)
panel = Panel("C:\Users\RYAN\Documents\GitHub\Realtime_Sim\Data\ColortizerData.txt")

# ----
pipeline = GeometryPipeline(
    GroupByLayer=False,
    GroupByType=False,
    IncludeHidden=True,
    IncludeLocked=True,
    LayerFilter="CityScopeTableSim02",
    NameFilter="*",
    TypeFilter=1073741848)  # disabled
txt = Text("C:\Users\RYAN\Documents\GitHub\Realtime_Sim\Data\prediction.txt")
srf = Surface(<surface referenced from the Rhino model>)

# ---- group: grid size
number_slider_2 = Slider(10.62, range=0..100)

# ---- group: building heights
number_slider_3 = Slider(0.1, range=0.1..100)
number_slider_4 = Slider(25, range=1..100)
number_slider_5 = Slider(50, range=1..100)
number_slider_6 = Slider(80, range=1..100)

# ---- group: randam seed for context
# data1: 0 to 5465
number_slider_7 = Slider(0, range=0..20000)

# ----
# Data File Visualize (difference)
panel_2 = Panel(txt)
number_slider_8 = Slider(0, range=0..100)

# ---- group: grid size
number_slider_9 = Slider(5, range=1..19)
number_slider_10 = Slider(5, range=1..19)

# ---- group: grid dimension
# Prediction Geo Setup
number_slider_11 = Slider(34.331, range=1..100)

# ---- group: building dimension
number_slider_12 = Slider(32.578, range=1..100)

# ----
# Predict
toggle = BooleanToggle(True)
panel_3 = Panel("C:\Users\RYAN\Documents\GitHub\Realtime_Sim\Python\predictWithLR_YZ.py")

# ---- group: input method 2 - rhino model
brep = Brep(pipeline)  # disabled

# ----
number_slider_13 = Slider(5465, range=0..5465)
# data2: 1 to 4500
number_slider_14 = Slider(4500, range=1..4500)
bbox = BoundingBox(Content=srf, Plane=PlaneXY(0, 0, 0))  # -> Box, Box_2
neg = Negative(Value=number_slider_2)

# ---- group: new grid size ratio
division = Division(A=number_slider_2, B=number_slider)

# ----
mesh = MeshBrep(
    Brep=brep,
    Settings={GridMaxCount=0, GridMinCount=16, JaggedSeams=False, MaxEdgeLength=0, MinEdgeLength=0.0001, MinTolerance=0, Refine=True, RefineAngle=0, RelativeTolerance=0.65, SimplePlanes=True, Tolerance=0})  # disabled
box_corners = BoxCorners(Box=bbox.Box)  # -> CornerA, CornerB, CornerC, CornerD, CornerE, CornerF, CornerG, CornerH
int = Integer(number_slider_7)
int_2 = Integer(int)
# 0, 10, 20, 50
merge = Merge(Data1=number_slider_3, Data2=number_slider_4, Data3=number_slider_5, Data4=number_slider_6)
txt_2 = Text(flatten(int_2))
txt_3 = Text(flatten("111"))
dom = ConstructDomain(DomainStart=number_slider_8, DomainEnd=number_slider_2)
dom_2 = ConstructDomain(DomainStart=number_slider_8, DomainEnd=neg)

# ---- group: colortizer data
file = ReadFile(File=panel, PerLineParse=True)

# ----
recgrid = Rectangular(
    Plane=PlaneXY(0, 0, 0),
    SizeX=number_slider_11,
    SizeY=number_slider_11,
    ExtentX=number_slider_9,
    ExtentY=number_slider_10)  # -> Cells, Points
mjoin = MeshJoin(Meshes=mesh)  # disabled

# ---- group: colortizer orgin
pt = Point(box_corners.CornerD)

# ----
# temp blocks
xy = XYPlane(Origin=pt)

# ---- group: prediction.txt
file_2 = ReadFile(File=panel_2, PerLineParse=True)

# ----
split = SplitList(List=file, Index=1)  # -> ListA, ListB
end = EndPoints(Curve=recgrid.Cells)  # -> Start, End
split_2 = TextSplit(Text=file_2, Separators=",")
pshift = ShiftPaths(Data=end.Start, Offset=-1)
lng = ListLength(List=pshift)
eval = Evaluate(F="int((x+1)/2)", x=lng)
subtraction = Subtraction(A=eval, B=2)
split_3 = TextSplit(Text=split.ListA, Separators="\t")
split_4 = TextSplit(Text=split.ListB, Separators="\t")
num = Number(split_2)
dom_3 = ConstructDomain(DomainStart=0, DomainEnd=subtraction)
subtraction_2 = Subtraction(A=lng, B=1)
pshift_2 = ShiftPaths(Data=split_4, Offset=1)
panel_4 = Panel(num)
pshift_3 = ShiftPaths(Data=split_3, Offset=1)
addition = Addition(A=subtraction, B=1)
subset = SubList(List=pshift, Domain=dom_3, Wrap=False)  # -> List, Index
dom_4 = ConstructDomain(DomainStart=eval, DomainEnd=subtraction_2)
pshift_4 = ShiftPaths(Data=pshift_2, Offset=1)
pshift_5 = ShiftPaths(Data=pshift_3, Offset=1)
division_2 = Division(A=number_slider_2, B=2)
division_3 = Division(A=number_slider_2, B=2)
item = ListItem(List=pshift, Index=addition, Wrap=True)
subset_2 = SubList(List=pshift, Domain=dom_4, Wrap=False)  # -> List, Index
int_3 = Integer(pshift_4)
txt_4 = Text(pshift_5)
Z = UnitZ(Factor=1)
merge_2 = Merge(Data1=subset.List, Data2=subset_2.List)

# ---- group: data tree to python list example
python = PythonScript()  # -> out, a; inputs DataTree: tree of Int32; disabled
# ---------- python: Python ----------
import clr
clr.AddReference("Grasshopper")
import Grasshopper as gh


def ghDataTreeToPythonList(dataTree):
    
    """ Converts a GH datatree to a nested Python list """
    
    # Create an empty Python list
    pyList = []
    
    # Add the branches of the Gh datatree to this list
    for i in range(DataTree.BranchCount):
        branch = list(DataTree.Branch(i))
        pyList.append(branch)
        
    return pyList

def pythonListTGhDataTree(pythonList):
    
    """ Converts a  nested Python list to a GH datatree """
    
    # Create GH datatree
    dataTree = gh.DataTree[int]()
    
    # Add pythonlist sub lists to dataTree
    for i,l in enumerate(pythonList):
        for v in l:
            dataTree.Add(v,gh.Kernel.Data.GH_Path(i))
            
    return dataTree


# Convert the GH DataTree to nested list and check its content
pyList = ghDataTreeToPythonList(DataTree)
print type(pyList)
print len(pyList)
print pyList[0]
print pyList

# Do something with pyList 
pyList = [[j + 2 for j in sublist] for sublist in pyList]
print pyList

# Convert pyList to Gh Datatree and return it to GH
a = pythonListTGhDataTree(pyList)
# ---------- end python ----------

# ----
panel_5 = Panel(txt_4)
panel_6 = Panel(int_3)
number_slider_15 = Slider(300, range=0..1000)
dom_5 = ConstructDomain(DomainStart=0, DomainEnd=Slider(25, range=0.1..100))
lng_2 = ListLength(List=merge_2)

# ---- group: starting pt (except centeral one)
pt_2 = Point(merge_2)

# ---- group: centeral starting pt
pt_3 = Point(item)

# ----
xy_2 = XYPlane(Origin=pt_3)
xy_3 = XYPlane(Origin=pt_2)
dom_6 = ConstructDomain(DomainStart=0, DomainEnd=number_slider_12)
box = DomainBox(Base=xy_2, X=dom_6, Y=dom_6, Z=dom_5)

# ---- group: sticky["blnInitiated"]
python_2 = PythonScript()  # -> out, blnInitiated
# ---------- python_2: Python ----------
"""
Realtime Simulator

written by Yan "Ryan" Zhang <ryanz@mit.edu>
for MIT Media Lab, Changing Place Group, CityScope Project
March.7th.2016
"""


import scriptcontext as sc

sc.sticky["blnInitiated"] = False
blnInitiated = sc.sticky["blnInitiated"]
# ---------- end python_2 ----------

# ----
neg_2 = Negative(Value=number_slider_15)

# ---- group: result difference
num_2 = Number(panel_4)

# ----
number_slider_16 = Slider(43, range=0..1000)  # disabled
bnd = Bounds(Numbers=num_2)
dom_7 = ConstructDomain(DomainStart=neg_2, DomainEnd=number_slider_15)

# ---- group: center blank replacement
brep_2 = Brep(box)

# ----
panel_7 = Panel(python_2.blnInitiated)
panel_8 = Panel(python_2.out)
remap = RemapNumbers(Value=num_2, Source=dom_7, Target=Domain(0, 1))  # -> Mapped, Clipped
toggle_activate = BooleanToggle(True)
merge_3 = Merge(
    Data1=ColourSwatch(SwatchColor=RGBA(0, 0, 0, 0)),
    Data2=ColourSwatch(SwatchColor=RGB(0, 128, 128)),
    Data3=ColourSwatch(SwatchColor=RGB(128, 87, 0)),
    Data4=ColourSwatch(SwatchColor=RGB(30, 128, 0)))
item_2 = ListItem(List=panel_6, Index="3", Wrap=False)
item_3 = ListItem(List=panel_6, Index="0", Wrap=False)
item_4 = ListItem(List=panel_6, Index="1", Wrap=False)
item_5 = ListItem(List=panel_6, Index="2", Wrap=False)
gradient = Gradient(LowerLimit=0, UpperLimit=1, Parameter=remap.Mapped, stops=[0: RGB(0, 128, 0), 0.5: RGB(255, 255, 0), 1: RGB(255, 0, 0)])
X = UnitX(Factor=Slider(1000, range=0..1000))

# ---- group: rotation
pshift_6 = ShiftPaths(Data=item_2, Offset=-1)

# ---- group: module id
pshift_7 = ShiftPaths(Data=item_3, Offset=-1)

int_4 = Integer(pshift_7)

# ----
lng_3 = ListLength(List=int_4)
larger = LargerThan(FirstNumber=int_4, SecondNumber="2")  # -> LargerThan, OrEqualTo
repeat = RepeatData(Data="-1", Length=lng_3)

# ---- group: filter id larger than 2
p_n_c = PickNChoose(Pattern=larger.LargerThan, Stream0=int_4, Stream1=repeat)

# ---- group: id to selection
addition_2 = Addition(A=p_n_c, B="1")

# ----
item_6 = ListItem(List=merge, Index=addition_2, Wrap=False)
multiplication = Multiplication(A=item_6, B=division)

# ---- group: height from colotizer
num_3 = Number(multiplication)

# ---- group: height!
num_4 = Number(num_3)

# ----
division_4 = Division(A=num_4, B=Slider(2, range=0..10))
dom_8 = ConstructDomain(DomainStart=number_slider_8, DomainEnd=division_4)
box_2 = DomainBox(Base=xy, X=dom, Y=dom_2, Z=dom_8)
panel_9 = Panel(num_3)
item_7 = ListItem(List=merge_3, Index=addition_2, Wrap=False)

# ---- group: x
pshift_8 = ShiftPaths(Data=item_4, Offset=-1)

# ----
multiplication_2 = Multiplication(A=pshift_8, B=number_slider_2)
addition_3 = Addition(A=multiplication_2, B=division_2)
X_2 = UnitX(Factor=multiplication_2)
move = Move(Geometry=box_2, Motion=X_2)  # -> Geometry, Transform

# ---- group: y
pshift_9 = ShiftPaths(Data=item_5, Offset=-1)

# ----
multiplication_3 = Multiplication(A=pshift_9, B=neg)
subtraction_3 = Subtraction(A=multiplication_3, B=division_3)
pt_4 = PointOriented(BasePlane=xy, UComponent=addition_3, VComponent=subtraction_3, WComponent=0)
line = LineSDL(Start=pt_4, Direction=Z, Length="100")
mcx = MeshCurve(Mesh=mjoin, Curve=line)  # -> Points, Faces; disabled
pdecon = Deconstruct(Point=mcx.Points)  # -> XComponent, YComponent, ZComponent; disabled
maxnum = MaxNum(num=pdecon.ZComponent)  # disabled
pshift_10 = ShiftPaths(Data=maxnum, Offset=-1)  # disabled

# ---- group: height from rhino model
num_5 = Number(pshift_10)  # disabled

num_6 = Number(num_5)

# ----
panel_10 = Panel(num_5)  # disabled
Y = UnitY(Factor=multiplication_3)
move_2 = Move(Geometry=move.Geometry, Motion=Y)  # -> Geometry, Transform

# ---- group: Parsed volume
box_3 = Box(move_2.Geometry)

# ----
item_8 = ListItem(List=box_3, Index=number_slider_16, Wrap=True)  # disabled

# ---- group: current and last heights
# trigger01 means height changed or not
python_3 = PythonScript(x=num_4)  # -> out, currentHeights, lastHeights, blnInitiated, trigger01; inputs x: list
# ---------- python_3: Python ----------
"""
Realtime Simulator

written by Yan "Ryan" Zhang <ryanz@mit.edu>
for MIT Media Lab, Changing Place Group, CityScope Project
March.7th.2016
"""

import scriptcontext as sc

if sc.sticky["blnInitiated"] == False: 
    sc.sticky["blnInitiated"] = True
    sc.sticky["lastHeights"] = x
    sc.sticky["currentHeights"] = x
else: 
    sc.sticky["lastHeights"] = sc.sticky["currentHeights"]
    sc.sticky["currentHeights"] = x


blnInitiated = sc.sticky["blnInitiated"]
lastHeights = sc.sticky["lastHeights"]
currentHeights = sc.sticky["currentHeights"]

if not lastHeights == currentHeights:
    trigger01 = True
else:
    trigger01 = False
# ---------- end python_3 ----------

# ---- group: sticky predicted difference result
# Update Predicted Influence
python_4 = PythonScript(x=num_2, trigger01=python_3.trigger01)  # -> out, predDiff, trigger02; inputs x: list
# ---------- python_4: Python ----------
"""
Realtime Simulator

written by Yan "Ryan" Zhang <ryanz@mit.edu>
for MIT Media Lab, Changing Place Group, CityScope Project
March.7th.2016
"""

import scriptcontext as sc

if trigger01:
    
    predDiff = []
    
    for n in range(int(len(x)/49.0+0.5)):
        predDiff.append(x[(n*49):((n+1)*49)])
    
    print predDiff
    
    sc.sticky["predDiff"] = predDiff
    
    trigger02 = True
    
else:
    
    trigger02 = False
# ---------- end python_4 ----------

# ----
panel_11 = Panel(python_4.trigger02)

# ---- group: update predicted influence
python_5 = PythonScript(trigger02=python_4.trigger02, predDiff=python_4.predDiff)  # -> out, trigger03; inputs predDiff: list
# ---------- python_5: Python ----------
"""
Realtime Simulator

written by Yan "Ryan" Zhang <ryanz@mit.edu>
for MIT Media Lab, Changing Place Group, CityScope Project
March.7th.2016
"""


import rhinoscriptsyntax as rs
import scriptcontext as sc
import clr
clr.AddReference("Grasshopper")
import Grasshopper as gh


# call main()
if trigger02:
    a = main()
    trigger03 = True
else:
    trigger03 = False


# main function
def main():
    currentHeights = sc.sticky["currentHeights"]
    lastHeights = sc.sticky["lastHeights"]
    bufferMatrix = sc.sticky["bufferMatrix"]
    allNodeZ = sc.sticky["allNodeZ"]
    allNodeV = sc.sticky["allNodeV"]
    print "bufferMatrix: \n", bufferMatrix, "\n"
    nc = bufferMatrix[2][2][3]
    print "center piece nc =", nc
    print "center piece current height: ", currentHeights[nc]
    print "center piece last height: ", lastHeights[nc]
    predDiffOrder = [[2,2],[0,4],[0,3],[0,2],[0,1],[0,0],[1,4],[1,3],[1,2],[1,1],[1,0],[2,4],[2,3],[2,1],[2,0],[3,4],[3,3],[3,2],[3,1],[3,0],[4,4],[4,3],[4,2],[4,1],[4,0]]
    
    # figure out the height change direction: add or remove
    if currentHeights[nc] > lastHeights[nc]:
        # added a center piece, influence will be positive
        print "Added a center piece. "
        influenceDirection = .65
    elif currentHeights[nc] < lastHeights[nc]:
        # removed a center piece, influence will be negative
        print "Removed a center piece. "
        influenceDirection = - .65
    else:
        # center piece didn't change: error!
        print "ERROR: CENTER PIECE HEIGHT DIDN'T CHANGE!!! "
    
    # update center piece nodes' z value
    tmpNodeZ = allNodeZ[nc] #mutable
    for n in range(len(tmpNodeZ)):
        tmpNodeZ[n] = currentHeights[nc]
    
    # apply the influence prediction
    for i in range(len(predDiffOrder)):
        #print "i =", i
        p = predDiffOrder[i]
        #print "p = predDiffOrder[i] =", p 
        n = bufferMatrix[p[1]][p[0]][3]
        #print "n =", n
        v = bufferMatrix[p[1]][p[0]][2]
        #print "v =", v
        if v == 1:
            nodeV = allNodeV[n]
            predV = predDiff[i]
            for j in range(len(nodeV)):
                nodeV[j] += predV[j] * influenceDirection
    
    # output a, need to pass outside the main function!
    #return a


# project functions
# given x step and y step return height id
def xy2n(x,y):
    n = y + (15 - x) * 16
    return n


# library functions
# gh data tree and py list
def ghDataTreeToPythonList(dataTree):
    
    """ Converts a GH datatree to a nested Python list """
    
    # Create an empty Python list
    pyList = []
    
    # Add the branches of the Gh datatree to this list
    for i in range(DataTree.BranchCount):
        branch = list(DataTree.Branch(i))
        pyList.append(branch)
        
    return pyList

def pythonListTGhDataTree(pythonList):
    
    """ Converts a  nested Python list to a GH datatree """
    
    # Create GH datatree
    dataTree = gh.DataTree[int]()
    
    # Add pythonlist sub lists to dataTree
    for i,l in enumerate(pythonList):
        for v in l:
            dataTree.Add(v,gh.Kernel.Data.GH_Path(i))
            
    return dataTree

def dataTreePythonListExample():
    # Convert the GH DataTree to nested list and check its content
    pyList = ghDataTreeToPythonList(DataTree)
    print type(pyList)
    print len(pyList)
    print pyList[0]
    print pyList
    
    # Do something with pyList 
    pyList = [[j + 2 for j in sublist] for sublist in pyList]
    print pyList
    
    # Convert pyList to Gh Datatree and return it to GH
    a = pythonListTGhDataTree(pyList)
# ---------- end python_5 ----------

# ----
panel_12 = Panel(python_5.trigger03)

# ---- group: compare get surrounding for predict export
python_6 = PythonScript(trigger01=python_3.trigger01)  # -> out, heights
# ---------- python_6: Python ----------
"""
Realtime Simulator

written by Yan "Ryan" Zhang <ryanz@mit.edu>
for MIT Media Lab, Changing Place Group, CityScope Project
March.7th.2016
"""


import rhinoscriptsyntax as rs
import scriptcontext as sc
import clr
clr.AddReference("Grasshopper")
import Grasshopper as gh


# call main()
if trigger01 and sc.sticky["blnInitiated"] == True:
    heights = main()


# main function
def main():
    currentHeights = sc.sticky["currentHeights"]
    lastHeights = sc.sticky["lastHeights"]
    diffs = []
    for i in range(0, len(currentHeights)):
        hc = currentHeights[i]
        hl = lastHeights[i]
        if not hc == hl:
            diffs.append(i)
    
    if len(diffs) > 0:
        
        xSteps = sc.sticky["xSteps"]
        ySteps = sc.sticky["ySteps"]
        for diff in diffs:
            print "differet module found! at number: ", diff
            print "x step = ", xSteps[diff]
            print "y step = ", ySteps[diff]
            print "lastHeights = ", lastHeights[diff]
            print "currentHeights = ", currentHeights[diff]
        
        # do the first diff first, TODO: loop each diff later
        diff = diffs[0]
        xs = range(int(xSteps[diff])-2,int(xSteps[diff])+2+1)
        ys = range(int(ySteps[diff])-2,int(ySteps[diff])+2+1)
        
        # bufferMatrix: 5 by 5 matrix (list of list), element is a list of
        # [x, y, valid(in bound), n(order in data list), height] 
        # if not valid, height = 0.030934
        
        # initiate bufferMatrix
        bufferMatrix = [[[],[],[],[],[]],
                        [[],[],[],[],[]],
                        [[],[],[],[],[]],
                        [[],[],[],[],[]],
                        [[],[],[],[],[]]]
        #for i in range(5): tempRow.append([0,0,0,0,0]) #doesn't work!
        
        # fill bufferMatrix
        for j in range(5):
            for i in range(5):
                #print "i: ", i, "; j: ", j
                x = xs[i]
                y = ys[j]
                #print "x: ", x, "; y: ", y
                if x >= 0 and x <= 15 and y >= 0 and y <= 15:
                    v = 1 #valid/in bound = 1, not valid = 0
                    n = xy2n(x,y)
                    h = lastHeights[n]
                else: 
                    v = 0 #not valid
                    n = -1 #not valid
                    h = 0.030934
                bufferMatrix[j][i] = [x,y,v,n,h]
        print "bufferMatrix: - [x,y,v,n,h]\n", bufferMatrix
        sc.sticky["bufferMatrix"] = bufferMatrix
        
        # export height list in right order
        # first is the center and then y 4 to 0, then x 0 to 4
        hs = []
        hs.append(bufferMatrix[2][2][4])
        n = 1
        for i in range(0,5):
            for j in range(0,5):
                if not (i==2 and 4-j==2):
                    #print "x: ", i, "; y: ", 4-j, "; n: ", n
                    hs.append(bufferMatrix[4-j][i][4])
                    n += 1
        print "height list hs[]: \n", hs
    
    # output heights, need to pass outside the main function!
    return hs


# project functions
# given x step and y step return height id
def xy2n(x,y):
    n = y + (15 - x) * 16
    return n


# library functions
# gh data tree and py list
def ghDataTreeToPythonList(dataTree):
    
    """ Converts a GH datatree to a nested Python list """
    
    # Create an empty Python list
    pyList = []
    
    # Add the branches of the Gh datatree to this list
    for i in range(DataTree.BranchCount):
        branch = list(DataTree.Branch(i))
        pyList.append(branch)
        
    return pyList

def pythonListTGhDataTree(pythonList):
    
    """ Converts a  nested Python list to a GH datatree """
    
    # Create GH datatree
    dataTree = gh.DataTree[int]()
    
    # Add pythonlist sub lists to dataTree
    for i,l in enumerate(pythonList):
        for v in l:
            dataTree.Add(v,gh.Kernel.Data.GH_Path(i))
            
    return dataTree

def dataTreePythonListExample():
    # Convert the GH DataTree to nested list and check its content
    pyList = ghDataTreeToPythonList(DataTree)
    print type(pyList)
    print len(pyList)
    print pyList[0]
    print pyList
    
    # Do something with pyList 
    pyList = [[j + 2 for j in sublist] for sublist in pyList]
    print pyList
    
    # Convert pyList to Gh Datatree and return it to GH
    a = pythonListTGhDataTree(pyList)
# ---------- end python_6 ----------

# ----
panel_13 = Panel(python_6.heights)
panel_14 = Panel(python_6.out)
panel_15 = Panel(pshift_8)
panel_16 = Panel(pshift_9)
panel_17 = Panel(pshift_6)
panel_18 = Panel(pshift_7)
division_5 = Division(A=panel_13, B=division)
preview = CustomPreview(Geometry=box_3, Shader=item_7)
swatch = ColourSwatch(SwatchColor=RGBA(171, 190, 255, 150))
swatch_2 = ColourSwatch(SwatchColor=RGBA(191, 191, 191, 75))

# ---- group: center building block geometry
brep_3 = Brep(brep_2)

# ----
multiplication_4 = Multiplication(A=division_5, B=10)
panel_19 = Panel(python_3.blnInitiated)
panel_20 = Panel(python_3.lastHeights)
panel_21 = Panel(python_3.out)
int_5 = Integer(multiplication_4)
division_6 = Division(A=int_5, B=10)
panel_22 = Panel(division_6)
panel_23 = Panel(python_3.currentHeights)
removebreptoporbottom = RemoveBrepTopOrBottom(brep=brep_3, bool=True)
preview_2 = CustomPreview(Geometry=removebreptoporbottom, Shader=swatch)

# ---- group: sticky rotations
python_7 = PythonScript(x=panel_17)  # -> out, rotations; inputs x: list
# ---------- python_7: Python ----------
"""
Realtime Simulator

written by Yan "Ryan" Zhang <ryanz@mit.edu>
for MIT Media Lab, Changing Place Group, CityScope Project
March.7th.2016
"""

import scriptcontext as sc

sc.sticky["rotations"] = x

rotations = sc.sticky["rotations"]
# ---------- end python_7 ----------

# ---- group: sticky y steps
python_8 = PythonScript(x=panel_16)  # -> out, ySteps; inputs x: list
# ---------- python_8: Python ----------
"""
Realtime Simulator

written by Yan "Ryan" Zhang <ryanz@mit.edu>
for MIT Media Lab, Changing Place Group, CityScope Project
March.7th.2016
"""

import scriptcontext as sc

sc.sticky["ySteps"] = x

ySteps = sc.sticky["ySteps"]
# ---------- end python_8 ----------

# ---- group: sticky moduleIDs
python_9 = PythonScript(x=panel_18)  # -> out, moduleIDs; inputs x: list
# ---------- python_9: Python ----------
"""
Realtime Simulator

written by Yan "Ryan" Zhang <ryanz@mit.edu>
for MIT Media Lab, Changing Place Group, CityScope Project
March.7th.2016
"""

import scriptcontext as sc

sc.sticky["moduleIDs"] = x

moduleIDs = sc.sticky["moduleIDs"]
# ---------- end python_9 ----------

# ---- group: sticky x steps
python_10 = PythonScript(x=panel_15)  # -> out, xSteps; inputs x: list
# ---------- python_10: Python ----------
"""
Realtime Simulator

written by Yan "Ryan" Zhang <ryanz@mit.edu>
for MIT Media Lab, Changing Place Group, CityScope Project
March.7th.2016
"""

import scriptcontext as sc

sc.sticky["xSteps"] = x

xSteps = sc.sticky["xSteps"]
# ---------- end python_10 ----------

# ----
panel_24 = Panel(python_7.rotations)
panel_25 = Panel(python_7.out)
panel_26 = Panel(python_8.ySteps)
panel_27 = Panel(python_8.out)
panel_28 = Panel(python_10.xSteps)
panel_29 = Panel(python_10.out)
panel_30 = Panel(python_9.moduleIDs)
panel_31 = Panel(python_9.out)

# ---- group: heights for predict
num_7 = Number(panel_22)

# ----
number_slider_17 = Slider(1000, range=0..1000)
split_5 = SplitList(List=num_7, Index=1)  # -> ListA, ListB
num_8 = Number(split_5.ListA)
txt_5 = Text(flatten(num_8))
dom_9 = ConstructDomain(DomainStart=0, DomainEnd=split_5.ListA)
dom_10 = ConstructDomain(DomainStart=0, DomainEnd=split_5.ListB)
box_4 = DomainBox(Base=xy_3, X=dom_6, Y=dom_6, Z=dom_10)
box_5 = DomainBox(Base=xy_2, X=dom_6, Y=dom_6, Z=dom_9)
pshift_11 = ShiftPaths(Data=box_5, Offset=-1)
pshift_12 = ShiftPaths(Data=pshift_11, Offset=-1)

# ---- group: context geometry
brep_4 = Brep(box_4)

# ----
removebreptoporbottom_2 = RemoveBrepTopOrBottom(brep=brep_4, bool=True)
preview_3 = CustomPreview(Geometry=removebreptoporbottom_2, Shader=swatch_2)
X_3 = UnitX(Factor=number_slider_17)
X_4 = UnitX(Factor=number_slider_17)
move_3 = Move(Geometry=removebreptoporbottom, Motion=X_3)  # -> Geometry, Transform
move_4 = Move(Geometry=removebreptoporbottom_2, Motion=X_4)  # -> Geometry, Transform
preview_4 = CustomPreview(Geometry=move_3.Geometry, Shader=swatch)
preview_5 = CustomPreview(Geometry=move_4.Geometry, Shader=swatch_2)

# ---- group: node base srf
# Nodes
brep_5 = Brep([brep_4, brep_3])

# ----
unit_width = Slider(5, range=0..10)
unit_height = Slider(5, range=0..10)

unit_width_2 = Slider(1.5, range=0..10)
unit_height_2 = Slider(4.2, range=0..10)

extractbreptoporbottom = ExtractBrepTopOrBottom(brep=brep_5, bool=True)
debrep = DeconstructBrep(Brep=brep_5)  # -> Faces, Edges, Vertices
srf_2 = Surface(reparameterize(flatten(extractbreptoporbottom)))
num_9 = Number(unit_width)
num_10 = Number(unit_height)

# ---- group: glass srf
srf_3 = Surface(reparameterize(graft(srf_2)))

# ----
dim = Dimensions(Surface=srf_3)  # -> UDimension, VDimension
area = Area(Geometry=srf_2)  # -> Area, Centroid
division_7 = Division(A=dim.VDimension, B=num_10)
division_8 = Division(A=dim.UDimension, B=num_9)

# ---- group: Parsed volume
# Initiation Solar Sim
# Nodes
box_6 = Box(box_3)  # disabled

# ----
divide = DivideDomain²(Domain=srf_3, UCount=division_8, VCount=division_7)
pdecon_2 = Deconstruct(Point=area.Centroid)  # -> XComponent, YComponent, ZComponent
subsrf = Isotrim(Surface=srf_3, Domain=divide)

# ---- group: input building height
num_11 = Number(pdecon_2.ZComponent)

# ---- group: result geo
srf_4 = Surface(reparameterize(flatten(subsrf)))

# ----
move_5 = Move(Geometry=srf_4, Motion=X)  # -> Geometry, Transform

# ---- group: result
preview_6 = CustomPreview(Geometry=move_5.Geometry, Shader=gradient)

# ----
removebreptoporbottom_3 = RemoveBrepTopOrBottom(brep=box_6, bool=True)  # disabled
join = BrepJoin(Breps=flatten(brep_5))  # -> Breps, Closed
area_2 = Area(Geometry=srf_4)  # -> Area, Centroid
nodes_offset_out = Slider(0.1, range=0..1)
mesh_2 = MeshBrep(
    Brep=join.Breps,
    Settings={GridMaxCount=0, GridMinCount=16, JaggedSeams=False, MaxEdgeLength=0, MinEdgeLength=0.0001, MinTolerance=0, Refine=True, RefineAngle=0, RelativeTolerance=0.65, SimplePlanes=True, Tolerance=0})
srf_5 = Surface(removebreptoporbottom_3)  # disabled
mjoin_2 = MeshJoin(Meshes=mesh_2)
meshcp = MeshClosestPoint(Point=area_2.Centroid, Mesh=mjoin_2)  # -> Point, Index, Parameter
meval = MeshEval(Mesh=mjoin_2, Parameter=meshcp.Parameter)  # -> Point, Normal, Colour

# ---- group: node base srf
brep_6 = Brep(srf_5)  # disabled

# ----
unit_width_3 = Slider(5, range=0..10)  # disabled
unit_height_3 = Slider(5, range=0..10)  # disabled

amp = Amplitude(Vector=meval.Normal, Amplitude=nodes_offset_out)
move_6 = Move(Geometry=area_2.Centroid, Motion=amp)  # -> Geometry, Transform
srf_6 = Surface(reparameterize(flatten(brep_6)))  # disabled

# ---- group: testing nodes
pt_5 = Point(move_6.Geometry)

# Data Export
pt_6 = Point(pt_5)

# ----
pdecon_3 = Deconstruct(Point=pt_6)  # -> XComponent, YComponent, ZComponent
subtraction_4 = Subtraction(A=pdecon_3.ZComponent, B=0.1)
merge_4 = Merge(Data1=graft(pdecon_3.XComponent), Data2=graft(pdecon_3.YComponent), Data3=graft(subtraction_4))
join_2 = TextJoin(Text=merge_4, Join=",")
pshift_13 = ShiftPaths(Data=join_2, Offset=-1)
panel_32 = Panel(pshift_13)
txt_6 = Text(flatten(panel_32))
merge_5 = Merge(
    Data1="[start]central building height",
    Data2=txt_5,
    Data3="[end]central building height",
    Data4="[start]random seed number",
    Data5=txt_2,
    Data6="[end]random seed number",
    Data7="[start]input node coordination",
    Data8=txt_6,
    Data9="[end]input node coordination",
    Data10="[start]node reads difference",
    Data11=txt_3,
    Data12="[end]node reads difference")

# ---- group: data to export
panel_33 = Panel(merge_5)

# ---- group: write txt file
vb = VBScript(
    filePath="C:\Users\RYAN\Documents\GitHub\Realtime_Sim\Data\Xtest.txt",
    data=panel_33,
    append=False,
    activate=toggle_activate)  # -> out, A; inputs data: list
# ---------- vb: VB ----------
    'Code by Victor Leung @ www.dreamationworks.com
    If activate Then

      Dim i As Integer
      Dim aryText(4) As String

      aryText(0) = "Mary WriteLine"
      aryText(1) = "Had"
      aryText(2) = "Another"
      aryText(3) = "Little"
      aryText(4) = "One"

      ' the data is appended to the file. If file doesnt exist, a new file is created
      Dim objWriter As New System.IO.StreamWriter(filePath, append)

      For i = 0 To data.Count - 1
        objWriter.WriteLine(data(i))
      Next

      objWriter.Close()

    End If

    If clearFile Then
      Dim objWriter As New System.IO.StreamWriter(filePath, False)
      objWriter.Close()
    End If
# ---------- end vb ----------

# ---- group: Call Predict Python Script
python_11 = PythonScript(active=toggle, trigger=vb.A, pathPyPredict=panel_3)  # -> out, predictionPath
# ---------- python_11: Python ----------
"""
Realtime Simulator

for MIT Media Lab, Changing Place Group, CityScope Project

by Yan Zhang (Ryan) <ryanz@mit.edu>
March.7th.2016
"""

#str01 = "x:"+str(x)+"; y:"+str(y)+"; z:"+str(z)
#print str01

if active: 
    from subprocess import call
    #call(["python", "C:\\Users\\RYAN\\Documents\\GitHub\\Realtime_Simulator\\Python\\\predictWithLR_YZ.py"])
    #print(pathPyPredict)
    call(["pythonw", pathPyPredict])
    # the print in called python script will not work
    predictionPath = "C:\Users\RYAN\Documents\GitHub\Realtime_Sim\Data\prediction.txt"


"""
call os in gh, and pass input parameters, 
and use subprocess to call a python script with arguement, 
output to a file and have gh read csv. 
"""
# ---------- end python_11 ----------

# ----
panel_34 = Panel(python_11.predictionPath)

# ---- group: glass srf
srf_7 = Surface(reparameterize(graft(srf_6)))  # disabled

# ----
multiplication_5 = Multiplication(A=unit_width_3, B=division)  # disabled
multiplication_6 = Multiplication(A=unit_height_3, B=division)  # disabled
num_12 = Number(multiplication_5)  # disabled
num_13 = Number(multiplication_6)  # disabled
dim_2 = Dimensions(Surface=srf_7)  # -> UDimension, VDimension; disabled
area_3 = Area(Geometry=srf_6)  # -> Area, Centroid; disabled
division_9 = Division(A=dim_2.VDimension, B=num_13)  # disabled
division_10 = Division(A=dim_2.UDimension, B=num_12)  # disabled
divide_2 = DivideDomain²(Domain=srf_7, UCount=division_10, VCount=division_9)  # disabled
pdecon_4 = Deconstruct(Point=area_3.Centroid)  # -> XComponent, YComponent, ZComponent; disabled
subsrf_2 = Isotrim(Surface=srf_7, Domain=divide_2)  # disabled

# ---- group: input building height
num_14 = Number(pdecon_4.ZComponent)  # disabled

# ---- group: result geo
srf_8 = Surface(reparameterize(flatten(subsrf_2)))  # disabled

# ----
evalsrf = EvaluateSurface(Surface=srf_8, Point=Point(0.5, 0.5, 0))  # -> Point, Normal, Frame; disabled
join_3 = BrepJoin(Breps=flatten(brep_6))  # -> Breps, Closed; disabled
nodes_offset_out_2 = Slider(0.1, range=0..1)  # disabled
mesh_3 = MeshBrep(
    Brep=join_3.Breps,
    Settings={GridMaxCount=0, GridMinCount=16, JaggedSeams=False, MaxEdgeLength=0, MinEdgeLength=0.0001, MinTolerance=0, Refine=True, RefineAngle=0, RelativeTolerance=0.65, SimplePlanes=True, Tolerance=0})  # disabled
mjoin_3 = MeshJoin(Meshes=mesh_3)  # disabled
meshcp_2 = MeshClosestPoint(Point=evalsrf.Point, Mesh=mjoin_3)  # -> Point, Index, Parameter; disabled
meval_2 = MeshEval(Mesh=mjoin_3, Parameter=meshcp_2.Parameter)  # -> Point, Normal, Colour; disabled
amp_2 = Amplitude(Vector=meval_2.Normal, Amplitude=nodes_offset_out_2)  # disabled

# ---- group: pickled initial testing nodes - rhino model
pt_7 = Point([Point(1160.084924, 160.0154184, 0.130934), Point(1160.084924, 161.5325612, 0.130934), Point(1160.084924, 163.0497041, 0.130934), Point(1160.084924, 164.5668469, 0.130934), Point(1160.084924, 166.0839898, 0.130934), Point(1160.084924, 167.6011327, 0.130934)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])

# ----
move_7 = Move(Geometry=evalsrf.Point, Motion=amp_2)  # -> Geometry, Transform; disabled

# ---- group: pickled initial testing nodes - Ryiadh
pt_8 = Point([Point(1160.084924, 160.0154184, 0.1309341412), Point(1160.084924, 161.5325612, 0.1309341412), Point(1160.084924, 163.0497041, 0.1309341412), Point(1160.084924, 164.5668469, 0.1309341412), Point(1160.084924, 166.0839898, 0.1309341412), Point(1160.084924, 167.6011327, 0.1309341412)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])

# ----
pdecon_5 = Deconstruct(Point=pt_8)  # -> XComponent, YComponent, ZComponent

# ---- group: sticky allNodeZ
python_12 = PythonScript(x=pdecon_5.ZComponent)  # -> out, allNodeZ; inputs x: list
# ---------- python_12: Python ----------
"""
Realtime Simulator

written by Yan "Ryan" Zhang <ryanz@mit.edu>
for MIT Media Lab, Changing Place Group, CityScope Project
March.7th.2016
"""

import scriptcontext as sc

allNodeZ = []

for n in range(int(len(x)/49.0+0.5)):
    allNodeZ.append(x[(n*49):((n+1)*49)])

sc.sticky["allNodeZ"] = allNodeZ
# ---------- end python_12 ----------

# ---- group: sticky allNodeY
python_13 = PythonScript(x=pdecon_5.YComponent)  # -> out, allNodeY; inputs x: list
# ---------- python_13: Python ----------
"""
Realtime Simulator

written by Yan "Ryan" Zhang <ryanz@mit.edu>
for MIT Media Lab, Changing Place Group, CityScope Project
March.7th.2016
"""

import scriptcontext as sc

allNodeY = []

for n in range(int(len(x)/49.0+0.5)):
    allNodeY.append(x[(n*49):((n+1)*49)])

sc.sticky["allNodeY"] = allNodeY
# ---------- end python_13 ----------

# ---- group: sticky allNodeX
python_14 = PythonScript(x=pdecon_5.XComponent)  # -> out, allNodeX; inputs x: list
# ---------- python_14: Python ----------
"""
Realtime Simulator

written by Yan "Ryan" Zhang <ryanz@mit.edu>
for MIT Media Lab, Changing Place Group, CityScope Project
March.7th.2016
"""

import scriptcontext as sc

allNodeX = []

for n in range(int(len(x)/49.0+0.5)):
    allNodeX.append(x[(n*49):((n+1)*49)])

sc.sticky["allNodeX"] = allNodeX
# ---------- end python_14 ----------

# ---- group: initial testing nodes
pt_9 = Point(move_7.Geometry)  # disabled

# ----
panel_35 = Panel("PROJECT_NAME")  # disabled

# ---- group: ground
brep_7 = Brep()  # disabled
M = Material(Geometry=brep_7, Geometry_2=brep_7, Material="GenericCeiling_80")  # -> GeometryWithMaterialAssigned, GeometryWithMaterialAssigned_2; disabled

# ---- group: glass
brep_8 = Brep()  # disabled
M_2 = Material(Geometry=brep_8, Geometry_2=brep_8, Material="GenericCeiling_80")  # -> GeometryWithMaterialAssigned, GeometryWithMaterialAssigned_2; disabled

# ---- group: slab
brep_9 = Brep(box_6)  # disabled
M_3 = Material(Geometry=brep_9, Geometry_2=brep_9, Material="GenericCeiling_80")  # -> GeometryWithMaterialAssigned, GeometryWithMaterialAssigned_2; disabled

# ---- group: can not be button!
# Analysis (with Central Building)
toggle_2 = BooleanToggle(False)  # disabled

# ---- group: internalised result - rhino model
num_15 = Number([1017, 1059, 1100, 1073, 1101, 1129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])

# ---- group: internalised result - Ryiadh
num_16 = Number([1310, 1311, 1311, 1312, 1313, 1314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])

# ---- group: initiate solar sim result
num_17 = Number(num_16)

# ---- group: sticky allNodeX Y Z V and Heights
# Visualization with Sticky Data
python_15 = PythonScript(trigger03=python_5.trigger03)  # -> out, allNodeX, allNodeY, allNodeZ, allNodeV, currentHeights, lastHeights
# ---------- python_15: Python ----------
"""
Realtime Simulator

written by Yan "Ryan" Zhang <ryanz@mit.edu>
for MIT Media Lab, Changing Place Group, CityScope Project
March.7th.2016
"""

import scriptcontext as sc

allNodeX = sc.sticky["allNodeX"]
allNodeY = sc.sticky["allNodeY"]
allNodeZ = sc.sticky["allNodeZ"]

allNodeV = sc.sticky["allNodeV"]

currentHeights = sc.sticky["currentHeights"]
lastHeights = sc.sticky["lastHeights"]

#print allNodeZ
# ---------- end python_15 ----------

# ----
panel_36 = Panel(num_17)

# ---- group: python list to gh data tree (float)
python_16 = PythonScript(PythonList=python_15.allNodeY)  # -> out, DataTree; inputs PythonList: list
# ---------- python_16: Python ----------
"""
written by Yan "Ryan" Zhang <ryanz@mit.edu>
March.7th.2016
"""

import clr
clr.AddReference("Grasshopper")
import Grasshopper as gh


# Converts a nested Python list to a GH datatree

# Create GH datatree
DataTree = gh.DataTree[float]()

# Add pythonlist sub lists to dataTree
for i,l in enumerate(PythonList):
    for v in l:
        DataTree.Add(v,gh.Kernel.Data.GH_Path(i))
# ---------- end python_16 ----------

python_17 = PythonScript(PythonList=python_15.allNodeX)  # -> out, DataTree; inputs PythonList: list; same code as python_16

python_18 = PythonScript(PythonList=python_15.allNodeV)  # -> out, DataTree; inputs PythonList: list; same code as python_16

python_19 = PythonScript(PythonList=python_15.allNodeZ)  # -> out, DataTree; inputs PythonList: list; same code as python_16

# ----
# default: -ab 2 -ad 1000 -as 20 -ar 300 -aa 0.1
# low1: -ab 2 -ad 600 -as 12 -ar 200 -aa 0.1
# low2: -ab 2 -ad 450 -as 9 -ar 150 -aa 0.1
# low3: -ab 2 -ad 300 -as 6 -ar 100 -aa 0.1
diva_daylight = DIVADaylightAnalysisForGH(
    ProjectName=panel_35,
    GeometryWithRadianceMaterialReference=[M_2.GeometryWithMaterialAssigned_2, M_3.GeometryWithMaterialAssigned_2, M.GeometryWithMaterialAssigned_2],
    AnalysisNodes=pt_9,
    WriteOnly=False,
    RunSimulation=toggle_2,
    ProjectName_2=panel_35,
    GeometryWithRadianceMaterialReference_2=[M_2.GeometryWithMaterialAssigned_2, M_3.GeometryWithMaterialAssigned_2, M.GeometryWithMaterialAssigned_2],
    AnalysisNodes_2=pt_9,
    WriteOnly_2=False,
    RunSimulation_2=toggle_2,
    Climate_Occ=0,
    Climate_RadParam="-ab 2 -ad 1000 -as 20 -ar 300 -aa 0.1",
    DF_RadParam="-ab 2 -ad 1000 -as 20 -ar 300 -aa 0.1",
    DimIrr=200,
    DirIrr=800,
    Ill_RadParam="-ab 2 -ad 1000 -as 20 -ar 300 -aa 0.1",
    Insol_CustomDates=False,
    Insol_EndDay=30,
    Insol_EndMonth=11,
    Insol_RadParam="-ab 2 -ad 300 -as 6 -ar 100 -aa 0.1",
    Insol_StartDay=0,
    Insol_StartMonth=0,
    Insol_Vis_RadParam="-ab 2 -ad 1000 -as 20 -ar 300 -aa 0.1",
    InsolationPeriod=0,
    Irr_FC_legend_max="auto",
    Light_Operation=3,
    Lighting_Param="-W 250.0 -Set 300 -Loss 20 -Standby 0.0",
    Location="USA_MA_Boston-Logan.Intl.AP.725090_TMY3.epw",
    Lum_FC_legend_max="auto",
    MDH_Input=False,
    MinIll=300,
    OutputStates=True,
    Quality=0,
    Rhino_Include=False,
    SimulationType=0,
    SkyCond=0,
    StartDay=20,
    StartHour=12,
    StartMonth=5,
    Vis_RadParam="-ps 8 -pt .15 -pj .6 -dj 0 -ds .5 -dt .5 -dc .25 -dr 0 -dp 64 -st .85 -ab 2 -aa .25 -ar 16 -ad 512 -as 128 -lr 4 -lw .05 -av 0 0 0",
    X_Resolution=600,
    Y_Resolution=400)  # -> OutputMessage, MetricSolarIrradiation, OutputMessage_2, MetricSolarIrradiation_2; disabled
pt_10 = ConstructPoint(XCoordinate=python_17.DataTree, YCoordinate=python_16.DataTree, ZCoordinate=python_19.DataTree)

# ---- group: sticky initiate solar sim data, and write to allNodeV once
python_20 = PythonScript(x=num_17)  # -> out, initSim; inputs x: list
# ---------- python_20: Python ----------
"""
Realtime Simulator

written by Yan "Ryan" Zhang <ryanz@mit.edu>
for MIT Media Lab, Changing Place Group, CityScope Project
March.7th.2016
"""

import scriptcontext as sc

initSim = []

for n in range(int(len(x)/49.0+0.5)):
    initSim.append(x[(n*49):((n+1)*49)])

print initSim

# save initial simulation result, do not change later
sc.sticky["initSim"] = initSim

# sc.sticky["allNodeV"] is the updating node reading value via prediction
# write initSim to allNodeV only once when initiate
sc.sticky["allNodeV"] = initSim
# ---------- end python_20 ----------

# ---- group: allNodeV: updating node reading value via prediction
num_18 = Number(flatten(python_18.DataTree))

# ---- group: all node pts
pt_11 = Point(flatten(pt_10))

# ---- group: initSim pickled - Ryiadh
data = Data(["Grasshopper.Kernel.Types.GH_ObjectWrapper", "Grasshopper.Kernel.Types.GH_ObjectWrapper", "Grasshopper.Kernel.Types.GH_ObjectWrapper", "Grasshopper.Kernel.Types.GH_ObjectWrapper", "Grasshopper.Kernel.Types.GH_ObjectWrapper", "Grasshopper.Kernel.Types.GH_ObjectWrapper"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])

# ---- group: initSim pickled - rhino model
data_2 = Data(["Grasshopper.Kernel.Types.GH_ObjectWrapper", "Grasshopper.Kernel.Types.GH_ObjectWrapper", "Grasshopper.Kernel.Types.GH_ObjectWrapper", "Grasshopper.Kernel.Types.GH_ObjectWrapper", "Grasshopper.Kernel.Types.GH_ObjectWrapper", "Grasshopper.Kernel.Types.GH_ObjectWrapper"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])

# ---- group: result with ground
num_19 = Number(diva_daylight.MetricSolarIrradiation_2)  # disabled

# ----
bnd_2 = Bounds(Numbers=num_16)  # disabled
num_20 = Number(num_18)
remap_2 = RemapNumbers(Value=num_16, Source=bnd_2, Target=Domain(0, 1))  # -> Mapped, Clipped; disabled
bnd_3 = Bounds(Numbers=num_20)
gradient_2 = Gradient(
    LowerLimit=0,
    UpperLimit=1,
    Parameter=remap_2.Mapped,
    stops=[0: RGB(0, 128, 0), 0.5: RGB(255, 255, 0), 1: RGB(255, 0, 0)])  # disabled
panel_37 = Panel(python_20.initSim)
remap_3 = RemapNumbers(Value=num_20, Source="0.0 to 1500.0", Target=Domain(0, 1))  # -> Mapped, Clipped
gradient_3 = Gradient(
    LowerLimit=0,
    UpperLimit=1,
    Parameter=remap_3.Mapped,
    stops=[0: RGB(0, 138, 0), 0.492: RGB(125, 125, 0), 1: RGB(138, 0, 0)])
gradient_4 = Gradient(
    LowerLimit=0,
    UpperLimit=1,
    Parameter=remap_3.Mapped,
    stops=[0: RGB(0, 128, 0), 0.5: RGB(255, 255, 0), 1: RGB(255, 0, 0)])

# ---- group: result
preview_7 = CustomPreview(Geometry=srf_8, Shader=gradient_2)  # disabled

preview_8 = CustomPreview(Geometry=pt_11, Shader=gradient_4)

# ---- group: n as line # in colortizer
# viz one box with initial solar sim
n = Slider(50, range=0..255)  # disabled

# ----
item_9 = ListItem(List=box_3, Index=n, Wrap=False)  # disabled
removebreptoporbottom_4 = RemoveBrepTopOrBottom(brep=item_9, bool=True)  # disabled
srf_9 = Surface(reparameterize(removebreptoporbottom_4))  # disabled
srf_10 = Surface(reparameterize(graft(srf_9)))  # disabled
num_21 = Number(1.546707058)  # disabled
dim_3 = Dimensions(Surface=srf_10)  # -> UDimension, VDimension; disabled
division_11 = Division(A=dim_3.VDimension, B=num_21)  # disabled
division_12 = Division(A=dim_3.UDimension, B=num_21)  # disabled
divide_3 = DivideDomain²(Domain=srf_10, UCount=division_12, VCount=division_11)  # disabled

# ---- group: sticky initiate solar sim data
python_21 = PythonScript(n=n)  # -> out, a; disabled
# ---------- python_21: Python ----------
"""
Realtime Simulator

written by Yan "Ryan" Zhang <ryanz@mit.edu>
for MIT Media Lab, Changing Place Group, CityScope Project
March.7th.2016
"""

import scriptcontext as sc

i = int(n)
print i

t = sc.sticky["initSim"]

a = t[i]
# ---------- end python_21 ----------

# ----
subsrf_3 = Isotrim(Surface=srf_10, Domain=divide_3)  # disabled
num_22 = Number(python_21.a)  # disabled

# ---- group: result geo
srf_11 = Surface(reparameterize(flatten(subsrf_3)))  # disabled

# ----
Z_2 = UnitZ(Factor=100)  # disabled
move_8 = Move(Geometry=srf_11, Motion=Z_2)  # -> Geometry, Transform; disabled
remap_4 = RemapNumbers(Value=num_22, Source=Domain(148, 1532), Target=Domain(0, 1))  # -> Mapped, Clipped; disabled
gradient_5 = Gradient(
    LowerLimit=0,
    UpperLimit=1,
    Parameter=remap_4.Mapped,
    stops=[0: RGB(0, 128, 0), 0.5: RGB(255, 255, 0), 1: RGB(255, 0, 0)])  # disabled

# ---- group: result
preview_9 = CustomPreview(Geometry=move_8.Geometry, Shader=gradient_5)  # disabled

# ==== cluster MaxNum
num = ClusterInput()
num_2 = Number(num)
bnd = Bounds(Numbers=num_2)
dedomain = DeconstructDomain(Domain=bnd)  # -> Start, End
equals = Equality(FirstNumber=num_2, SecondNumber=dedomain.End)  # -> Equality, Inequality
dispatch = Dispatch(List=num_2, DispatchPattern=equals.Equality)  # -> ListA, ListB
num_3 = Number(dispatch.ListA)
num_4 = ClusterOutput(num_3)

# ==== cluster RemoveBrepTopOrBottom
brep = ClusterInput()
bool = ClusterInput()
brep_2 = Brep(brep)
bool_2 = Boolean(bool)
num = Number(bool_2)
debrep = DeconstructBrep(Brep=brep_2)  # -> Faces, Edges, Vertices
subtraction = Subtraction(A=num, B=0.5)
multiplication = Multiplication(A=subtraction, B=2)
Z = UnitZ(Factor=multiplication)
area = Area(Geometry=debrep.Faces)  # -> Area, Centroid
srf_cp = SurfaceClosestPoint(Point=area.Centroid, Surface=debrep.Faces)  # -> Point, UVPoint, Distance
evalsrf = EvaluateSurface(Surface=debrep.Faces, Point=srf_cp.UVPoint)  # -> Point, Normal, Frame
angle = Angle(VectorA=evalsrf.Normal, VectorB=Z)  # -> Angle, Reflex
equals = Equality(FirstNumber=angle.Angle, SecondNumber=0)  # -> Equality, Inequality
dispatch = Dispatch(List=debrep.Faces, DispatchPattern=equals.Inequality)  # -> ListA, ListB
srf = Surface(dispatch.ListA)
join = BrepJoin(Breps=srf)  # -> Breps, Closed
pshift = ShiftPaths(Data=join.Breps, Offset=-1)
brep_3 = Brep(pshift)
brep_4 = ClusterOutput(brep_3)

# ==== cluster ExtractBrepTopOrBottom
brep = ClusterInput()
bool = ClusterInput()
brep_2 = Brep(brep)
bool_2 = Boolean(bool)
num = Number(bool_2)
debrep = DeconstructBrep(Brep=brep_2)  # -> Faces, Edges, Vertices
subtraction = Subtraction(A=num, B=0.5)
multiplication = Multiplication(A=subtraction, B=2)
Z = UnitZ(Factor=multiplication)
area = Area(Geometry=debrep.Faces)  # -> Area, Centroid
srf_cp = SurfaceClosestPoint(Point=area.Centroid, Surface=debrep.Faces)  # -> Point, UVPoint, Distance
evalsrf = EvaluateSurface(Surface=debrep.Faces, Point=srf_cp.UVPoint)  # -> Point, Normal, Frame
angle = Angle(VectorA=evalsrf.Normal, VectorB=Z)  # -> Angle, Reflex
equals = Equality(FirstNumber=angle.Angle, SecondNumber=0)  # -> Equality, Inequality
dispatch = Dispatch(List=debrep.Faces, DispatchPattern=equals.Equality)  # -> ListA, ListB
srf = Surface(dispatch.ListA)
srf_2 = ClusterOutput(srf)
