# Grasshopper definition 160407_ProjectionMapper_camGeo_realscale.gh (Grasshopper 0.9.76)
# plug-ins: horsterCameraControl

# ---- group: half canvas width
panel = Panel("1136.507")

# ----
multiplication = Multiplication(A=panel, B=2)

# ---- group: current cam canvas width
panel_2 = Panel(multiplication)
num = Number(panel_2)

# ---- group: canvas ratio
division = Division(A="16", B="9")
num_2 = Number(division)

# ---- group: current cam tgt pos
pt = Point(<point referenced from the Rhino model>)

# ---- group: current cam pos
pt_2 = Point(<point referenced from the Rhino model>)

# ---- group: target corner pts
pt_3 = Point([<point referenced from the Rhino model> x4])

# ----
ln = Line(StartPoint=pt_2, EndPoint=pt_3)
Z = UnitZ(Factor=100)

# ---- group: current cam canvas height
division_2 = Division(A=num, B=num_2)
num_3 = Number(division_2)

# ----
move = Move(Geometry=pt, Motion=Z)  # -> Geometry, Transform
pl_3pt = Plane3Pt(PointA=pt, PointB=pt_2, PointC=move.Geometry)
division_3 = Division(A=num, B=2)
division_4 = Division(A=num_3, B=2)
pt_4 = PointOriented(BasePlane=pl_3pt, UComponent=0, VComponent=0, WComponent=-100)
pt_5 = PointOriented(BasePlane=pl_3pt, UComponent=0, VComponent=100, WComponent=0)
neg = Negative(Value=division_3)
neg_2 = Negative(Value=division_4)
dom = ConstructDomain(DomainStart=division_3, DomainEnd=neg)
pl_3pt_2 = Plane3Pt(PointA=pt, PointB=pt_4, PointC=pt_5)
dom_2 = ConstructDomain(DomainStart=division_4, DomainEnd=neg_2)

# ---- group: current cam canvas pln
pln = Plane(pl_3pt_2)

# ----
plx = LinePlane(Line=ln, Plane=pln)  # -> Point, ParamL, ParamP

# ---- group: target corner pts on init cam canvas
pt_6 = Point(plx.Point)

# ----
preview = CustomPreview(Geometry=pt_6, Shader=ColourSwatch(SwatchColor=RGB(0, 255, 4)))
plcoord = PlaneCoordinates(Point=pt_6, System=pln)  # -> XCoordinate, YCoordinate, ZCoordinate
division_5 = Division(A=plcoord.XCoordinate, B=num)
division_6 = Division(A=plcoord.YCoordinate, B=num_3)
rectangle = Rectangle(Plane=pln, XSize=dom, YSize=dom_2, Radius=0)  # -> Rectangle, Length
addition = Addition(A=division_5, B=0.5)
addition_2 = Addition(A=division_6, B=0.5)
panel_3 = Panel(addition_2)
panel_4 = Panel(addition)
pt_7 = ConstructPoint(XCoordinate=panel_4, YCoordinate=panel_3, ZCoordinate=0)

# ---- group: corner pts 0.0 to 1.0 - target
pt_8 = Point(pt_7)

# ----
galapagos = Galapagos(
    fitness=num_6,
    gene=[number_slider_7, number_slider_8, number_slider_9, number_slider_10, number_slider_11, number_slider_12])

# ---- group: 001
number_slider = Slider(-9.99878, range=-10..10)
number_slider_2 = Slider(0.61887, range=-10..10)
number_slider_3 = Slider(99.99835, range=-100..100)
number_slider_4 = Slider(-2.977, range=-10..10)
number_slider_5 = Slider(-3.77274, range=-10..10)
number_slider_6 = Slider(-15, range=-15..15)

# ----
number_slider_7 = Slider(63.51949, range=-100..100)
number_slider_8 = Slider(-35.00031, range=-100..100)
number_slider_9 = Slider(-300, range=-300..300)
number_slider_10 = Slider(13.28752, range=-30..30)
number_slider_11 = Slider(-6.18902, range=-30..30)
number_slider_12 = Slider(104.99, range=-105..105)

# ---- group: real corner pts
pt_9 = Point([<point referenced from the Rhino model> x4])

# ----
ln_2 = Line(StartPoint=pt_2, EndPoint=pt_9)

number_slider_13 = Slider(-23.8722, range=-30..10)
number_slider_14 = Slider(3.73072, range=-10..10)
number_slider_15 = Slider(83.00936, range=-100..300)
number_slider_16 = Slider(-6.96472, range=-10..10)
number_slider_17 = Slider(-3.70572, range=-10..10)
number_slider_18 = Slider(-34.69, range=-35..15)

vec = VectorXYZ(XComponent=number_slider_7, YComponent=number_slider_8, ZComponent=number_slider_9)  # -> Vector, Length
vec_2 = VectorXYZ(XComponent=number_slider_10, YComponent=number_slider_11, ZComponent=0)  # -> Vector, Length
addition_3 = Addition(A=num, B=number_slider_12)
move_2 = Move(Geometry=pt_2, Motion=vec.Vector)  # -> Geometry, Transform
move_3 = Move(Geometry=pt, Motion=vec_2.Vector)  # -> Geometry, Transform

# ---- group: test canvas width
num_4 = Number(addition_3)

# ----
number_slider_19 = Slider(-24.1252, range=-50..10)
number_slider_20 = Slider(3.72389, range=-10..10)
number_slider_21 = Slider(83.41925, range=-100..300)
number_slider_22 = Slider(-6.96341, range=-30..10)
number_slider_23 = Slider(-3.70633, range=-30..10)
number_slider_24 = Slider(-34.69, range=-105..15)

# ---- group: test cam tgt pos
pt_10 = Point(move_3.Geometry)

# ---- group: test cam pos
pt_11 = Point(move_2.Geometry)

# ---- group: current cam canvas height
division_7 = Division(A=num_4, B=num_2)
num_5 = Number(division_7)

# ----
ln_3 = Line(StartPoint=pt_11, EndPoint=pt_10)
Z_2 = UnitZ(Factor=100)
move_4 = Move(Geometry=pt_10, Motion=Z_2)  # -> Geometry, Transform
division_8 = Division(A=num_4, B=2)
division_9 = Division(A=num_5, B=2)
neg_3 = Negative(Value=division_8)
neg_4 = Negative(Value=division_9)

setcam = SetCamera(CameraLocation=pt_11, TargetLocation=pt_10, LensLength=Slider(105.5987, range=0..200), Activate=Toggle(True))

pl_3pt_3 = Plane3Pt(PointA=pt_10, PointB=pt_11, PointC=move_4.Geometry)
dom_3 = ConstructDomain(DomainStart=division_8, DomainEnd=neg_3)
dom_4 = ConstructDomain(DomainStart=division_9, DomainEnd=neg_4)
pt_12 = PointOriented(BasePlane=pl_3pt_3, UComponent=0, VComponent=0, WComponent=-100)
pt_13 = PointOriented(BasePlane=pl_3pt_3, UComponent=0, VComponent=100, WComponent=0)
pl_3pt_4 = Plane3Pt(PointA=pt_10, PointB=pt_12, PointC=pt_13)

# ---- group: target cam canvas pln
pln_2 = Plane(pl_3pt_4)

# ----
plx_2 = LinePlane(Line=ln_2, Plane=pln_2)  # -> Point, ParamL, ParamP

# ---- group: real corner pts on test cam canvas
pt_14 = Point(plx_2.Point)

# ----
preview_2 = CustomPreview(Geometry=pt_14, Shader=ColourSwatch(SwatchColor=RGB(255, 0, 0)))
plcoord_2 = PlaneCoordinates(Point=pt_14, System=pln_2)  # -> XCoordinate, YCoordinate, ZCoordinate
division_10 = Division(A=plcoord_2.YCoordinate, B=num_5)
division_11 = Division(A=plcoord_2.XCoordinate, B=num_4)
addition_4 = Addition(A=division_11, B=0.5)
addition_5 = Addition(A=division_10, B=0.5)
panel_5 = Panel(addition_5)
panel_6 = Panel(addition_4)
rectangle_2 = Rectangle(Plane=pln_2, XSize=dom_3, YSize=dom_4, Radius=0)  # -> Rectangle, Length
pt_15 = ConstructPoint(XCoordinate=panel_6, YCoordinate=panel_5, ZCoordinate=0)

# ---- group: corner pts 0.0 to 1.0 - current
pt_16 = Point(pt_15)

# ----
dist = Distance(PointA=pt_8, PointB=pt_16)  # -> flatten(Distance)
panel_7 = Panel(dist)
ma = MassAddition(Input=panel_7)  # -> Result, PartialResults
num_6 = Number(ma.Result)
panel_8 = Panel(num_6)
