# Grasshopper definition 160427_CityMatrix_4toggles.gh (Grasshopper 0.9.76)
# plug-ins: Python Interpreter, gHowl, HDTReference, LunchBox

# ---- group: mesh coloring
res_color = ColourSwatch(SwatchColor=RGB(251, 255, 122))
mesh = Mesh(<mesh referenced from the Rhino model>)
sidewalk = ColourSwatch(SwatchColor=RGB(107, 107, 107))
bikelane = ColourSwatch(SwatchColor=RGB(86, 135, 87))
res_gray = ColourSwatch(SwatchColor=RGB(227, 227, 227))
off_gray = ColourSwatch(SwatchColor=RGB(171, 171, 171))
offcolor = ColourSwatch(SwatchColor=RGB(255, 122, 122))
parking = ColourSwatch(SwatchColor=RGB(196, 156, 100))
blank = ColourSwatch(SwatchColor=RGB(110, 110, 110))
road = ColourSwatch(SwatchColor=RGB(64, 64, 64))
park = ColourSwatch(SwatchColor=RGB(165, 201, 44))
# 3D City Grid System
text = ColourSwatch(SwatchColor=RGB(0, 0, 0))
res_warm = ColourSwatch(SwatchColor=RGB(255, 251, 230))
off_cold = ColourSwatch(SwatchColor=RGB(230, 242, 255))
mcol = MeshColours(Mesh=mesh, Colours=off_cold)
mesh_2 = Mesh(mcol)

# ---- group: shrink
cell_shrink = Slider(0.98, range=0.75..1)

# ---- group: total ppl bound
domain = Domain("700 to 35000")

# ---- group: module meshes lego ref: -1
mesh_3 = Mesh(<mesh referenced from the Rhino model>)

# ---- group: module meshes lego ref: 0 to 5
mesh_4 = Mesh([<mesh referenced from the Rhino model> x6])

# ---- group: colortizer orgin
# CityMatrix
# 
# by Yan "Ryan" Zhang <ryanz@mit.edu>
# for MIT Media Lab, Changing Place Group, CityScope Project
# March.17th.2016
# LEGO Grid System
pt = Point(<point referenced from the Rhino model>)

# ---- group: module meshes lego ref: 6 line bike
mesh_5 = Mesh(<mesh referenced from the Rhino model>)  # disabled

# ---- group: table size ref pt
pt_2 = Point(<point referenced from the Rhino model>)

# ---- group: module meshes lego ref: 6 line car
mesh_6 = Mesh(<mesh referenced from the Rhino model>)  # disabled

# ---- group: intersections
crossings = Point([Point(156.25, 281.25, 0), Point(468.75, 281.25, 0), Point(718.75, 281.25, 0), Point(156.25, 656.25, 0), Point(468.75, 656.25, 0), Point(718.75, 656.25, 0), Point(906.25, 906.25, 0), Point(718.75, 906.25, 0), Point(468.75, 906.25, 0), Point(156.25, 906.25, 0), Point(906.25, 281.25, 0), Point(906.25, 656.25, 0), Point(906.25, 781.25, 0), Point(906.25, 531.25, 0), Point(906.25, 156.25, 0)])

# ---- group: all road pieces
pt_3 = Point([Point(906.25, 156.25, 0), Point(906.25, 531.25, 0), Point(906.25, 781.25, 0), Point(906.25, 656.25, 0), Point(906.25, 281.25, 0), Point(156.25, 906.25, 0)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])

# ----
# Block Floor Numbers @ Lego
panel = Panel("-0.8")

# ---- group: all road pieces
pt_4 = Point([Point(906.25, 156.25, 0), Point(906.25, 531.25, 0), Point(906.25, 781.25, 0), Point(906.25, 656.25, 0), Point(906.25, 281.25, 0), Point(156.25, 906.25, 0)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])  # disabled

# ----
number_slider = Slider(3.5, range=0..10)  # disabled
number_slider_2 = Slider(-14, range=-30..0)  # disabled
number_slider_3 = Slider(5.1, range=0..10)  # disabled
number_slider_4 = Slider(700, range=700..35000)

# ---- group: intersections
crossings_2 = Point([Point(156.25, 281.25, 0), Point(468.75, 281.25, 0), Point(718.75, 281.25, 0), Point(156.25, 656.25, 0), Point(468.75, 656.25, 0), Point(718.75, 656.25, 0), Point(906.25, 906.25, 0), Point(718.75, 906.25, 0), Point(468.75, 906.25, 0), Point(156.25, 906.25, 0), Point(906.25, 281.25, 0), Point(906.25, 656.25, 0), Point(906.25, 781.25, 0), Point(906.25, 531.25, 0), Point(906.25, 156.25, 0)])  # disabled

# ----
# mid
number_slider_5 = Slider(55, range=0..100)
# old
number_slider_6 = Slider(23, range=0..100)
# Human Dots @ Lego - Inside
number_slider_7 = Slider(69, range=0..100)
_4_commed = Slider(6, range=1..25)
_1_resmed = Slider(4, range=1..25)
_3_comhq = Slider(3, range=1..25)

# ---- group: ppl density level range
panel_2 = Panel("0 to 700")

# ----
_0_reslux = Slider(1, range=1..25)
_2_resmu = Slider(20, range=1..25)

# ---- group: ref dot mesh 3 x 3
# dots template generation
mesh_7 = Mesh(<mesh referenced from the Rhino model>)  # disabled

# ---- group: ref crvs for divide
crv = Curve([<curve referenced from the Rhino model> x4])  # disabled

# ---- group: level ref num range
panel_3 = Panel("0 to 4")

# ----
_5_rescw = Slider(20, range=1..25)

# ---- group: 5 density inside dot meshes
mesh_8 = Mesh([<mesh referenced from the Rhino model> x5])

# ----
number_slider_8 = Slider(4, range=0..4)  # disabled
area = Area(Geometry=mesh_7)  # -> Area, Centroid; disabled
multiplication = Multiplication(A=number_slider_8, B=2)  # disabled
addition = Addition(A=multiplication, B=4)  # disabled
panel_4 = Panel(addition)  # disabled
divide = DivideCurve(Curve=crv, Count=addition, Kinks=False)  # -> Points, Tangents, Parameters; disabled
shift = ShiftList(List=divide.Points, Shift=1, Wrap=False)  # -> flatten(List); disabled
vec2pt = Vector2Pt(PointA=area.Centroid, PointB=shift, Unitize=False)  # -> Vector, Length; disabled
move = Move(Geometry=mesh_7, Motion=vec2pt.Vector)  # -> Geometry, Transform; disabled
mid_mid_career = ColourSwatch(SwatchColor=RGB(255, 208, 0))  # disabled
mln_young = ColourSwatch(SwatchColor=RGB(0, 166, 255))  # disabled
exc_elderly = ColourSwatch(SwatchColor=RGB(255, 0, 0))  # disabled
mjoin = MeshJoin(Meshes=flatten(move.Geometry))  # disabled
mcol_2 = MeshColours(Mesh=mjoin, Colours=mln_young)  # disabled

text_new = ColourSwatch(SwatchColor=RGB(64, 64, 64))

# ---- group: 3D building site move amount
X = UnitX(Factor="10000")

# ----
# young
number_slider_9 = Slider(200, range=0..500)
xy = XYPlane(Origin=pt)
dist = Distance(PointA=pt, PointB=pt_2)
timer = Timer(TimerInterval=500, Target=division_2)  # disabled

# ---- group: 6 intersect bike
mesh_9 = Mesh(<mesh referenced from the Rhino model>)  # disabled

# ---- group: 6 intersect car
mesh_10 = Mesh(<mesh referenced from the Rhino model>)  # disabled

# ----
movetoorgin = MoveToOrgin(G=mesh_8, num=cell_shrink)
com = ColourSwatch(SwatchColor=RGB(158, 158, 158))
com_2 = ColourSwatch(SwatchColor=RGB(71, 71, 71))

# ---- group: ref mesh
# Traffic Heatmap - Yasushi
mesh_11 = Mesh(<mesh referenced from the Rhino model>)  # disabled

# ----
res = ColourSwatch(SwatchColor=RGB(212, 212, 212))
res_2 = ColourSwatch(SwatchColor=RGB(76, 76, 76))

# ---- group: base cplane
pln = Plane(xy)

# ----
dedomain = DeconstructDomain(Domain=panel_3)  # -> Start, End
movetoorgin_2 = MoveToOrgin(G=mesh_3, num=cell_shrink)
movetoorgin_3 = MoveToOrgin(G=mesh_4, num=cell_shrink)
pt_5 = ConstructPoint(XCoordinate=number_slider, YCoordinate=number_slider_2, ZCoordinate=number_slider_3)  # disabled
vec = Vector(X)
pt_6 = ConstructPoint(XCoordinate=Slider(0, range=0..10), YCoordinate=Slider(0, range=-30..0), ZCoordinate=Slider(5.1, range=0..10))

# ---- group: private car / road quator 0s
mesh_12 = Mesh([<mesh referenced from the Rhino model> x4])
pt_7 = Point(<point referenced from the Rhino model>)

# ---- group: private car / center line quator 0s
mesh_13 = Mesh([<mesh referenced from the Rhino model> x4])
pt_8 = Point(<point referenced from the Rhino model>)

# ---- group: private car / sidewalk quator 0s
mesh_14 = Mesh([<mesh referenced from the Rhino model> x4])
pt_9 = Point(<point referenced from the Rhino model>)

# ----
srf = Surface(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)  # disabled
movetoorgin_4 = MoveToOrgin(G=mesh_11, num=cell_shrink)  # disabled
merge = Merge(Data1=res, Data2=res, Data3=res, Data4=com, Data5=com, Data6=com)
merge_2 = Merge(Data1=res_2, Data2=res_2, Data3=res_2, Data4=com_2, Data5=com_2, Data6=com_2)

# ---- group: range
B = DomainEnd(number_slider_9)

B_2 = DomainEnd(Slider(120, range=0..500))

B_3 = DomainEnd(Slider(75, range=0..500))

# ----
xy_2 = XYPlane(Origin=pt_5)  # disabled
xy_3 = XYPlane(Origin=pt_6)

# ---- group: private car / road quator 1s
mesh_15 = Mesh([<mesh referenced from the Rhino model> x4])
pt_10 = Point(<point referenced from the Rhino model>)

# ---- group: private car
scale_nu = ScaleNU(Geometry=mesh_12, Plane=pt_7, ScaleX=cell_shrink, ScaleY=cell_shrink, ScaleZ=1)  # -> Geometry, Transform
scale_nu_2 = ScaleNU(Geometry=mesh_15, Plane=pt_10, ScaleX=cell_shrink, ScaleY=cell_shrink, ScaleZ=1)  # -> Geometry, Transform

# ---- group: private car / center line quator 1s
mesh_16 = Mesh([<mesh referenced from the Rhino model> x4])
pt_11 = Point(<point referenced from the Rhino model>)

# ---- group: private car
scale_nu_3 = ScaleNU(Geometry=mesh_13, Plane=pt_8, ScaleX=cell_shrink, ScaleY=cell_shrink, ScaleZ=1)  # -> Geometry, Transform
scale_nu_4 = ScaleNU(Geometry=mesh_16, Plane=pt_11, ScaleX=cell_shrink, ScaleY=cell_shrink, ScaleZ=1)  # -> Geometry, Transform

# ---- group: private car / sidewalk quator 1s
mesh_17 = Mesh([<mesh referenced from the Rhino model> x4])
pt_12 = Point(<point referenced from the Rhino model>)

# ---- group: private car
scale_nu_5 = ScaleNU(Geometry=mesh_14, Plane=pt_9, ScaleX=cell_shrink, ScaleY=cell_shrink, ScaleZ=1)  # -> Geometry, Transform
scale_nu_6 = ScaleNU(Geometry=mesh_17, Plane=pt_12, ScaleX=cell_shrink, ScaleY=cell_shrink, ScaleZ=1)  # -> Geometry, Transform

# ---- group: balance two colors
number_slider_10 = Slider(0.8, range=0..1)

# ---- group: module meshes lego at orgin
mesh_18 = Mesh(movetoorgin_3)

mesh_19 = Mesh(movetoorgin_2)

# ----
merge_3 = Merge(Data1=merge, Data2=merge_2)
pshift = ShiftPaths(Data=movetoorgin_4, Offset=-1)  # disabled
road_2 = ColourSwatch(SwatchColor=RGB(64, 64, 64))
subtraction = Subtraction(A=1, B=number_slider_10)

# ---- group: PEV / road quator 0s
mesh_20 = Mesh([<mesh referenced from the Rhino model> x4])
pt_13 = Point(<point referenced from the Rhino model>)

# ---- group: PEV / center line quator 0s
mesh_21 = Mesh(mesh_13)
pt_14 = Point(pt_8)

# ----
number_slider_11 = Slider(17, range=0..100)  # disabled

# ---- group: color for each type
col = Colour(merge_3)

# ----
dom = ConstructDomain(DomainStart=0, DomainEnd=B)

# ---- group: PEV / sidewalk quator 0s
mesh_22 = Mesh([<mesh referenced from the Rhino model> x4])
pt_15 = Point(<point referenced from the Rhino model>)

# ---- group: floor height
panel_5 = Panel("3.5")

# ----
mid_mid_career_2 = ColourSwatch(SwatchColor=RGB(255, 208, 0))
dom_2 = ConstructDomain(DomainStart=0, DomainEnd=B_2)
dom_3 = ConstructDomain(DomainStart=0, DomainEnd=B_3)
mln_young_2 = ColourSwatch(SwatchColor=RGB(0, 166, 255))
exc_elderly_2 = ColourSwatch(SwatchColor=RGB(255, 0, 0))
swatch = ColourSwatch(SwatchColor=RGB(0, 0, 0))  # disabled

# ---- group: ref mesh at orgin
mesh_23 = Mesh(pshift)  # disabled

# ----
move_2 = Move(Geometry=mesh_23, Motion=pt_4)  # -> Geometry, Transform; disabled

# ---- group: PEV / road quator 1s
mesh_24 = Mesh([<mesh referenced from the Rhino model> x4])
pt_16 = Point(<point referenced from the Rhino model>)

# ---- group: PEV
scale_nu_7 = ScaleNU(Geometry=mesh_20, Plane=pt_13, ScaleX=cell_shrink, ScaleY=cell_shrink, ScaleZ=1)  # -> Geometry, Transform
scale_nu_8 = ScaleNU(Geometry=mesh_24, Plane=pt_16, ScaleX=cell_shrink, ScaleY=cell_shrink, ScaleZ=1)  # -> Geometry, Transform

# ---- group: PEV / center line quator 1s
mesh_25 = Mesh(mesh_16)
pt_17 = Point(pt_11)

# ---- group: PEV
scale_nu_9 = ScaleNU(Geometry=mesh_21, Plane=pt_14, ScaleX=cell_shrink, ScaleY=cell_shrink, ScaleZ=1)  # -> Geometry, Transform
scale_nu_10 = ScaleNU(Geometry=mesh_25, Plane=pt_17, ScaleX=cell_shrink, ScaleY=cell_shrink, ScaleZ=1)  # -> Geometry, Transform

# ----
argb = SplitARGB(Colour=road_2, IntegerChannels=True)  # -> Alpha, Red, Green, Blue

# ---- group: base height
panel_6 = Panel("5.0")

# ---- group: PEV / sidewalk quator 1s
mesh_26 = Mesh([<mesh referenced from the Rhino model> x4])
pt_18 = Point(<point referenced from the Rhino model>)

# ---- group: PEV
scale_nu_11 = ScaleNU(Geometry=mesh_22, Plane=pt_15, ScaleX=cell_shrink, ScaleY=cell_shrink, ScaleZ=1)  # -> Geometry, Transform
scale_nu_12 = ScaleNU(Geometry=mesh_26, Plane=pt_18, ScaleX=cell_shrink, ScaleY=cell_shrink, ScaleZ=1)  # -> Geometry, Transform

# ----
number_slider_12 = Slider(4.9, range=0..10)  # disabled
merge_4 = Merge(
    Data1=exc_elderly_2,
    Data2=mid_mid_career_2,
    Data3=mln_young_2,
    Data4=exc_elderly_2,
    Data5=mid_mid_career_2,
    Data6=mln_young_2)
vec_2 = VectorXYZ(XComponent=argb.Red, YComponent=argb.Green, ZComponent=argb.Blue)  # -> Vector, Length

# ---- group: multipe for ppls
number_slider_13 = Slider(0.5, range=-0.01..2)

# ----
panel_7 = Panel("8")  # disabled
Z = UnitZ(Factor=number_slider_12)  # disabled

# ---- group: translate example
pt_19 = Point(Point(-15, -8, 0))  # disabled
python = PythonScript(point=pt_19)  # -> out, output; inputs point: Point3d; disabled
# ---------- python: Python ----------
import Rhino

transform = Rhino.Geometry.Transform.Translation(0,0,5)
point.Transform(transform)

output = point
# ---------- end python ----------

# ----
multiplication_2 = Multiplication(A=vec_2.Vector, B=subtraction)

# ---- group: bake for ref
mesh_27 = Mesh(mcol_2)  # disabled

# ----
move_3 = Move(Geometry=move_2.Geometry, Motion=Z)  # -> Geometry, Transform; disabled
graft = GraftTree(Tree=move_3.Geometry, IncludeEmptyLists=True, IncludeNullItems=True)  # disabled
move_4 = Move(Geometry=move_3.Geometry, Motion=vec)  # -> Geometry, Transform; disabled

# ---- group: reduce ratio
number_slider_14 = Slider(0, range=0..1)

# ---- group: building height factor
number_slider_15 = Slider(1.8, range=0..10)

# ----
graft_2 = GraftTree(Tree=move_4.Geometry, IncludeEmptyLists=True, IncludeNullItems=True)  # disabled
number_slider_16 = Slider(0.2, range=0..1)
number_slider_17 = Slider(0.2, range=0..1)
number_slider_18 = Slider(0.2, range=0..1)
mid_mid_career_3 = ColourSwatch(SwatchColor=RGB(255, 208, 0))
mln_young_3 = ColourSwatch(SwatchColor=RGB(0, 166, 255))
exc_elderly_3 = ColourSwatch(SwatchColor=RGB(255, 0, 0))

# ---- group: dot shape
polygon = Polygon(Plane=PlaneXY(0, 0, 0), Radius=Slider(3, range=0..10), Segments=Slider(9, range=0..10), FilletRadius=0)  # -> Polygon, Length
boundary = BoundarySurfaces(Edges=polygon.Polygon)
mesh_28 = Mesh(boundary)

# ----
mesh_29 = Mesh(mesh_28)
mesh_30 = Mesh(mesh_28)
mesh_31 = Mesh(mesh_28)
number_slider_19 = Slider(10, range=10..100)
panel_8 = Panel("C:\Users\RYAN\Documents\GitHub\CityMatrix\Data\colortizer_data_rhino_02_YZ.txt")
panel_9 = Panel("C:\Users\RYAN\Documents\GitHub\CityMatrix\Data\colortizer_data_sample.txt")
# Parsing Colortizer Data (CityMatrix 16x16)
panel_10 = Panel("C:\Users\RYAN\Documents\GitHub\CityMatrix\Data\colortizer_data.txt")
panel_11 = Panel("C:\Users\RYAN\Documents\GitHub\CityMatrix\Data\colortizer_data_03_YZ.txt")

# ---- group: meshes lego ref: parking
mesh_32 = Mesh(<mesh referenced from the Rhino model>)

# ----
panel_12 = Panel("C:\Users\RYAN\Documents\GitHub\CityMatrix\Data\colortizer_data_rhino_01_YZ.txt")

# ---- group: meshes lego ref: park
mesh_33 = Mesh(<mesh referenced from the Rhino model>)

# ----
panel_13 = Panel("C:\Users\RYAN\Documents\GitHub\CityMatrix\Map\Amenities Maps\Amenities_Trans.png")
# Google Map @ Lego
planesrf = PlaneSurface(Plane=pln, XSize=Domain(0, 1000), YSize=Domain(-1000, 0))
panel_14 = Panel("C:\Users\RYAN\Documents\GitHub\CityMatrix\Map\Amenities Maps\Amenities_85Alpha.png")
Z_2 = UnitZ(Factor=20)
# C:\Users\RYAN\Documents\GitHub\CityMatrix\Map\HAMBURG RS 1600pxl.jpg
panel_15 = Panel("0.0")

# ---- group: road center - PEV
crv_2 = Curve([<curve referenced from the Rhino model> x7])  # disabled

# ---- group: road center - private car 1
crv_3 = Curve([<curve referenced from the Rhino model> x84])  # disabled

# ----
Z_3 = UnitZ(Factor=number_slider_19)

# ---- group: road center - private car 2
crv_4 = Curve([<curve referenced from the Rhino model> x48])  # disabled

# ----
yz = YZPlane(Origin=Point(500, 0, 0))  # disabled
move_5 = Move(Geometry=planesrf, Motion=Z_2)  # -> Geometry, Transform
msphereex = MeshSphereEx(Base=Z_3, Radius=number_slider_19, Count=Slider(5, range=0..10))
Z_4 = UnitZ(Factor=Slider(6, range=0..10))

# ---- group: car shape mesh
# Cars PEVs @ Lego
number_slider_20 = Slider(11.1, range=0..30)  # disabled
number_slider_21 = Slider(4.1, range=0..30)  # disabled
number_slider_22 = Slider(0.75, range=0..2)  # disabled
number_slider_23 = Slider(0, range=0..2)  # disabled
neg = Negative(Value=number_slider_20)  # disabled
neg_2 = Negative(Value=number_slider_21)  # disabled
dom_4 = ConstructDomain(DomainStart=neg, DomainEnd=number_slider_20)  # disabled
dom_5 = ConstructDomain(DomainStart=neg_2, DomainEnd=number_slider_21)  # disabled
rectangle = Rectangle(Plane=PlaneXY(0, 0, 0), XSize=dom_4, YSize=dom_5, Radius=number_slider_23)  # -> Rectangle, Length; disabled
planesrf_2 = PlaneSurface(Plane=PlaneXY(0, 0, 0), XSize=dom_4, YSize=dom_5)  # disabled
offset = Offset(Curve=rectangle.Rectangle, Distance=number_slider_22, Plane=PlaneXY(0, 0, 0), Corners=1)  # disabled
rdiff = RegionDifference(CurvesA=offset, CurvesB=rectangle.Rectangle)  # disabled
boundary_2 = BoundarySurfaces(Edges=rdiff)  # disabled
mesh_34 = Mesh(boundary_2)  # disabled

# ----
mirror = Mirror(Geometry=crv_3, Plane=yz)  # -> Geometry, Transform; disabled
Z_5 = UnitZ(Factor=6.5)  # disabled
movetoorgin_5 = MoveToOrgin(G=mesh_32, num=cell_shrink)
movetoorgin_6 = MoveToOrgin(G=mesh_33, num=cell_shrink)
move_6 = Move(Geometry=msphereex, Motion=Z_4)  # -> Geometry, Transform

# ---- group: udp receiver
udp = UDPReceiver(Address="127.0.0.1", Port="7001", Pattern=0)  # -> Info, Data

# ----
move_7 = Move(Geometry=mirror.Geometry, Motion=Z_5)  # -> Geometry, Transform; disabled
tree_scale = Slider(0.81, range=0.5..2)
mcol_3 = MeshColours(Mesh=move_6.Geometry, Colours=park)
split = TextSplit(Text=udp.Data)
explode = Explode(Curve=move_7.Geometry, Recursive=True)  # -> Segments, Vertices; disabled

# ---- group: module meshes lego at orgin
mesh_35 = Mesh(movetoorgin_5)

# ---- group: reading txt
file = ReadFile(File=panel_11, PerLineParse=True)

# ---- group: module meshes lego at orgin
mesh_36 = Mesh(movetoorgin_6)

# ----
shift_2 = ShiftList(List=split, Shift=1, Wrap=False)
pshift_2 = ShiftPaths(Data=shift_2, Offset=-1)
pshift_3 = ShiftPaths(Data=explode.Segments, Offset=-1)  # disabled

# ---- group: meshes 3D ref: Tree
mesh_37 = Mesh(mcol_3)

# ----
number_slider_24 = Slider(28.7, range=0..30)  # disabled
X_2 = UnitX(Factor=Slider(7.9, range=0..10))
panel_16 = Panel("")  # disabled

# ---- group: overwrite toggle 1 - trans mode
transportation_mode = BooleanToggle(True)

# ----
panel_17 = Panel("C:\Users\RYAN\Documents\GitHub\CityMatrix\Map\Amenities Maps\Amenities_Trans.png")
planesrf_3 = PlaneSurface(Plane=pln, XSize=Domain(0, 1000), YSize=Domain(-1000, 0))
Z_6 = UnitZ(Factor=20)
# C:\Users\RYAN\Documents\GitHub\CityMatrix\Map\HAMBURG RS 1600pxl.jpg
panel_19 = Panel("0.01")
txt = Text(file)
crv_5 = Curve(pshift_3)  # disabled
txt_2 = Text(pshift_2)
move_8 = Move(Geometry=planesrf_3, Motion=X_2)  # -> Geometry, Transform

# ---- group: 3D building site move amount
vec_3 = Vector(X)

# ----
number_slider_25 = Slider(11.8, range=0..100)  # disabled
tree = Slider(2.13, range=0..5)
move_9 = Move(Geometry=move_8.Geometry, Motion=Z_6)  # -> Geometry, Transform
len = Length(Curve=crv_5)  # disabled

# ---- group: colortizer data
txt_3 = Text(txt_2)

# ----
panel_20 = Panel(txt_3)
division = Division(A=len, B=number_slider_24)  # disabled

# ---- group: parking cell #
parking_cell = Slider(18, range=0..50)

# ---- group: total parking cell number
# Parking & Park
int = Integer(parking_cell)

# ----
filter = StreamFilter(Gate=Toggle(True), Stream1=move_9.Geometry)
pt_20 = Point(<point referenced from the Rhino model>)  # disabled
divide_2 = DivideCurve(Curve=crv_5, Count=division, Kinks=False)  # -> Points, Tangents, Parameters; disabled
split_2 = SplitList(List=txt_3, Index=10)  # -> ListA, ListB
pshift_4 = ShiftPaths(Data=split_2.ListB, Offset=-1)
multiplication_3 = Multiplication(A="3", B=tree)
multiplication_4 = Multiplication(A="3", B=tree)
dom_6 = ConstructDomain(DomainStart=multiplication_3, DomainEnd=multiplication_4)
equals = Equality(FirstNumber=divide_2.Parameters, SecondNumber=0)  # -> Equality, Inequality; disabled

# ---- group: park cell #
park_cell = Slider(33, range=0..50)

# ---- group: total park cell number
int_2 = Integer(park_cell)

# ----
pshift_5 = ShiftPaths(Data=split_2.ListA, Offset=-1)
item = ListItem(List=txt_3, Index=266, Wrap=False)
show_google_map = BooleanToggle(False)
filter_2 = StreamFilter(Gate=show_google_map, Stream1=move_5.Geometry)
previewmat = CustomPreviewMaterials(
    Geometry=filter_2,
    DiffuseColor=ColourSwatch(SwatchColor=RGB(255, 255, 255)),
    Transparency=panel_15,
    DiffuseBitmap=panel_13)
dispatch = Dispatch(List=divide_2.Tangents, DispatchPattern=equals.Equality)  # -> ListA, ListB; disabled
dispatch_2 = Dispatch(List=divide_2.Points, DispatchPattern=equals.Equality)  # -> ListA, ListB; disabled
split_3 = TextSplit(Text=item, Separators="\t")
previewmat_2 = CustomPreviewMaterials(
    Geometry=filter,
    DiffuseColor=ColourSwatch(SwatchColor=RGB(255, 255, 255)),
    Transparency=panel_19,
    DiffuseBitmap=panel_17)
item_2 = ListItem(List=pshift_5, Index=4, Wrap=False)
pshift_6 = ShiftPaths(Data=dispatch.ListB, Offset=-1)  # disabled
item_3 = ListItem(List=pshift_5, Index=2, Wrap=False)
item_4 = ListItem(List=pshift_5, Index=3, Wrap=False)
item_5 = ListItem(List=pshift_5, Index=5, Wrap=False)
item_6 = ListItem(List=pshift_5, Index=6, Wrap=False)
item_7 = ListItem(List=pshift_5, Index=7, Wrap=False)
item_8 = ListItem(List=pshift_5, Index=9, Wrap=False)
pshift_7 = ShiftPaths(Data=dispatch_2.ListB, Offset=-1)  # disabled
pdecon = Deconstruct(Point=pshift_7)  # -> XComponent, YComponent, ZComponent; disabled
inc = Includes(Value=pdecon.YComponent, Domain=Domain(0, 1000))  # -> Includes, Deviation; disabled
inc_2 = Includes(Value=pdecon.XComponent, Domain=Domain(0, 1000))  # -> Includes, Deviation; disabled
item_9 = ListItem(List=pshift_5, Index=1, Wrap=False)
item_10 = ListItem(List=pshift_5, Index=0, Wrap=False)
item_11 = ListItem(List=pshift_5, Index=8, Wrap=False)
# Population Matrix - Old
panel_21 = Panel("Residential: ")  # disabled
panel_22 = Panel(" - Luxury: ")  # disabled
panel_23 = Panel(" - Micro-unit: ")  # disabled
panel_24 = Panel(" - Regular: ")  # disabled
and = GateAnd(A=inc_2.Includes, B=inc.Includes)  # disabled
pshift_8 = ShiftPaths(Data=split_3, Offset=1)
split_4 = TextSplit(Text=item_2, Separators="\t")
split_5 = TextSplit(Text=item_3, Separators="\t")
split_6 = TextSplit(Text=item_4, Separators="\t")
split_7 = TextSplit(Text=item_5, Separators="\t")
split_8 = TextSplit(Text=item_6, Separators="\t")
split_9 = TextSplit(Text=item_7, Separators="\t")
split_10 = TextSplit(Text=item_8, Separators="\t")
split_11 = TextSplit(Text=item_9, Separators="\t")
split_12 = TextSplit(Text=item_10, Separators="\t")
split_13 = TextSplit(Text=item_11, Separators="\t")
txt_4 = Text(pshift_8)
dispatch_3 = Dispatch(List=pshift_7, DispatchPattern=and)  # -> ListA, ListB; disabled
panel_25 = Panel("")  # disabled
dispatch_4 = Dispatch(List=pshift_6, DispatchPattern=and)  # -> ListA, ListB; disabled
pshift_9 = ShiftPaths(Data=split_4, Offset=1)
pshift_10 = ShiftPaths(Data=split_5, Offset=1)
pshift_11 = ShiftPaths(Data=split_6, Offset=1)
pshift_12 = ShiftPaths(Data=split_7, Offset=1)
pshift_13 = ShiftPaths(Data=split_8, Offset=1)
pshift_14 = ShiftPaths(Data=split_9, Offset=1)
pshift_15 = ShiftPaths(Data=split_10, Offset=1)
pshift_16 = ShiftPaths(Data=split_11, Offset=1)
pshift_17 = ShiftPaths(Data=split_12, Offset=1)
pshift_18 = ShiftPaths(Data=split_13, Offset=1)
number_slider_26 = Slider(19.1, range=0..100)  # disabled
panel_26 = Panel(txt_4)
total_ppl = Slider(28269, range=700..30000)
vec_4 = Vector(dispatch_4.ListA)  # disabled
pt_21 = Point(dispatch_3.ListA)  # disabled
item_12 = ListItem(List=pshift_9, Index=0, Wrap=False)
item_13 = ListItem(List=pshift_10, Index=0, Wrap=False)
item_14 = ListItem(List=pshift_11, Index=0, Wrap=False)
item_15 = ListItem(List=pshift_12, Index=0, Wrap=False)
item_16 = ListItem(List=pshift_13, Index=0, Wrap=False)
item_17 = ListItem(List=pshift_14, Index=0, Wrap=False)
item_18 = ListItem(List=pshift_15, Index=0, Wrap=False)
item_19 = ListItem(List=pshift_16, Index=0, Wrap=False)
item_20 = ListItem(List=pshift_17, Index=0, Wrap=False)
item_21 = ListItem(List=pshift_18, Index=0, Wrap=False)
swatch_2 = ColourSwatch(SwatchColor=RGB(201, 201, 201))  # disabled
xy_4 = XYPlane(Origin=pt_21)  # disabled
txt_5 = Text(item_12)
txt_6 = Text(item_13)
txt_7 = Text(item_14)
txt_8 = Text(item_15)
txt_9 = Text(item_16)
txt_10 = Text(item_17)
txt_11 = Text(item_18)
txt_12 = Text(item_19)
txt_13 = Text(item_20)
txt_14 = Text(item_21)
pt_22 = Point(<point referenced from the Rhino model>)  # disabled
item_22 = ListItem(List=panel_26, Index=0, Wrap=False)
item_23 = ListItem(List=panel_26, Index=1, Wrap=False)
item_24 = ListItem(List=panel_26, Index=2, Wrap=False)
item_25 = ListItem(List=panel_26, Index=4, Wrap=False)
item_26 = ListItem(List=panel_26, Index=5, Wrap=False)
item_27 = ListItem(List=panel_26, Index=3, Wrap=False)
number_slider_27 = Slider(65, range=0..100)  # disabled
number_slider_28 = Slider(0.86, range=0..1)  # disabled
panel_27 = Panel(txt_5)
panel_28 = Panel(txt_6)
panel_29 = Panel(txt_7)
panel_30 = Panel(txt_8)
panel_31 = Panel(txt_9)
panel_32 = Panel(txt_10)
panel_33 = Panel(txt_11)
panel_34 = Panel(txt_12)
panel_35 = Panel(txt_13)
panel_36 = Panel(txt_14)
align = AlignPlane(Plane=xy_4, Direction=vec_4)  # -> Plane, Angle; disabled
int_3 = Integer(item_22)
int_4 = Integer(int_3)
int_5 = Integer(item_23)
int_6 = Integer(int_5)
int_7 = Integer(item_24)
int_8 = Integer(int_7)
int_9 = Integer(item_27)
int_10 = Integer(int_9)
int_11 = Integer(item_25)
int_12 = Integer(int_11)
int_13 = Integer(item_26)
int_14 = Integer(int_13)
merge_5 = Merge(Data1=int_4, Data2=int_6, Data3=int_8, Data4=int_10, Data5=int_12, Data6=int_14)

# ---- group: all fl #s
txt_15 = Text([int_4, int_6, int_8, int_10, int_12, int_14])

# ---- group: floor num for each type
int_15 = Integer(merge_5)

int_16 = Integer(int_15)

# ----
multiplication_5 = Multiplication(A=int_15, B=panel_5)

# ---- group: building height for each type
num = Number(multiplication_5)

# ----
panel_37 = Panel(num)
panel_38 = Panel("Office: ")  # disabled
panel_39 = Panel(" - Headquarter: ")  # disabled
panel_40 = Panel(" - Regular: ")  # disabled
panel_41 = Panel(" - Co-working: ")  # disabled
res_warm_2 = ColourSwatch(SwatchColor=RGB(255, 246, 204))
off_cold_2 = ColourSwatch(SwatchColor=RGB(204, 229, 255))

# ---- group: Dashboard Text Color
color = ColourSwatch(SwatchColor=RGB(201, 201, 201))
col_2 = Colour(color)

# ----
col_3 = Colour(col_2)  # disabled
item_28 = ListItem(List=pshift_9, Index=1, Wrap=False)

# ---- group: dockRotation
int_17 = Integer(item_28)

int_18 = Integer(item_28)

# ----
item_29 = ListItem(List=pshift_10, Index=1, Wrap=False)
item_30 = ListItem(List=pshift_11, Index=1, Wrap=False)

# ---- group: dockID
int_19 = Integer(item_30)

int_20 = Integer(item_30)

# ----
item_31 = ListItem(List=pshift_12, Index=1, Wrap=False)

# ---- group: slider1
num_2 = Number(item_31)

num_3 = Number(item_31)

# ----
item_32 = ListItem(List=pshift_13, Index=1, Wrap=False)

# ---- group: toggle1
bool = Boolean(item_32)

bool_2 = Boolean(item_32)

# ----
panel_42 = Panel(bool_2)

# ---- group: toggle1
bool_3 = Boolean(panel_42)

# ---- group: traffic mode is PEV
bool_4 = Boolean(bool_3)

# ----
multiplication_6 = Multiplication(A=bool_4, B=panel)

# ---- group: traffic mode is PEV
bool_5 = Boolean(bool_3)  # disabled

# ---- group: toggle1
bool_6 = Boolean(bool_3)

# ----
filter_3 = StreamFilter(Gate=bool_6, Stream0=scale_nu.Geometry, Stream1=scale_nu_7.Geometry)
filter_4 = StreamFilter(Gate=bool_6, Stream0=scale_nu_2.Geometry, Stream1=scale_nu_8.Geometry)

# ---- group: toggle1
bool_7 = Boolean(bool_3)

# ----
filter_5 = StreamFilter(Gate=bool_7, Stream0=scale_nu_3.Geometry, Stream1=scale_nu_9.Geometry)
filter_6 = StreamFilter(Gate=bool_7, Stream0=scale_nu_4.Geometry, Stream1=scale_nu_10.Geometry)

# ---- group: toggle1
bool_8 = Boolean(bool_3)

# ----
filter_7 = StreamFilter(Gate=bool_8, Stream0=scale_nu_5.Geometry, Stream1=scale_nu_11.Geometry)
filter_8 = StreamFilter(Gate=bool_8, Stream0=scale_nu_6.Geometry, Stream1=scale_nu_12.Geometry)
mesh_38 = Mesh(filter_4)
mesh_39 = Mesh(filter_3)
mesh_40 = Mesh(filter_6)
mesh_41 = Mesh(filter_5)
mesh_42 = Mesh(filter_8)
mesh_43 = Mesh(filter_7)
filter_9 = StreamFilter(Gate=bool_6, Stream0=pt_7, Stream1=pt_13)
filter_10 = StreamFilter(Gate=bool_6, Stream0=pt_10, Stream1=pt_16)
filter_11 = StreamFilter(Gate=bool_7, Stream0=pt_8, Stream1=pt_14)
filter_12 = StreamFilter(Gate=bool_7, Stream0=pt_11, Stream1=pt_17)
filter_13 = StreamFilter(Gate=bool_8, Stream0=pt_9, Stream1=pt_15)
filter_14 = StreamFilter(Gate=bool_8, Stream0=pt_12, Stream1=pt_18)
pt_23 = Point(filter_10)
pt_24 = Point(filter_12)
pt_25 = Point(filter_9)
pt_26 = Point(filter_11)
pt_27 = Point(filter_14)
pt_28 = Point(filter_13)
item_33 = ListItem(List=pshift_14, Index=1, Wrap=False)

# ---- group: toggle2
bool_9 = Boolean(item_33)

bool_10 = Boolean(item_33)

# ----
item_34 = ListItem(List=pshift_15, Index=1, Wrap=False)
item_35 = ListItem(List=pshift_16, Index=1, Wrap=False)

# ---- group: gridExtent_x
int_21 = Integer(item_35)

int_22 = Integer(item_35)

# ----
division_2 = Division(A=dist, B=int_21)

# ---- group: cell size
num_4 = Number(division_2)

num_5 = Number(division_2)

# ----
division_3 = Division(A=num_5, B=2)
multiplication_7 = Multiplication(A=division_3, B=Slider(0.95, range=0..1))
neg_3 = Negative(Value=multiplication_7)
dom_7 = ConstructDomain(DomainStart=neg_3, DomainEnd=multiplication_7)
multiplication_8 = Multiplication(A=panel_7, B=num_4)  # disabled
pt_29 = ConstructPoint(XCoordinate=multiplication_8, YCoordinate=0, ZCoordinate=0)  # disabled
yz_2 = YZPlane(Origin=pt_29)  # disabled
mirror_2 = Mirror(Geometry=move_3.Geometry, Plane=yz_2)  # -> Geometry, Transform; disabled

# ---- group: gridExtent_x
# Dashboard
int_23 = Integer(item_35)

# ---- group: cell size
num_6 = Number(division_2)

# ----
division_4 = Division(A=num_6, B=2.5)
division_5 = Division(A=num_5, B=2)
neg_4 = Negative(Value=division_4)

# ---- group: cell area
sqr = Square(Value=num_5)

# ----
multiplication_9 = Multiplication(A=sqr, B=Slider(0.25, range=0..1))
num_7 = Number(multiplication_9)
dom_8 = ConstructDomain(DomainStart=neg_4, DomainEnd=division_4)

# ---- group: ppl per m2
multiplication_10 = Multiplication(A=num_7, B="0.018181")
multiplication_11 = Multiplication(A=num_7, B="0.05454")
multiplication_12 = Multiplication(A=num_7, B="0.0666667")
multiplication_13 = Multiplication(A=num_7, B="0.01123")
multiplication_14 = Multiplication(A=num_7, B="0.2")
multiplication_15 = Multiplication(A=num_7, B="0.0337")

# ---- group: ppl per flr
panel_43 = Panel(multiplication_10)
panel_44 = Panel(multiplication_13)
panel_45 = Panel(multiplication_12)
panel_46 = Panel(multiplication_15)
panel_47 = Panel(multiplication_11)
panel_48 = Panel(multiplication_14)

# ----
pshift_19 = ShiftPaths(Data=multiplication_11, Offset=-1)
pshift_20 = ShiftPaths(Data=multiplication_14, Offset=-1)
pshift_21 = ShiftPaths(Data=multiplication_12, Offset=-1)
pshift_22 = ShiftPaths(Data=multiplication_10, Offset=-1)
pshift_23 = ShiftPaths(Data=multiplication_15, Offset=-1)
pshift_24 = ShiftPaths(Data=multiplication_13, Offset=-1)

# ---- group: RS
num_8 = Number(pshift_21)

num_9 = Number(num_8)

# ---- group: OL
num_10 = Number(pshift_23)

num_11 = Number(num_10)

# ---- group: OS
num_12 = Number(pshift_20)

num_13 = Number(num_12)

# ---- group: OM
num_14 = Number(pshift_19)

num_15 = Number(num_14)

# ---- group: RM
num_16 = Number(pshift_22)

num_17 = Number(num_16)

# ---- group: RL
num_18 = Number(pshift_24)

num_19 = Number(num_18)

# ---- group: ppl per flr
# id5
# id3
# id4
# id0
# id2
# id1
# young
# mid
# old
panel_49 = Panel("0")
panel_50 = Panel("6")
panel_51 = Panel("12")
panel_52 = Panel("36")
panel_53 = Panel("9")
panel_54 = Panel("18")
panel_55 = Panel("48")
num_20 = Number(["0", num_17, "0", "0", num_15, "0"])
num_21 = Number([num_19, "0", "0", num_11, "0", "0"])
num_22 = Number([panel_49, "0", num_9, "0", "0", num_13])

# ----
multiplication_16 = Multiplication(A=num_22, B=number_slider_13)
multiplication_17 = Multiplication(A=num_20, B=number_slider_13)
multiplication_18 = Multiplication(A=num_21, B=number_slider_13)
num_23 = Number(multiplication_16)
num_24 = Number(multiplication_17)
num_25 = Number(multiplication_18)
item_36 = ListItem(List=pshift_17, Index=1, Wrap=False)
item_37 = ListItem(List=pshift_18, Index=1, Wrap=False)

# ---- group: toggle2
bool_11 = Boolean(item_37)

bool_12 = Boolean(item_37)

# ----
panel_56 = Panel("")  # disabled
rnd_reduce_by_ratio = RndReduceByRatio(L=align.Plane, B=number_slider_28, S=number_slider_27)  # disabled
number_slider_29 = Slider(11.8, range=0..100)  # disabled

# ---- group: dockRotation
int_24 = Integer(item_28)

# ---- group: IDMax
int_25 = Integer(item_29)

# ---- group: dockID
int_26 = Integer(item_30)

# ---- group: slider1
num_26 = Number(item_31)

# ---- group: toggle1
bool_13 = Boolean(item_32)

# ---- group: toggle2
bool_14 = Boolean(item_33)

# ---- group: gridExtent_x
int_27 = Integer(item_35)

# ---- group: gridIndex
int_28 = Integer(item_36)

# ---- group: toggle4
bool_15 = Boolean(item_34)

# ---- group: toggle3
bool_16 = Boolean(item_37)

# ----
mesh_44 = Mesh(mesh_34)  # disabled
pln_2 = Plane(rnd_reduce_by_ratio)  # disabled
swatch_3 = ColourSwatch(SwatchColor=RGB(201, 201, 201))  # disabled
panel_57 = Panel(int_24)
panel_58 = Panel(int_25)
panel_59 = Panel(int_26)
panel_60 = Panel(num_26)
panel_61 = Panel(bool_13)
panel_62 = Panel(bool_14)
panel_63 = Panel(int_27)
panel_64 = Panel(int_28)
panel_65 = Panel(bool_15)
panel_66 = Panel(bool_16)
pt_30 = Point(<point referenced from the Rhino model>)  # disabled

# ---- group: Dashboard Text Size 2
size = Slider(10, range=0..100)
num_27 = Number(size)

# ---- group: Dashboard Text Size 1
size_2 = Slider(15, range=0..100)
num_28 = Number(size_2)

# ----
orient = Orient(Geometry=mesh_44, Source=PlaneXY(0, 0, 0), Target=pln_2)  # -> Geometry, Transform; disabled
swatch_4 = ColourSwatch(SwatchColor=RGB(255, 255, 255))  # disabled
mjoin_2 = MeshJoin(Meshes=orient.Geometry)  # disabled
item_38 = ListItem(List=pshift_16, Index=2, Wrap=False)

# ---- group: gridExtent_y
int_29 = Integer(item_38)

int_30 = Integer(item_38)

int_31 = Integer(item_38)

int_32 = Integer(item_38)

# ----
mcol_4 = MeshColours(Mesh=mjoin_2, Colours=swatch_4)  # disabled
item_39 = ListItem(List=mesh_18, Index=int_26, Wrap=False)
pt_31 = Point(<point referenced from the Rhino model>)
neg_5 = Negative(Value=int_24)
panel_67 = Panel(int_32)
subtraction_2 = Subtraction(A=int_27, B=1)
mesh_45 = Mesh(mcol_4)  # disabled
rotate = Rotate(Geometry=item_39, Angle=degrees(neg_5), Plane=PlaneXY(0, 0, 0))  # -> Geometry, Transform

ttl_min = Slider(100, range=0..100)
type_min = Slider(20, range=0..100)

vec2pt_2 = Vector2Pt(PointA=Point(0, 0, 0), PointB=pt_31, Unitize=False)  # -> Vector, Length
multiplication_19 = Multiplication(A=int_27, B=int_32)
split_14 = SplitList(List=pshift_4, Index=multiplication_19)  # -> ListA, ListB
pshift_25 = ShiftPaths(Data=split_14.ListA, Offset=-1)
split_15 = TextSplit(Text=pshift_25, Separators="\t")
pshift_26 = ShiftPaths(Data=split_15, Offset=1)

# ---- group: all data
int_33 = Integer(pshift_26)

# ----
panel_68 = Panel(int_33)
item_40 = ListItem(List=int_33, Index="3", Wrap=False)
item_41 = ListItem(List=int_33, Index="0", Wrap=False)
item_42 = ListItem(List=int_33, Index="1", Wrap=False)
item_43 = ListItem(List=int_33, Index="2", Wrap=False)
pshift_27 = ShiftPaths(Data=item_41, Offset=-1)
pshift_28 = ShiftPaths(Data=item_42, Offset=-1)
pshift_29 = ShiftPaths(Data=item_43, Offset=-1)
pshift_30 = ShiftPaths(Data=item_40, Offset=-1)
neg_6 = Negative(Value=pshift_30)

# ---- group: module id
int_34 = Integer(pshift_27)

int_35 = Integer(int_34)

int_36 = Integer(int_34)

# ----
larger = LargerThan(FirstNumber=int_35, SecondNumber="0")  # -> LargerThan, OrEqualTo
smaller = SmallerThan(FirstNumber=int_35, SecondNumber="5")  # -> SmallerThan, OrEqualTo
and_2 = GateAnd(A=larger.OrEqualTo, B=smaller.OrEqualTo)

# ---- group: is building or not
bool_17 = Boolean(and_2)

# ----
dispatch_5 = Dispatch(List=int_35, DispatchPattern=bool_17)  # -> ListA, ListB

# ---- group: building id
int_37 = Integer(dispatch_5.ListA)

# ----
larger_2 = LargerThan(FirstNumber=int_36, SecondNumber="0")  # -> LargerThan, OrEqualTo
smaller_2 = SmallerThan(FirstNumber=int_36, SecondNumber="5")  # -> SmallerThan, OrEqualTo
and_3 = GateAnd(A=larger_2.OrEqualTo, B=smaller_2.OrEqualTo)
# Human Dots @ Lego - Outside
dispatch_6 = Dispatch(List=int_36, DispatchPattern=and_3)  # -> ListA, ListB

# ---- group: filted id
int_38 = Integer(dispatch_6.ListA)

# ----
dispatch_7 = Dispatch(List=int_36, DispatchPattern=and_3)  # -> ListA, ListB; disabled
item_44 = ListItem(List=txt_15, Index=graft(int_38), Wrap=True)
item_45 = ListItem(List=txt_15, Index=graft(dispatch_7.ListA), Wrap=True)  # disabled
pshift_31 = ShiftPaths(Data=item_44, Offset=-1)
pshift_32 = ShiftPaths(Data=item_45, Offset=-1)  # disabled

# ---- group: flr #s
txt_16 = Text(pshift_31)

# ----
txt_17 = Text(pshift_32)  # disabled
filter_15 = StreamFilter(Gate=show_google_map, Stream0=txt_17)  # disabled
dispatch_8 = Dispatch(List=int_36, DispatchPattern=and_3)  # -> ListA, ListB

# ---- group: ids filted - building module
int_39 = Integer(dispatch_8.ListA)

# ----
item_46 = ListItem(List=merge_4, Index=graft(int_39), Wrap=False)
txt_18 = Text(filter_15)  # disabled
smaller_3 = SmallerThan(FirstNumber=int_36, SecondNumber="0")  # -> SmallerThan, OrEqualTo
item_47 = ListItem(List=mesh_18, Index=graft(dispatch_8.ListA), Wrap=False)
item_48 = ListItem(List=panel_37, Index=graft(int_37), Wrap=False)
pshift_33 = ShiftPaths(Data=item_47, Offset=-1)
item_49 = ListItem(List=num_25, Index=graft(int_38), Wrap=True)
item_50 = ListItem(List=num_23, Index=graft(int_38), Wrap=True)
item_51 = ListItem(List=num_24, Index=graft(int_38), Wrap=True)
pshift_34 = ShiftPaths(Data=item_48, Offset=-1)
pshift_35 = ShiftPaths(Data=item_49, Offset=-1)
pshift_36 = ShiftPaths(Data=item_50, Offset=-1)
pshift_37 = ShiftPaths(Data=item_51, Offset=-1)
multiplication_20 = Multiplication(A=pshift_34, B=number_slider_15)

# ---- group: building height of each building
num_29 = Number(multiplication_20)

# ----
addition_2 = Addition(A=num_29, B=panel_6)
dom_9 = ConstructDomain(DomainStart=0, DomainEnd=addition_2)

# ---- group: old per flr
num_30 = Number(pshift_35)

# ---- group: young per flr
num_31 = Number(pshift_36)

# ---- group: mid per flr
num_32 = Number(pshift_37)

# ----
equals_2 = Equality(FirstNumber=int_36, SecondNumber="7")  # -> Equality, Inequality
equals_3 = Equality(FirstNumber=int_36, SecondNumber="6")  # -> Equality, Inequality
multiplication_21 = Multiplication(A=num_32, B=txt_16)
multiplication_22 = Multiplication(A=num_31, B=txt_16)
multiplication_23 = Multiplication(A=num_30, B=txt_16)
or = GateOr(A=equals_3.Equality, B=equals_2.Equality)

# ---- group: total ppl in building mid
int_40 = Integer(multiplication_21)

# ---- group: total ppl in building young
int_41 = Integer(multiplication_22)

# ----
addition_3 = Addition(A=int_41, B=int_40)

# ---- group: total ppl in building old
int_42 = Integer(multiplication_23)

# ----
addition_4 = Addition(A=addition_3, B=int_42)

# ---- group: total ppl in building - all
int_43 = Integer(addition_4)

int_44 = Integer(int_43)

# ----
remap = RemapNumbers(Value=int_44, Source=panel_2, Target=panel_3)  # -> Mapped, Clipped
bnd = Bounds(Numbers=int_44)
panel_69 = Panel(bnd)

# ---- group: density level
int_45 = Integer(remap.Mapped)

# ----
bnd_2 = Bounds(Numbers=int_45)
panel_70 = Panel(bnd_2)
min = Minimum(A=int_45, B=dedomain.End)
bnd_3 = Bounds(Numbers=min)
panel_71 = Panel(bnd_3)

# ---- group: density level in range
int_46 = Integer(min)

# ----
item_52 = ListItem(List=movetoorgin, Index=graft(int_46), Wrap=False)
pshift_38 = ShiftPaths(Data=item_52, Offset=-1)

# ---- group: module id
int_47 = Integer(int_34)

# ----
equals_4 = Equality(FirstNumber=int_47, SecondNumber="0")  # -> Equality, Inequality
equals_5 = Equality(FirstNumber=int_47, SecondNumber="1")  # -> Equality, Inequality
equals_6 = Equality(FirstNumber=int_47, SecondNumber="3")  # -> Equality, Inequality
equals_7 = Equality(FirstNumber=int_47, SecondNumber="2")  # -> Equality, Inequality
equals_8 = Equality(FirstNumber=int_47, SecondNumber="4")  # -> Equality, Inequality
equals_9 = Equality(FirstNumber=int_47, SecondNumber="5")  # -> Equality, Inequality
int_48 = Integer(equals_4.Equality)
int_49 = Integer(equals_5.Equality)
int_50 = Integer(equals_6.Equality)
int_51 = Integer(equals_7.Equality)
int_52 = Integer(equals_8.Equality)
int_53 = Integer(equals_9.Equality)
ma = MassAddition(Input=int_48)  # -> Result, PartialResults
ma_2 = MassAddition(Input=int_49)  # -> Result, PartialResults
ma_3 = MassAddition(Input=int_50)  # -> Result, PartialResults
ma_4 = MassAddition(Input=int_51)  # -> Result, PartialResults
ma_5 = MassAddition(Input=int_52)  # -> Result, PartialResults
ma_6 = MassAddition(Input=int_53)  # -> Result, PartialResults
int_54 = Integer(ma.Result)
panel_72 = Panel(int_54)
int_55 = Integer(ma_2.Result)
panel_73 = Panel(int_55)
int_56 = Integer(ma_3.Result)
panel_74 = Panel(int_56)
int_57 = Integer(ma_4.Result)
panel_75 = Panel(int_57)
int_58 = Integer(ma_5.Result)
panel_76 = Panel(int_58)
int_59 = Integer(ma_6.Result)
panel_77 = Panel(int_59)

# ---- group: Micro-unit Building #
int_60 = Integer(int_57)

# ---- group: Regular residential Building #
int_61 = Integer(int_55)

# ---- group: Luxury Building #
int_62 = Integer(int_54)

# ---- group: Head Quater Building #
int_63 = Integer(int_56)

# ---- group: Regular Office Building #
int_64 = Integer(int_58)

# ---- group: Co-working Building #
int_65 = Integer(int_59)

# ----
multiplication_24 = Multiplication(A=int_12, B=int_64)
multiplication_25 = Multiplication(A=int_6, B=int_61)
multiplication_26 = Multiplication(A=int_14, B=int_65)
multiplication_27 = Multiplication(A=int_8, B=int_60)
multiplication_28 = Multiplication(A=int_10, B=int_63)
multiplication_29 = Multiplication(A=int_4, B=int_62)

multiplication_30 = Multiplication(A=panel_47, B=multiplication_24)
multiplication_31 = Multiplication(A=panel_43, B=multiplication_25)
multiplication_32 = Multiplication(A=panel_45, B=multiplication_27)
multiplication_33 = Multiplication(A=panel_48, B=multiplication_26)
multiplication_34 = Multiplication(A=panel_46, B=multiplication_28)
multiplication_35 = Multiplication(A=panel_44, B=multiplication_29)

# ---- group: Regular Office ppl #
int_66 = Integer(multiplication_30)

# ---- group: Head Quater ppl #
int_67 = Integer(multiplication_34)

# ---- group: Co-working ppl #
int_68 = Integer(multiplication_33)

# ---- group: Micro-unit ppl #
int_69 = Integer(multiplication_32)

# ----
join = TextJoin(Text=flatten([panel_23, int_69]))  # disabled

# ---- group: Luxury ppl #
int_70 = Integer(multiplication_35)

# ----
join_2 = TextJoin(Text=flatten([panel_22, int_70]))  # disabled

# ---- group: Regular residential ppl #
int_71 = Integer(multiplication_31)

# ----
join_3 = TextJoin(Text=flatten([panel_24, int_71]))  # disabled
ma_7 = MassAddition(Input=[int_68, int_66, int_67])  # -> Result, PartialResults
ma_8 = MassAddition(Input=[int_69, int_71, int_70])  # -> Result, PartialResults

# ---- group: total working ppl #
int_72 = Integer(ma_7.Result)

# ---- group: total residential ppl #
int_73 = Integer(ma_8.Result)

# ----
join_4 = TextJoin(Text=flatten([panel_21, int_73]))  # disabled
join_5 = TextJoin(Text=[join_4, join, join_3, join_2], Join=panel_25)  # disabled

# ---- group: residential list
tag = TextTag3D(Location=pt_22, Text=join_5, Size=number_slider_26, Colour=swatch_2, Justification=1)  # disabled

# ----
addition_5 = Addition(A=int_73, B=int_72)
join_6 = TextJoin(Text=flatten([panel_38, int_72]))  # disabled
join_7 = TextJoin(Text=flatten([panel_40, int_66]))  # disabled
join_8 = TextJoin(Text=flatten([panel_41, int_68]))  # disabled
join_9 = TextJoin(Text=flatten([panel_39, int_67]))  # disabled
join_10 = TextJoin(Text=[join_6, join_8, join_7, join_9], Join=panel_56)  # disabled

# ---- group: total ppl #
int_74 = Integer(addition_5)

int_75 = Integer(int_74)

int_76 = Integer(int_74)  # disabled

# ----
remap_2 = RemapNumbers(Value=int_75, Source=domain, Target=Domain(0, 0.5))  # -> Mapped, Clipped
int_77 = Integer(int_76)  # disabled
remap_3 = RemapNumbers(Value=int_75, Source=domain, Target=Domain(0.3, 1))  # -> Mapped, Clipped
congestion = PythonScript(A=crossings_2, S=srf, P=pt_4, N=int_77, B=bool_5)  # -> out, C, t; inputs A: list, P: list; disabled
# ---------- congestion: Python ----------
import random 
import rhinoscriptsyntax as rs

ratio = float((N-700)/(35000.0-700.0))

C=[]
t=[]

#print ratio

hue = 50 - 50 * ratio
alpha = 255 * ratio

if B :
    hue += 45
    alpha /= float(3)

min_distance = []

for p in P:
    mind = 10000000
    for a in A:
        d = rs.Distance(a,p)
        if d < mind:
            mind = d
    distance =  (1-mind/250) * 0.2 
    hue += distance*2
    if not B:
        t.append((60-hue)*1.5)
    else:
        t.append((100-hue)*0.5)
    C.append(rs.ColorHLSToRGB((hue+random.randint(-2,2),128,255,alpha+random.randint(-5,5))));
# ---------- end congestion ----------
gradient = Gradient(LowerLimit=0, UpperLimit=100, Parameter=congestion.t, stops=[0: RGB(79, 79, 79), 0.793: RGB(173, 0, 0)])  # disabled
pshift_39 = ShiftPaths(Data=gradient, Offset=-1)  # disabled
graft_3 = GraftTree(Tree=pshift_39, IncludeEmptyLists=True, IncludeNullItems=True)  # disabled
mspray = MeshSpray(Mesh=graft, Points=Point(0, 0, 0), Colours=graft_3, SprayMode=0)  # disabled
mspray_2 = MeshSpray(Mesh=graft_2, Points=Point(0, 0, 0), Colours=graft_3, SprayMode=0)  # disabled
mjoin_3 = MeshJoin(Meshes=flatten(mspray))  # disabled
mjoin_4 = MeshJoin(Meshes=flatten(mspray_2))  # disabled
filter_16 = StreamFilter(Gate=show_google_map, Stream0=mjoin_3)  # disabled

# ---- group: road traffic 3D
mesh_46 = Mesh(mjoin_4)  # disabled

# ---- group: road traffic lego
mesh_47 = Mesh(filter_16)  # disabled

# ----
panel_78 = Panel(congestion.t)  # disabled
# Amenity List - Yasushi
amenities = PythonScript(N=int_74)  # -> out, A; disabled
# ---------- amenities: Python ----------
import math

title = ["density","subway_station","department_store","embassy","beauty_salon","police","courthouse","cemetery","pharmacy","local_government_office","shopping_mall","city_hall","rv_park","shoe_store","bank","bowling_alley","school","bar","university","car_dealer","taxi_stand","grocery_or_supermarket","fire_station","church","convenience_store","campground","lawyer","parking","post_office","hindu_temple","hardware_store","meal_takeaway","movie_rental","gas_station","funeral_home","aquarium","restaurant","home_goods_store","atm","veterinary_care","airport","locksmith","bus_station","hospital","night_club","electrician","mosque","amusement_park","lodging","florist","liquor_store","museum","car_rental","stadium","store","hair_care","transit_station","meal_delivery","gym","park","dentist","library","book_store","painter","roofing_contractor","moving_company","clothing_store","furniture_store","physiotherapist","casino","art_gallery","car_wash","movie_theater","spa","accounting","cafe","car_repair","synagogue","real_estate_agency","electronics_store","doctor","bicycle_store","storage","zoo","train_station","jewelry_store","laundry","insurance_agency","plumber","pet_store","bakery","travel_agency"]

newyork = [27673,10,6,10,74,3,0,0,29,27,16,0,0,28,111,2,35,200,6,13,0,20,2,13,23,1,200,89,6,0,0,74,5,0,0,0,200,102,183,2,1,7,41,22,60,16,0,0,140,12,7,9,7,0,200,60,51,28,35,13,135,31,18,5,1,28,200,21,46,1,26,1,35,39,200,96,18,0,200,105,200,2,11,0,0,200,29,200,9,2,37,177]
atlanta = [700,0,0,0,15,0,0,0,3,2,1,0,0,2,4,0,4,31,1,0,0,2,1,5,3,0,200,10,0,0,1,4,0,1,0,0,46,13,7,1,0,0,11,8,7,0,0,0,5,0,1,1,0,0,59,15,11,2,7,0,25,0,0,2,1,1,8,7,2,0,3,1,0,11,8,9,3,0,22,3,58,0,0,0,0,0,6,22,2,2,2,4]

ratio = (N - atlanta[0]) / float(newyork[0] - atlanta[0])
print ratio

amenities = {}

for i in range(len(title))[1:]:
    amenity =  title[i]
    num =  math.floor(atlanta[i]+(newyork[i]-atlanta[i]) * ratio)
    
    if title[i].startswith('law'): continue
    if title[i].startswith('jew'): continue
    if title[i].startswith('accoun'): continue
    if title[i].startswith('store'): continue
    if title[i].startswith('travel'): continue
    if title[i].startswith('cloth'): continue
    if title[i].startswith('local_'): continue
    if title[i].startswith('electronic'): continue
    if title[i].startswith('dent'): continue
    if title[i].startswith('insu'): continue
    if title[i].startswith('physio'): continue
    if title[i].startswith('real'): continue
    if title[i].startswith('doc'): continue
    if title[i].startswith('storage'): continue
    if title[i].startswith('painter'): continue
    if title[i].startswith('moving'): continue
    if title[i].startswith('subway'): continue
    if title[i].startswith('meal'): continue
    if title[i].startswith('embassy'): continue
    if title[i].startswith('shoe'): continue
    
    if num > 2:
        amenities[title[i]] = num

result = []
cnt = 0

for amenity in sorted(amenities, key=lambda k: amenities[k], reverse=True):
    cnt += 1
    if cnt%4 <= 1 : continue
    result.append('{}: {}'.format(amenity,int(amenities[amenity])))
    

print result

A = result
# ---------- end amenities ----------
panel_79 = Panel(amenities.A)  # disabled
join_11 = TextJoin(Text=panel_79, Join=panel_16)  # disabled

# ---- group: amenity list
tag_2 = TextTag3D(Location=pt_20, Text=join_11, Size=number_slider_25, Colour=col_3, Justification=1)  # disabled

# ---- group: residential list
tag_3 = TextTag3D(Location=pt_30, Text=join_10, Size=number_slider_26, Colour=swatch_3, Justification=1)  # disabled

# ----
panel_80 = Panel(int_74)

# ---- group: y
int_78 = Integer(pshift_29)

int_79 = Integer(int_78)

int_80 = Integer(int_78)

int_81 = Integer(int_78)

# ---- group: rotation
int_82 = Integer(neg_6)

int_83 = Integer(int_82)

int_84 = Integer(int_82)

# ----
dispatch_9 = Dispatch(List=int_84, DispatchPattern=and_3)  # -> ListA, ListB
rotate_2 = Rotate(Geometry=pshift_33, Angle=degrees(dispatch_9.ListA), Plane=PlaneXY(0, 0, 0))  # -> Geometry, Transform
graft_4 = GraftTree(Tree=rotate_2.Transform, IncludeEmptyLists=True, IncludeNullItems=True)  # disabled
graft_5 = GraftTree(Tree=rotate_2.Transform, IncludeEmptyLists=True, IncludeNullItems=True)

# ---- group: rotation
int_85 = Integer(int_82)

# ----
subtraction_3 = Subtraction(A=subtraction_2, B=pshift_28)

# ---- group: x
int_86 = Integer(subtraction_3)

int_87 = Integer(int_86)

int_88 = Integer(int_86)

# ---- group: road check matrix
python_2 = PythonScript(xe=int_21, ye=int_29, x=int_88, y=int_80, id=int_36)  # -> out, m; inputs x: list, y: list, id: list
# ---------- python_2: Python ----------
"""
CityMatrix

written by "Ryan" Yan Zhang <ryanz@mit.edu>
for MIT Media Lab, Changing Place Group
April.6th.2016
"""

import rhinoscriptsyntax as rs

m = [[-1 for n in range(xe)] for n in range(ye)]

#for n in range(len(id)):
#    if id[n] == 7:
#        m[y[n]][x[n]] = 6
#    else:
#        m[y[n]][x[n]] = id[n]

for n in range(len(id)):
    m[y[n]][x[n]] = id[n]

for n in range(ye):
    print m[n]
# ---------- end python_2 ----------

python_3 = PythonScript(xe=int_21, ye=int_29, x=int_88, y=int_80, id=int_36)  # -> out, m; inputs x: list, y: list, id: list; same code as python_2

# ---- group: sidewalk check matrix
python_4 = PythonScript(xe=int_21, ye=int_29, x=int_88, y=int_80, id=int_36)  # -> out, m; inputs x: list, y: list, id: list; same code as python_2

# ----
modulecenter = ModuleCenter(pt=pt, num=num_4, int_2=int_88, int=int_80)  # -> pt_5, transform_2
xform = Transform(modulecenter.transform_2)  # disabled

# ---- group: road check list
python_5 = PythonScript(xe=int_21, ye=int_29, x=int_88, y=int_80, id=int_36, m=python_2.m)  # -> out, rdType; inputs x: list, y: list, id: list, m: list
# ---------- python_5: Python ----------
"""
CityMatrix

written by "Ryan" Yan Zhang <ryanz@mit.edu>
for MIT Media Lab, Changing Place Group
April.6th.2016
"""

import rhinoscriptsyntax as rs

rdType = []

for n in range(len(id)):
    
    code = []
    
    if id[n]==6:
        
        # 0: check x, y+1
        if y[n]+1>ye-1:
            code.append(1)
        else:
            if m[y[n]+1][x[n]]==6:
                code.append(1)
            else:
                code.append(0)
        
        # 1: check x+1, y
        if x[n]+1>xe-1:
            code.append(1)
        else:
            if m[y[n]][x[n]+1]==6:
                code.append(1)
            else:
                code.append(0)
        
        # 2: check x, y-1
        if y[n]-1<0:
            code.append(1)
        else:
            if m[y[n]-1][x[n]]==6:
                code.append(1)
            else:
                code.append(0)
        
        # 3: check x-1, y
        if x[n]-1<0:
            code.append(1)
        else:
            if m[y[n]][x[n]-1]==6:
                code.append(1)
            else:
                code.append(0)
    
    else:
        
        code = [0,0,0,0]
    
    print code
    rdType.append(code)
# ---------- end python_5 ----------

python_6 = PythonScript(xe=int_21, ye=int_29, x=int_88, y=int_80, id=int_36, m=python_3.m)  # -> out, rdType; inputs x: list, y: list, id: list, m: list; same code as python_5

# ---- group: sidewalk check list
python_7 = PythonScript(xe=int_21, ye=int_29, x=int_88, y=int_80, id=int_36, m=python_4.m)  # -> out, rdType; inputs x: list, y: list, id: list, m: list; same code as python_5

# ---- group: module center
pt_32 = Point(modulecenter.pt_5)

pt_33 = Point(pt_32)

# ----
dispatch_10 = Dispatch(List=pt_33, DispatchPattern=bool_17)  # -> ListA, ListB

# ---- group: road check list
python_8 = PythonScript(pt=pt_32, id=int_36, rdType=python_5.rdType, rdQua0=mesh_39, c0=pt_25, rdQua1=mesh_38, c1=pt_23)  # -> out, allRoadMesh; inputs pt: list, id: list, rdType: list, rdQua0: list, rdQua1: list
# ---------- python_8: Python ----------
"""
CityMatrix

written by "Ryan" Yan Zhang <ryanz@mit.edu>
for MIT Media Lab, Changing Place Group
April.6th.2016
"""

import rhinoscriptsyntax as rs
import Rhino.Geometry as rg

allRoadMesh = []

for n in range(len(id)):
    
    if id[n]==6:
        
        for i in range(len(rdType[n])):
            t = rdType[n][i]
            v = rs.PointCoordinates(pt[n])
            if t == 0:
                c = rs.PointCoordinates(c0)
                vx = v[0]-c[0]
                vy = v[1]-c[1]
                new = rs.CopyObject(rdQua0[i],(vx,vy,0.))
            else:
                c = rs.PointCoordinates(c1)
                vx = v[0]-c[0]
                vy = v[1]-c[1]
                new = rs.CopyObject(rdQua1[i],(vx,vy,0.))
            allRoadMesh.append(new)
# ---------- end python_8 ----------

python_9 = PythonScript(pt=pt_32, id=int_36, rdType=python_6.rdType, rdQua0=mesh_41, c0=pt_26, rdQua1=mesh_40, c1=pt_24)  # -> out, allRoadMesh; inputs pt: list, id: list, rdType: list, rdQua0: list, rdQua1: list; same code as python_8

# ---- group: building center
pt_34 = Point(dispatch_10.ListA)

# ---- group: sidewalk check list
python_10 = PythonScript(pt=pt_32, id=int_36, rdType=python_7.rdType, rdQua0=mesh_43, c0=pt_28, rdQua1=mesh_42, c1=pt_27)  # -> out, allRoadMesh; inputs pt: list, id: list, rdType: list, rdQua0: list, rdQua1: list; same code as python_8

# ---- group: sidewalk mesh final!
mesh_48 = Mesh(python_10.allRoadMesh)

# ----
move_10 = Move(Geometry=mesh_48, Motion=vec)  # -> Geometry, Transform
box = DomainBox(Base=pt_34, X=dom_7, Y=dom_7, Z=dom_9)
dispatch_11 = Dispatch(List=pt_32, DispatchPattern=smaller_3.SmallerThan)  # -> ListA, ListB
vec2pt_3 = Vector2Pt(PointA=Point(0, 0, 0), PointB=dispatch_11.ListA, Unitize=False)  # -> Vector, Length
move_11 = Move(Geometry=box, Motion=vec)  # -> Geometry, Transform
dispatch_12 = Dispatch(List=pt_32, DispatchPattern=and_3)  # -> ListA, ListB

# ---- group: module center pts filted - building module
pt_35 = Point(dispatch_12.ListA)

# ----
vec2pt_4 = Vector2Pt(PointA=Point(0, 0, 0), PointB=pt_35, Unitize=False)  # -> Vector, Length
move_12 = Move(Geometry=pshift_38, Motion=vec2pt_4.Vector)  # -> Geometry, Transform
mspray_3 = MeshSpray(Mesh=graft(move_12.Geometry), Points=Point(0, 0, 0), Colours=item_46, SprayMode=0)
mesh_49 = Mesh(mspray_3)
move_13 = Move(Geometry=mesh_19, Motion=vec2pt_3.Vector)  # -> Geometry, Transform

# ---- group: building geo
box_2 = Box(move_11.Geometry)

# ---- group: textured buildings
panel_81 = Panel("C:\Users\RYAN\Documents\GitHub\CityMatrix\Map\PEV_PSG AND PKG_300DPI.png")  # disabled
panel_82 = Panel("0.01")  # disabled
swatch_5 = ColourSwatch(SwatchColor=RGB(255, 255, 255))  # disabled
boxmap = BoxMapping(Mesh=box_2, Box=box_2)  # disabled
previewmat_3 = CustomPreviewMaterials(Geometry=boxmap, DiffuseColor=swatch_5, Transparency=panel_82, DiffuseBitmap=panel_81)  # disabled

# ----
vec2pt_5 = Vector2Pt(PointA=Point(0, 0, 0), PointB=dispatch_12.ListA, Unitize=False)  # -> Vector, Length
move_14 = Move(Geometry=rotate_2.Geometry, Motion=vec2pt_5.Vector)  # -> Geometry, Transform
pshift_40 = ShiftPaths(Data=move_14.Transform, Offset=-1)  # disabled
pshift_41 = ShiftPaths(Data=move_14.Transform, Offset=-1)
graft_6 = GraftTree(Tree=pshift_40, IncludeEmptyLists=True, IncludeNullItems=True)  # disabled
graft_7 = GraftTree(Tree=pshift_41, IncludeEmptyLists=True, IncludeNullItems=True)
comp = Compound(Transforms=[graft_4, graft_6])  # disabled
comp_2 = Compound(Transforms=[graft_5, graft_7])
transform = Transform(Geometry=xy_2, Transform=comp)  # disabled
transform_2 = Transform(Geometry=xy_3, Transform=comp_2)
pshift_42 = ShiftPaths(Data=transform, Offset=-1)  # disabled
pshift_43 = ShiftPaths(Data=transform_2, Offset=-1)

# ---- group: people dots base plans
pln_3 = Plane(pshift_43)

# ---- group: block #
lng = ListLength(List=pln_3)

# ---- group: seed d
random = Random(Range=Domain(0, 10000), Number=lng, Seed=Slider(17, range=0..100))

# ---- group: seed r
random_2 = Random(Range=Domain(0, 10000), Number=lng, Seed=number_slider_5)

# ---- group: seed d
random_3 = Random(Range=Domain(0, 10000), Number=lng, Seed=Slider(51, range=0..100))

random_4 = Random(Range=Domain(0, 10000), Number=lng, Seed=Slider(46, range=0..100))

# ---- group: seed r
random_5 = Random(Range=Domain(0, 10000), Number=lng, Seed=number_slider_6)

random_6 = Random(Range=Domain(0, 10000), Number=lng, Seed=number_slider_7)

# ----
pshift_44 = ShiftPaths(Data=random_2, Offset=-1)
pshift_45 = ShiftPaths(Data=random, Offset=-1)
pshift_46 = ShiftPaths(Data=random_5, Offset=-1)
pshift_47 = ShiftPaths(Data=random_6, Offset=-1)
pshift_48 = ShiftPaths(Data=random_3, Offset=-1)
pshift_49 = ShiftPaths(Data=random_4, Offset=-1)

# ---- group: d
random_7 = Random(Range=Domain(0, 1), Number=int_41, Seed=pshift_45)

# ---- group: r
random_8 = Random(Range=Domain(0, 360), Number=int_41, Seed=pshift_44)

# ---- group: d
random_9 = Random(Range=Domain(0, 1), Number=int_40, Seed=pshift_48)

random_10 = Random(Range=Domain(0, 1), Number=int_42, Seed=pshift_49)

# ---- group: r
random_11 = Random(Range=Domain(0, 360), Number=int_40, Seed=pshift_46)

random_12 = Random(Range=Domain(0, 360), Number=int_42, Seed=pshift_47)

# ----
graph = GraphMapper(
    random_7,
    x0=0,
    x1=1,
    y0=0,
    y1=1,
    container_name="Bezier",
    cpx=[0, 0.2763824463, 1, 1],
    cpy=[0, 0.2786865234, 0.3680863976, 1])
graph_2 = GraphMapper(
    random_9,
    x0=0,
    x1=1,
    y0=0,
    y1=1,
    container_name="Bezier",
    cpx=[0, 0.3430397809, 1, 1],
    cpy=[0, 0.5653408766, 0.3680863976, 1])
graph_3 = GraphMapper(
    random_10,
    x0=0,
    x1=1,
    y0=0,
    y1=1,
    container_name="Bezier",
    cpx=[0, 0.2961647809, 0.9886363745, 1],
    cpy=[0, 0.6839488745, 0.5063920021, 1])
rad = Radians(Degrees=random_8)
rad_2 = Radians(Degrees=random_11)
rad_3 = Radians(Degrees=random_12)
remap_4 = RemapNumbers(Value=graph, Source=Domain(0, 1), Target=dom)  # -> Mapped, Clipped
remap_5 = RemapNumbers(Value=graph_2, Source=Domain(0, 1), Target=dom_2)  # -> Mapped, Clipped
remap_6 = RemapNumbers(Value=graph_3, Source=Domain(0, 1), Target=dom_3)  # -> Mapped, Clipped
pt_36 = PointCylindrical(BasePlane=graft(pln_3), Angle=rad, Radius=remap_4.Mapped, Elevation=0)
pt_37 = PointCylindrical(BasePlane=graft(pln_3), Angle=rad_2, Radius=remap_5.Mapped, Elevation=0)
pt_38 = PointCylindrical(BasePlane=graft(pln_3), Angle=rad_3, Radius=remap_6.Mapped, Elevation=0)
tag_4 = TextTag3D(Location=pshift_42, Text=txt_18, Size=number_slider_11, Colour=swatch, Justification=5)  # disabled
pshift_50 = ShiftPaths(Data=pt_36, Offset=-1)
pdecon_2 = Deconstruct(Point=pshift_50)  # -> XComponent, YComponent, ZComponent
pshift_51 = ShiftPaths(Data=pt_37, Offset=-1)
pdecon_3 = Deconstruct(Point=pshift_51)  # -> XComponent, YComponent, ZComponent
pshift_52 = ShiftPaths(Data=pt_38, Offset=-1)
pdecon_4 = Deconstruct(Point=pshift_52)  # -> XComponent, YComponent, ZComponent
inc_3 = Includes(Value=pdecon_2.YComponent, Domain=Domain(0, 1000))  # -> Includes, Deviation
inc_4 = Includes(Value=pdecon_2.XComponent, Domain=Domain(0, 1000))  # -> Includes, Deviation
inc_5 = Includes(Value=pdecon_3.YComponent, Domain=Domain(0, 1000))  # -> Includes, Deviation
inc_6 = Includes(Value=pdecon_3.XComponent, Domain=Domain(0, 1000))  # -> Includes, Deviation
inc_7 = Includes(Value=pdecon_4.YComponent, Domain=Domain(0, 1000))  # -> Includes, Deviation
inc_8 = Includes(Value=pdecon_4.XComponent, Domain=Domain(0, 1000))  # -> Includes, Deviation
and_4 = GateAnd(A=inc_4.Includes, B=inc_3.Includes)
and_5 = GateAnd(A=inc_6.Includes, B=inc_5.Includes)
and_6 = GateAnd(A=inc_8.Includes, B=inc_7.Includes)
dispatch_13 = Dispatch(List=pshift_50, DispatchPattern=and_4)  # -> ListA, ListB
dispatch_14 = Dispatch(List=pshift_51, DispatchPattern=and_5)  # -> ListA, ListB
dispatch_15 = Dispatch(List=pshift_52, DispatchPattern=and_6)  # -> ListA, ListB
pt_39 = Point(dispatch_13.ListA)
pt_40 = Point(dispatch_14.ListA)
pt_41 = Point(dispatch_15.ListA)
rnd_reduce_by_ratio_2 = RndReduceByRatio(L=pt_39, B=number_slider_14, S=Slider(52, range=0..100))
rnd_reduce_by_ratio_3 = RndReduceByRatio(L=pt_40, B=number_slider_14, S=Slider(59, range=0..100))
rnd_reduce_by_ratio_4 = RndReduceByRatio(L=pt_41, B=number_slider_14, S=Slider(72, range=0..100))
pt_42 = Point(rnd_reduce_by_ratio_2)
move_15 = Move(Geometry=mesh_29, Motion=pt_42)  # -> Geometry, Transform
pt_43 = Point(rnd_reduce_by_ratio_3)
move_16 = Move(Geometry=mesh_31, Motion=pt_43)  # -> Geometry, Transform
pt_44 = Point(rnd_reduce_by_ratio_4)
move_17 = Move(Geometry=mesh_30, Motion=pt_44)  # -> Geometry, Transform
mjoin_5 = MeshJoin(Meshes=move_15.Geometry)
mjoin_6 = MeshJoin(Meshes=move_17.Geometry)
mjoin_7 = MeshJoin(Meshes=move_16.Geometry)
dispatch_16 = Dispatch(List=pt_32, DispatchPattern=or)  # -> ListA, ListB

# ---- group: sidewalk
mesh_50 = Mesh(move_10.Geometry)

# ----
mcol_5 = MeshColours(Mesh=mjoin_5, Colours=mln_young_3)
mcol_6 = MeshColours(Mesh=mjoin_6, Colours=exc_elderly_3)
mcol_7 = MeshColours(Mesh=mjoin_7, Colours=mid_mid_career_3)

# ---- group: road mesh final!
mesh_51 = Mesh(python_8.allRoadMesh)

# ---- group: road center pts
pt_45 = Point(dispatch_16.ListA)

# ---- group: center line mesh final!
mesh_52 = Mesh(python_9.allRoadMesh)

# ----
preview = CustomPreview(Geometry=pt_43, Shader=mid_mid_career_3)

# ---- group: building lego modules
mesh_53 = Mesh(move_14.Geometry)

# ---- group: blank
mesh_54 = Mesh(move_13.Geometry)

mesh_55 = Mesh(mesh_54)

# ----
move_18 = Move(Geometry=mesh_55, Motion=vec)  # -> Geometry, Transform

# ---- group: blank
mesh_56 = Mesh(move_18.Geometry)

# ---- group: sidewalk mesh final!
mesh_57 = Mesh(python_10.allRoadMesh)

# ----
preview_2 = CustomPreview(Geometry=pt_44, Shader=exc_elderly_3)
easter_eggs = EasterEggs(L=pt_32, A_2=int_36, shrink=cell_shrink, L_2=pt_32, A=int_36, shrink_2=cell_shrink)  # disabled
preview_3 = CustomPreview(Geometry=pt_42, Shader=mln_young_3)
filter_17 = StreamFilter(Gate=show_google_map, Stream0=mesh_53)
filter_18 = StreamFilter(Gate=show_google_map, Stream0=mesh_51)
filter_19 = StreamFilter(Gate=show_google_map, Stream0=mesh_52)
filter_20 = StreamFilter(Gate=show_google_map, Stream0=mesh_54)
filter_21 = StreamFilter(Gate=show_google_map, Stream0=mesh_57)

# ---- group: old ppl dots mesh
mesh_58 = Mesh(mcol_6)

# ---- group: mid ppl dots mesh
mesh_59 = Mesh(mcol_7)

# ---- group: young ppl dots mesh
mesh_60 = Mesh(mcol_5)

# ---- group: road mesh final!
mesh_61 = Mesh(filter_18)

mesh_62 = Mesh(mesh_61)

# ----
move_19 = Move(Geometry=mesh_62, Motion=vec)  # -> Geometry, Transform

# ---- group: road
mesh_63 = Mesh(move_19.Geometry)

# ---- group: center line mesh final!
mesh_64 = Mesh(filter_19)

# Traffic Heatmap - Ryan
mesh_65 = Mesh(mesh_64)

# ----
pshift_53 = ShiftPaths(Data=mesh_65, Offset=-3)
area_2 = Area(Geometry=pshift_53)  # -> Area, Centroid

# ---- group: center pts
pt_46 = Point(area_2.Centroid)

# ----
cps = ClosestPoints(Point=pt_46, Cloud=pt_3, Count=1)  # -> ClosestPoint, CPIndex, Distance
pshift_54 = ShiftPaths(Data=cps.ClosestPoint, Offset=-1)
dist_2 = Distance(PointA=graft(pshift_54), PointB=crossings)
bnd_4 = Bounds(Numbers=dist_2)
dedomain_2 = DeconstructDomain(Domain=bnd_4)  # -> Start, End
pshift_55 = ShiftPaths(Data=dedomain_2.Start, Offset=-1)

# ---- group: min dis to intersections
num_33 = Number(pshift_55)

# ----
bnd_5 = Bounds(Numbers=num_33)
remap_7 = RemapNumbers(Value=num_33, Source=bnd_5, Target=Domain(0, 1))  # -> Mapped, Clipped
subtraction_4 = Subtraction(A=1, B=remap_7.Mapped)
graph_4 = GraphMapper(
    subtraction_4,
    x0=0,
    x1=1,
    y0=0,
    y1=0.5,
    container_name="Bezier",
    cpx=[0, 0.1613658518, 0.7159118652, 1],
    cpy=[0, 0.3613502979, 0.9704423547, 1])
multiplication_36 = Multiplication(A=graph_4, B=remap_3.Mapped)
addition_6 = Addition(A=remap_2.Mapped, B=multiplication_36)
addition_7 = Addition(A=addition_6, B=multiplication_6)
gradient_2 = Gradient(
    LowerLimit=0,
    UpperLimit=1,
    Parameter=addition_7,
    stops=[0: RGB(0, 128, 0), 0.422: RGB(255, 255, 0), 0.919: RGB(255, 0, 0)])
argb_2 = SplitARGB(Colour=gradient_2, IntegerChannels=True)  # -> Alpha, Red, Green, Blue
vec_5 = VectorXYZ(XComponent=argb_2.Red, YComponent=argb_2.Green, ZComponent=argb_2.Blue)  # -> Vector, Length
multiplication_37 = Multiplication(A=vec_5.Vector, B=number_slider_10)
addition_8 = Addition(A=multiplication_37, B=multiplication_2)
devec = DeconstructVector(Vector=addition_8)  # -> XComponent, YComponent, ZComponent
rgb = ColourRGB(Alpha=255, Red=devec.XComponent, Green=devec.YComponent, Blue=devec.ZComponent)
col_4 = Colour(rgb)
mspray_4 = MeshSpray(Mesh=graft(pshift_53), Points=graft(pshift_54), Colours=graft(col_4), SprayMode=0)
mjoin_8 = MeshJoin(Meshes=flatten(mspray_4))
filter_22 = StreamFilter(Gate=show_google_map, Stream0=mjoin_8)

# ---- group: road traffic lego
mesh_66 = Mesh(filter_22)

# ---- group: building lego modules
mesh_67 = Mesh(filter_17)

# ---- group: blank
mesh_68 = Mesh(filter_20)

# ---- group: sidewalk mesh final!
mesh_69 = Mesh(filter_21)

# ---- group: x
int_89 = Integer(int_86)

# ---- group: blank modules
mesh_70 = Mesh(mesh_54)

# ----
geobottomcenter = GeoBottomCenter_2(geo=mesh_70)
lng_2 = ListLength(List=geobottomcenter)
division_6 = Division(A=int, B=lng_2)
randomsplit = RandomSplitList(MasterList=geobottomcenter, Seed=Slider(32, range=0..100), Split=division_6)  # -> ListA, ListB
lng_3 = ListLength(List=randomsplit.ListA)
division_7 = Division(A=int_2, B=lng_3)
randomsplit_2 = RandomSplitList(MasterList=randomsplit.ListA, Seed=Slider(25, range=0..100), Split=division_7)  # -> ListA, ListB

# ---- group: parking center
pt_47 = Point(randomsplit.ListB)

# ---- group: park center lego
pt_48 = Point(randomsplit_2.ListB)

# ----
move_20 = Move(Geometry=pt_48, Motion=vec_3)  # -> Geometry, Transform

# ---- group: park center 3D
pt_49 = Point(move_20.Geometry)

# ----
planesrf_4 = PlaneSurface(Plane=pt_49, XSize=dom_8, YSize=dom_8)
lng_4 = ListLength(List=pt_49)
random_13 = Random(Range="0.8 to 1.4", Number=lng_4, Seed=Slider(72, range=0..100))
multiplication_38 = Multiplication(A=random_13, B=tree_scale)
scale = Scale(Geometry=mesh_37, Center=Point(0, 0, 0), Factor=multiplication_38)  # -> Geometry, Transform
random_14 = Random(Range=dom_6, Number=lng_4, Seed=Slider(17, range=0..100))
random_15 = Random(Range=Domain(0, 1000), Number=lng_4, Seed=Slider(35, range=0..100))
vec2pt_6 = Vector2Pt(PointA=Point(0, 0, 0), PointB=pt_48, Unitize=False)  # -> Vector, Length
vec2pt_7 = Vector2Pt(PointA=Point(0, 0, 0), PointB=pt_47, Unitize=False)  # -> Vector, Length
popgeo = PopulateGeometry(Geometry=flatten(planesrf_4), Count=flatten(random_14), Seed=flatten(random_15))
move_21 = Move(Geometry=mesh_36, Motion=vec2pt_6.Vector)  # -> Geometry, Transform
move_22 = Move(Geometry=mesh_35, Motion=vec2pt_7.Vector)  # -> Geometry, Transform

# ---- group: tree center
pt_50 = Point(flatten(popgeo))

# ----
vec2pt_8 = Vector2Pt(PointA=Point(0, 0, 0), PointB=pt_50, Unitize=False)  # -> Vector, Length
move_23 = Move(Geometry=scale.Geometry, Motion=vec2pt_8.Vector)  # -> Geometry, Transform

# ---- group: parking lego
mesh_71 = Mesh(move_21.Geometry)

# ----
move_24 = Move(Geometry=mesh_71, Motion=vec_3)  # -> Geometry, Transform

# ---- group: parking 3D
mesh_72 = Mesh(move_24.Geometry)

# ---- group: parking lego
mesh_73 = Mesh(move_22.Geometry)

# ----
move_25 = Move(Geometry=mesh_73, Motion=vec_3)  # -> Geometry, Transform

# ---- group: parking 3D
mesh_74 = Mesh(move_25.Geometry)

# ---- group: trees 3D
mesh_75 = Mesh(move_23.Geometry)

# ----
filter_23 = StreamFilter(Gate=show_google_map, Stream0=mesh_71)
filter_24 = StreamFilter(Gate=show_google_map, Stream0=mesh_73)

# ---- group: parking lego
mesh_76 = Mesh(filter_23)

mesh_77 = Mesh(filter_24)

# ----
pshift_56 = ShiftPaths(Data=int_73, Offset=-1)
nullrep = ReplaceNulls(Items=pshift_56, Replacements=0)  # -> Items, Count
max = Maximum(A=nullrep.Items, B=ttl_min)
pt_51 = ConstructPoint(XCoordinate=Slider(3.5, range=0..10), YCoordinate=Slider(-14, range=-30..0), ZCoordinate=Slider(5.1, range=0..10))
panel_83 = Panel(int_86)
panel_84 = Panel(int_78)
panel_85 = Panel(int_82)
panel_86 = Panel(int_34)
pshift_57 = ShiftPaths(Data=int_69, Offset=-1)
nullrep_2 = ReplaceNulls(Items=pshift_57, Replacements=0)  # -> Items, Count
pshift_58 = ShiftPaths(Data=int_71, Offset=-1)
nullrep_3 = ReplaceNulls(Items=pshift_58, Replacements=0)  # -> Items, Count
pshift_59 = ShiftPaths(Data=int_70, Offset=-1)
nullrep_4 = ReplaceNulls(Items=pshift_59, Replacements=0)  # -> Items, Count
move_26 = Move(Geometry=rotate.Geometry, Motion=vec2pt_2.Vector)  # -> Geometry, Transform
max_2 = Maximum(A=nullrep_4.Items, B=type_min)
max_3 = Maximum(A=nullrep_3.Items, B=type_min)
max_4 = Maximum(A=nullrep_2.Items, B=type_min)

# ---- group: total cell #
int_90 = Integer(multiplication_19)

# ---- group: R
int_91 = Integer(max)

# ----
xy_5 = XYPlane(Origin=pt_51)
comp_3 = Compound(Transforms=flatten([rotate.Transform, move_26.Transform]))

# ---- group: RL
int_92 = Integer(max_2)

# ---- group: RM
int_93 = Integer(max_3)

# ---- group: RS
int_94 = Integer(max_4)

# ----
panel_87 = Panel(int_90)
# Population Matrix - New
pt_52 = Point(<point referenced from the Rhino model>)
num_34 = Number(num_28)
col_5 = Colour(res_warm_2)

# ---- group: dock lego modules
mesh_78 = Mesh(move_26.Geometry)

# ----
# Dock
panel_88 = Panel("Residential")
pt_53 = Point(<point referenced from the Rhino model>)
num_35 = Number(num_28)
pt_54 = Point(<point referenced from the Rhino model>)
num_36 = Number(num_28)
col_6 = Colour(res_warm_2)
pt_55 = Point(<point referenced from the Rhino model>)
num_37 = Number(num_28)
col_7 = Colour(res_warm_2)
col_8 = Colour(res_warm_2)

# ---- group: residential total
tag_5 = TextTag3D(Location=pt_52, Text=int_91, Size=num_34, Colour=col_5, Justification=7)

# ----
transform_3 = Transform(Geometry=xy_5, Transform=comp_3)

# ---- group: RL
tag_6 = TextTag3D(Location=pt_54, Text=int_92, Size=num_36, Colour=col_7, Justification=7)

# ---- group: RS
tag_7 = TextTag3D(Location=pt_53, Text=int_94, Size=num_35, Colour=col_6, Justification=7)

# ---- group: RM
tag_8 = TextTag3D(Location=pt_55, Text=int_93, Size=num_37, Colour=col_8, Justification=7)

# ----
pshift_60 = ShiftPaths(Data=int_72, Offset=-1)
nullrep_5 = ReplaceNulls(Items=pshift_60, Replacements=0)  # -> Items, Count
txt_19 = Text(["Large Unit", "Medium Unit", "Small Unit", "Large Unit", "Medium Unit", "Small Unit"])
txt_20 = Text([panel_88, "Residential", "Residential", "Office", "Office", "Office"])
max_5 = Maximum(A=nullrep_5.Items, B=ttl_min)
pshift_61 = ShiftPaths(Data=int_67, Offset=-1)
nullrep_6 = ReplaceNulls(Items=pshift_61, Replacements=0)  # -> Items, Count
pshift_62 = ShiftPaths(Data=int_68, Offset=-1)
nullrep_7 = ReplaceNulls(Items=pshift_62, Replacements=0)  # -> Items, Count
pshift_63 = ShiftPaths(Data=int_66, Offset=-1)
nullrep_8 = ReplaceNulls(Items=pshift_63, Replacements=0)  # -> Items, Count

# ---- group: O
int_95 = Integer(max_5)

# ----
number_slider_30 = Slider(15.2, range=0..100)
max_6 = Maximum(A=nullrep_7.Items, B=type_min)
max_7 = Maximum(A=nullrep_6.Items, B=type_min)
item_53 = ListItem(List=txt_19, Index=int_26, Wrap=False)
max_8 = Maximum(A=nullrep_8.Items, B=type_min)
item_54 = ListItem(List=txt_20, Index=int_26, Wrap=False)

# ---- group: sticky rotations
python_11 = PythonScript(x=int_82)  # -> out, rotations; inputs x: list; disabled
# ---------- python_11: Python ----------
"""
Realtime Simulator

written by Yan "Ryan" Zhang <ryanz@mit.edu>
for MIT Media Lab, Changing Place Group, CityScope Project
March.7th.2016
"""

import scriptcontext as sc

sc.sticky["rotations"] = x

rotations = sc.sticky["rotations"]
# ---------- end python_11 ----------

# ---- group: sticky y steps
python_12 = PythonScript(x=int_78)  # -> out, ySteps; inputs x: list; disabled
# ---------- python_12: Python ----------
"""
Realtime Simulator

written by Yan "Ryan" Zhang <ryanz@mit.edu>
for MIT Media Lab, Changing Place Group, CityScope Project
March.7th.2016
"""

import scriptcontext as sc

sc.sticky["ySteps"] = x

ySteps = sc.sticky["ySteps"]
# ---------- end python_12 ----------

# ---- group: sticky moduleIDs
python_13 = PythonScript(x=int_34)  # -> out, moduleIDs; inputs x: list; disabled
# ---------- python_13: Python ----------
"""
Realtime Simulator

written by Yan "Ryan" Zhang <ryanz@mit.edu>
for MIT Media Lab, Changing Place Group, CityScope Project
March.7th.2016
"""

import scriptcontext as sc

sc.sticky["moduleIDs"] = x

moduleIDs = sc.sticky["moduleIDs"]
# ---------- end python_13 ----------

# ---- group: sticky x steps
python_14 = PythonScript(x=int_86)  # -> out, xSteps; inputs x: list; disabled
# ---------- python_14: Python ----------
"""
Realtime Simulator

written by Yan "Ryan" Zhang <ryanz@mit.edu>
for MIT Media Lab, Changing Place Group, CityScope Project
March.7th.2016
"""

import scriptcontext as sc

sc.sticky["xSteps"] = x

xSteps = sc.sticky["xSteps"]
# ---------- end python_14 ----------

# ---- group: OL
int_96 = Integer(max_7)

# ---- group: OM
int_97 = Integer(max_8)

# ---- group: OS
int_98 = Integer(max_6)

# ----
pt_56 = Point(<point referenced from the Rhino model>)
num_38 = Number(num_28)
col_9 = Colour(off_cold_2)
swatch_6 = ColourSwatch(SwatchColor=RGB(201, 201, 201))
pt_57 = Point(<point referenced from the Rhino model>)
num_39 = Number(num_28)
pt_58 = Point(<point referenced from the Rhino model>)
num_40 = Number(num_28)
col_10 = Colour(off_cold_2)
col_11 = Colour(off_cold_2)
pt_59 = Point(<point referenced from the Rhino model>)
num_41 = Number(num_28)
col_12 = Colour(off_cold_2)

# ---- group: office total
tag_9 = TextTag3D(Location=pt_56, Text=int_95, Size=num_38, Colour=col_9, Justification=7)

# ----
pt_60 = Point(<point referenced from the Rhino model>)
pt_61 = Point(<point referenced from the Rhino model>)

# ---- group: OL
tag_10 = TextTag3D(Location=pt_57, Text=int_67, Size=num_39, Colour=col_10, Justification=7)

# ----
panel_89 = Panel(python_11.rotations)  # disabled

# ---- group: OS
tag_11 = TextTag3D(Location=pt_58, Text=int_68, Size=num_40, Colour=col_11, Justification=7)

# ---- group: OM
tag_12 = TextTag3D(Location=pt_59, Text=int_66, Size=num_41, Colour=col_12, Justification=7)

# ----
panel_90 = Panel(python_11.out)  # disabled
panel_91 = Panel(python_12.ySteps)  # disabled
panel_92 = Panel(python_12.out)  # disabled
panel_93 = Panel(python_14.xSteps)  # disabled
panel_94 = Panel(python_14.out)  # disabled
panel_95 = Panel(python_13.moduleIDs)  # disabled
panel_96 = Panel(python_13.out)  # disabled

# ---- group: unit name
tag_13 = TextTag3D(Location=pt_60, Text=item_53, Size=number_slider_30, Colour=swatch_6, Justification=5)

# ---- group: res/off
tag_14 = TextTag3D(Location=pt_61, Text=item_54, Size=number_slider_30, Colour=swatch_6, Justification=5)

# ----
mid_mid_career_4 = ColourSwatch(SwatchColor=RGB(255, 208, 0))
# Bar Diagram
mln_young_4 = ColourSwatch(SwatchColor=RGB(0, 166, 255))
exc_elderly_4 = ColourSwatch(SwatchColor=RGB(255, 0, 0))
_0 = Slider(0, range=0..1)

# ---- group: v sep ln length
number_slider_31 = Slider(16, range=10..20)

# ---- group: gh ref pt start
pt_62 = Point(<point referenced from the Rhino model>)

# ---- group: gh ref pt end
pt_63 = Point(<point referenced from the Rhino model>)

# ---- group: bar diagram ppl range
domain_2 = Domain("0 to 20000")

# ----
# Toggles
panel_97 = Panel("Private Car")
pdecon_5 = Deconstruct(Point=pt_63)  # -> XComponent, YComponent, ZComponent
pdecon_6 = Deconstruct(Point=pt_62)  # -> XComponent, YComponent, ZComponent
neg_7 = Negative(Value=number_slider_31)
merge_6 = Merge(Data1=mln_young_4, Data2=mid_mid_career_4, Data3=exc_elderly_4)
txt_21 = Text(["Amenity On", "Amenity Off"])
txt_22 = Text(["Sat. Map On", "Sat. Map Off"])
txt_23 = Text(["Hmn Intrctn On", "Hmn Intrctn Off"])
txt_24 = Text([panel_97, "Mobility on Demand"])
Y = UnitY(Factor=number_slider_31)
Y_2 = UnitY(Factor=neg_7)
item_55 = ListItem(List=txt_21, Index=bool_16, Wrap=True)
item_56 = ListItem(List=txt_22, Index=bool_15, Wrap=True)
item_57 = ListItem(List=txt_23, Index=bool_14, Wrap=True)
item_58 = ListItem(List=txt_24, Index=bool_13, Wrap=True)
addition_9 = Addition(A=int_94, B=int_93)
addition_10 = Addition(A=int_98, B=int_97)
pt_64 = Point(<point referenced from the Rhino model>)
pt_65 = Point(<point referenced from the Rhino model>)
pt_66 = Point(<point referenced from the Rhino model>)
pt_67 = Point(<point referenced from the Rhino model>)
addition_11 = Addition(A=addition_9, B=int_92)
addition_12 = Addition(A=addition_10, B=int_96)

# ---- group: amenities
tag_15 = TextTag3D(Location=pt_64, Text=item_55, Size=number_slider_30, Colour=swatch_6, Justification=5)

# ---- group: google map
tag_16 = TextTag3D(Location=pt_66, Text=item_56, Size=number_slider_30, Colour=swatch_6, Justification=5)

# ---- group: human interaction
tag_17 = TextTag3D(Location=pt_65, Text=item_57, Size=number_slider_30, Colour=swatch_6, Justification=5)

# ---- group: transportation mode
tag_18 = TextTag3D(Location=pt_67, Text=item_58, Size=number_slider_30, Colour=swatch_6, Justification=5)

# ----
merge_7 = Merge(Data1=_0, Data2=int_94, Data3=addition_9, Data4=addition_11)
merge_8 = Merge(Data1=_0, Data2=int_98, Data3=addition_10, Data4=addition_12)

# ---- group: module center
pt_68 = Point(modulecenter.pt_5)

# ----
srf_2 = Surface(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)

# ---- group: module id
int_99 = Integer(int_34)

# ---- group: dockID
int_100 = Integer(item_30)

# ----
equals_10 = Equality(FirstNumber=int_37, SecondNumber=int_100)  # -> Equality, Inequality
multiplication_39 = Multiplication(A=equals_10.Inequality, B=6)
addition_13 = Addition(A=int_37, B=multiplication_39)
neg_8 = Negative(Value=number_slider_31)

# ---- group: ttl h len
subtraction_5 = Subtraction(A=pdecon_5.XComponent, B=pdecon_6.XComponent)

# ---- group: 0-1
remap_8 = RemapNumbers(Value=merge_7, Source=domain_2, Target=Domain(0, 1))  # -> Mapped, Clipped

remap_9 = RemapNumbers(Value=merge_8, Source=domain_2, Target=Domain(0, 1))  # -> Mapped, Clipped

# ----
mesh_79 = Mesh(srf_2)
division_8 = Division(A=neg_8, B=2)
division_9 = Division(A=number_slider_31, B=2)
equals_11 = Equality(FirstNumber=int_100, SecondNumber="-1")  # -> Equality, Inequality
filter_25 = StreamFilter(Gate=equals_11.Equality, Stream0=addition_13, Stream1=int_37)
item_59 = ListItem(List=col, Index=graft(filter_25), Wrap=False)
pshift_64 = ShiftPaths(Data=item_59, Offset=-1)

# ---- group: color for each building
col_13 = Colour(pshift_64)

# ---- group: 3D Buldings
preview_4 = CustomPreview(Geometry=box_2, Shader=col_13)

# ----
equals_12 = Equality(FirstNumber=int_99, SecondNumber=int_100)  # -> Equality, Inequality
Z_7 = UnitZ(Factor=Slider(5.3, range=0..10))
multiplication_40 = Multiplication(A=remap_9.Mapped, B=subtraction_5)
# Slider
Y_3 = UnitY(Factor=division_8)
multiplication_41 = Multiplication(A=remap_8.Mapped, B=subtraction_5)
Y_4 = UnitY(Factor=division_9)
panel_98 = Panel("1 to 30")  # disabled
move_27 = Move(Geometry=mesh_79, Motion=Z_7)  # -> Geometry, Transform
addition_14 = Addition(A=pdecon_6.XComponent, B=multiplication_41)
addition_15 = Addition(A=pdecon_6.XComponent, B=multiplication_40)
dispatch_17 = Dispatch(List=pt_68, DispatchPattern=equals_12.Inequality)  # -> ListA, ListB

# ---- group: slider1
num_42 = Number(num_26)  # disabled

# ----
pt_69 = ConstructPoint(XCoordinate=addition_14, YCoordinate=pdecon_6.YComponent, ZCoordinate=0)
move_28 = Move(Geometry=pt_69, Motion=Y_4)  # -> Geometry, Transform
shift_3 = ShiftList(List=move_28.Geometry, Shift=-1, Wrap=False)
pt_70 = ConstructPoint(XCoordinate=addition_15, YCoordinate=pdecon_6.YComponent, ZCoordinate=0)
move_29 = Move(Geometry=pt_70, Motion=Y_3)  # -> Geometry, Transform
shift_4 = ShiftList(List=move_29.Geometry, Shift=-1, Wrap=False)
range = Range(Domain=panel_98, Steps=100)  # disabled
vec2pt_9 = Vector2Pt(PointA=Point(0, 0, 0), PointB=dispatch_17.ListA, Unitize=False)  # -> Vector, Length
shift_5 = ShiftList(List=move_29.Geometry, Shift=1, Wrap=False)
shift_6 = ShiftList(List=move_28.Geometry, Shift=1, Wrap=False)
multiplication_42 = Multiplication(A=num_42, B=100)  # disabled

# ---- group: lower v sep ln
line = LineSDL(Start=pt_70, Direction=Y_2, Length=number_slider_31)

# ---- group: upper v sep ln
line_2 = LineSDL(Start=pt_69, Direction=Y, Length=number_slider_31)

# ---- group: h sep ln
ln = Line(StartPoint=pt_62, EndPoint=pt_63)

# ----
int_101 = Integer(range)  # disabled
move_30 = Move(Geometry=move_27.Geometry, Motion=vec2pt_9.Vector)  # -> Geometry, Transform
ln_2 = Line(StartPoint=shift_4, EndPoint=shift_5)
ln_3 = Line(StartPoint=shift_3, EndPoint=shift_6)
neg_9 = Negative(Value=number_slider_31)
neg_10 = Negative(Value=number_slider_31)
txt_25 = Text(int_101)  # disabled
int_102 = Integer(multiplication_42)  # disabled
mjoin_9 = MeshJoin(Meshes=move_30.Geometry)
division_10 = Division(A=neg_9, B=6)
division_11 = Division(A=neg_10, B=6)
item_60 = ListItem(List=txt_25, Index=int_102, Wrap=True)  # disabled

# ---- group: dock lego floor number
tag_19 = TextTag3D(
    Location=transform_3,
    Text=item_60,
    Size=Slider(17, range=0..100),
    Colour=ColourSwatch(SwatchColor=RGB(0, 0, 0)),
    Justification=5)

# ----
Y_5 = UnitY(Factor=division_10)
Y_6 = UnitY(Factor=division_11)
division_12 = Division(A=number_slider_31, B=3)
division_13 = Division(A=number_slider_31, B=3)
filter_26 = StreamFilter(Gate=equals_11.Equality, Stream0=mjoin_9)
move_31 = Move(Geometry=ln_2, Motion=Y_5)  # -> Geometry, Transform
pt_71 = Point(<point referenced from the Rhino model>)  # disabled
move_32 = Move(Geometry=ln_3, Motion=Y_6)  # -> Geometry, Transform
Y_7 = UnitY(Factor=division_12)
Y_8 = UnitY(Factor=division_13)

# ---- group: fl # slider
tag_20 = TextTag3D(Location=pt_71, Text=item_60, Size=number_slider_30, Colour=swatch_6, Justification=8)  # disabled

# ---- group: last pt O
item_61 = ListItem(List=pt_70, Index=-1, Wrap=True)

# ---- group: last pt R
item_62 = ListItem(List=pt_69, Index=-1, Wrap=True)

# ----
extr = Extrude(Base=move_31.Geometry, Direction=Y_7)
extr_2 = Extrude(Base=move_32.Geometry, Direction=Y_8)
preview_5 = CustomPreview(Geometry=filter_26, Shader=ColourSwatch(SwatchColor=RGBA(0, 0, 0, 128)))
mesh_80 = Mesh(extr)
mesh_81 = Mesh(extr_2)
neg_11 = Negative(Value=number_slider_31)
division_14 = Division(A=neg_11, B=2)
Y_9 = UnitY(Factor=division_14)
move_33 = Move(Geometry=item_61, Motion=Y_9)  # -> Geometry, Transform
division_15 = Division(A=number_slider_31, B=2)
Y_10 = UnitY(Factor=division_15)
move_34 = Move(Geometry=item_62, Motion=Y_10)  # -> Geometry, Transform
mspray_5 = MeshSpray(Mesh=graft(mesh_80), Points=Point(0, 0, 0), Colours=graft(merge_6), SprayMode=0)
mspray_6 = MeshSpray(Mesh=graft(mesh_81), Points=Point(0, 0, 0), Colours=graft(merge_6), SprayMode=0)
X_3 = UnitX(Factor=3)
move_35 = Move(Geometry=move_33.Geometry, Motion=X_3)  # -> Geometry, Transform
X_4 = UnitX(Factor=3)
move_36 = Move(Geometry=move_34.Geometry, Motion=X_4)  # -> Geometry, Transform
pshift_65 = ShiftPaths(Data=mspray_5, Offset=-1)
pshift_66 = ShiftPaths(Data=mspray_6, Offset=-1)

# ---- group: all sep lns
crv_6 = Curve([ln, line_2, line])

# ----
pt_72 = Point(move_35.Geometry)
num_43 = Number(num_27)
col_14 = Colour(off_cold_2)
pt_73 = Point(move_36.Geometry)
num_44 = Number(num_27)
col_15 = Colour(res_warm_2)

# ---- group: work
tag_21 = TextTag3D(Location=pt_72, Text="work", Size=num_43, Colour=col_14, Justification=4)

# ---- group: live
tag_22 = TextTag3D(Location=pt_73, Text="live", Size=num_44, Colour=col_15, Justification=4)

# ---- group: work
mesh_82 = Mesh(pshift_65)

# ---- group: live
mesh_83 = Mesh(pshift_66)

# ----
preview_6 = CustomPreview(Geometry=crv_6, Shader=col_2)

# ==== cluster ModuleCenter
pt = ClusterInput()
int = ClusterInput()
num = ClusterInput()
int_2 = ClusterInput()

# ---- group: y
int_3 = Integer(int)

# ---- group: cell size
num_2 = Number(num)

# ---- group: x
int_4 = Integer(int_2)

# ---- group: center
pt_2 = Point(pt)

# ----
pt_3 = ConstructPoint(XCoordinate=0, YCoordinate=0, ZCoordinate=0)  # disabled
addition = Addition(A=int_4, B=0.5)
vec2pt = Vector2Pt(PointA=pt_3, PointB=pt_2, Unitize=False)  # -> Vector, Length; disabled
addition_2 = Addition(A=int_3, B=0.5)
multiplication = Multiplication(A=addition, B=num_2)
lng = ListLength(List=int_4)  # disabled
move = Move(Motion=vec2pt.Vector)  # -> Geometry, Transform; disabled
multiplication_2 = Multiplication(A=addition_2, B=num_2)
X = UnitX(Factor=multiplication)
repeat = RepeatData(Data=move.Transform, Length=lng)  # disabled
neg = Negative(Value=multiplication_2)
move_2 = Move(Geometry=pt_2, Motion=X)  # -> Geometry, Transform
graft = GraftTree(Tree=move_2.Transform, IncludeEmptyLists=True, IncludeNullItems=True)  # disabled
Y = UnitY(Factor=neg)
pshift = ShiftPaths(Data=repeat, Offset=-1)  # disabled
move_3 = Move(Geometry=move_2.Geometry, Motion=Y)  # -> Geometry, Transform
graft_2 = GraftTree(Tree=move_3.Transform, IncludeEmptyLists=True, IncludeNullItems=True)  # disabled
comp = Compound(Transforms=[graft, graft_2])  # disabled
graft_3 = GraftTree(Tree=pshift, IncludeEmptyLists=True, IncludeNullItems=True)  # disabled
comp_2 = Compound(Transforms=[comp, graft_3])  # disabled

# ---- group: module center
pt_4 = Point(move_3.Geometry)

# ----
pshift_2 = ShiftPaths(Data=comp_2, Offset=-1)  # disabled
transform = Transform(pshift_2)  # disabled
pt_5 = ClusterOutput(pt_4)
transform_2 = ClusterOutput(transform)  # disabled

# ==== cluster MoveToOrgin
num = ClusterInput()
G = ClusterInput()
num_2 = Number(num)
geobottomcenter = GeoBottomCenter(geo=G)
vec2pt = Vector2Pt(PointA=geobottomcenter, PointB=Point(0, 0, 0), Unitize=False)  # -> Vector, Length
move = Move(Geometry=G, Motion=vec2pt.Vector)  # -> Geometry, Transform
scale_nu = ScaleNU(Geometry=move.Geometry, Plane=PlaneXY(0, 0, 0), ScaleX=num_2, ScaleY=num_2, ScaleZ=1)  # -> Geometry, Transform
G_2 = ClusterOutput(scale_nu.Geometry)

# ==== cluster GeoBottomCenter_2
geo = ClusterInput()
geo_2 = Geometry(geo)
bbox = BoundingBox(Content=geo_2, Plane=PlaneXY(0, 0, 0))  # -> Box, Box_2
box_corners = BoxCorners(Box=bbox.Box)  # -> CornerA, CornerB, CornerC, CornerD, CornerE, CornerF, CornerG, CornerH
pdecon = Deconstruct(Point=box_corners.CornerA)  # -> XComponent, YComponent, ZComponent
pdecon_2 = Deconstruct(Point=box_corners.CornerC)  # -> XComponent, YComponent, ZComponent
addition = Addition(A=pdecon.XComponent, B=pdecon_2.XComponent)
addition_2 = Addition(A=pdecon.YComponent, B=pdecon_2.YComponent)
division = Division(A=addition, B=2)
division_2 = Division(A=addition_2, B=2)
pt = ConstructPoint(XCoordinate=division, YCoordinate=division_2, ZCoordinate=pdecon.ZComponent)
pshift = ShiftPaths(Data=pt, Offset=-1)
pt_2 = Point(pshift)
pt_3 = ClusterOutput(pt_2)

# ==== cluster EasterEggs
panel = Panel("79")  # disabled
panel_2 = Panel("30")  # disabled
subtraction = Subtraction(A=panel, B=1)  # disabled
subtraction_2 = Subtraction(A=panel_2, B=1)  # disabled
sqgrid = Square(Plane=PlaneXY(0, 0, 0), Size=1, ExtentX=subtraction, ExtentY=subtraction_2)  # -> Cells, Points; disabled
pdecon = Deconstruct(Point=sqgrid.Points)  # -> XComponent, YComponent, ZComponent; disabled
division = Division(A=pdecon.XComponent, B=panel)  # disabled
division_2 = Division(A=pdecon.YComponent, B=panel_2)  # disabled
pt = ConstructPoint(XCoordinate=division, YCoordinate=division_2, ZCoordinate=0)  # disabled
ahsv = SplitAHSV()  # -> Alpha, Hue, Saturation, Value; disabled
smaller = SmallerThan(FirstNumber=ahsv.Alpha, SecondNumber=1)  # -> SmallerThan, OrEqualTo; disabled
dispatch = Dispatch(List=sqgrid.Points, DispatchPattern=smaller.SmallerThan)  # -> ListA, ListB; disabled
dispatch_2 = Dispatch(DispatchPattern=smaller.SmallerThan)  # -> ListA, ListB; disabled
vec = VectorXYZ(XComponent=2, YComponent=-2, ZComponent=-10)  # -> Vector, Length; disabled
col = Colour(flatten(dispatch_2.ListB))  # disabled
planesrf = PlaneSurface(Plane=dispatch.ListB, XSize=Domain(-0.5, 0.5), YSize=Domain(-0.5, 0.5))  # disabled
mesh = Mesh(flatten(planesrf))  # disabled
mspray = MeshSpray(Mesh=graft(mesh), Points=Point(0, 0, 0), Colours=graft(col), SprayMode=0)  # disabled
mjoin = MeshJoin(Meshes=flatten(mspray))  # disabled
move = Move(Geometry=mjoin, Motion=vec.Vector)  # -> Geometry, Transform; disabled
mcol = MeshColours(Mesh=move.Geometry, Colours=RGB(0, 0, 0))  # disabled
preview = CustomPreview(Geometry=planesrf, Shader=dispatch_2.ListB)  # disabled
mjoin_2 = MeshJoin(Meshes=flatten([mjoin, mcol]))  # disabled
toggle = BooleanToggle(False)  # disabled
toggle_2 = BooleanToggle(False)  # disabled
panel_3 = Panel("7")  # disabled
swatch = ColourSwatch(SwatchColor=RGB(0, 0, 0))  # disabled
swatch_2 = ColourSwatch(SwatchColor=RGB(255, 115, 0))  # disabled

# ---- group: module meshes lego ref: 7 - J
mesh_2 = Mesh(<mesh referenced from the Rhino model>)  # disabled

# ---- group: on screen mesh ref: 8 - X
mesh_3 = Mesh(<mesh referenced from the Rhino model>)  # disabled

# ---- group: module meshes lego ref: 8 - X
mesh_4 = Mesh(<mesh referenced from the Rhino model>)  # disabled

# ----
panel_4 = Panel("7")  # disabled
mesh_5 = Mesh(<mesh referenced from the Rhino model>)  # disabled

# ---- group: on screen mesh ref: 7 - J
mesh_6 = Mesh(mjoin_2)  # disabled

# ----
mcol_2 = MeshColours(Mesh=mesh_3, Colours=swatch_2)  # disabled
mcol_3 = MeshColours(Mesh=mesh_5, Colours=swatch)  # disabled
shrink = ClusterInput()
shrink_2 = ClusterInput()
movetoorgin = MoveToOrgin(G=mesh_2, num=shrink)  # disabled
mjoin_3 = MeshJoin(Meshes=[mcol_2, mcol_3])  # disabled
movetoorgin_2 = MoveToOrgin(G=mesh_4, num=shrink_2)  # disabled

# ---- group: module meshes lego at orgin
mesh_7 = Mesh(movetoorgin)  # disabled

mesh_8 = Mesh(movetoorgin_2)  # disabled

# ----
A = ClusterInput()
A_2 = ClusterInput()
equals = Equality(FirstNumber=A, SecondNumber=panel_4)  # -> Equality, Inequality; disabled
int = Integer(equals.Equality)  # disabled
ma = MassAddition(Input=int)  # -> Result, PartialResults; disabled
larger = LargerThan(FirstNumber=ma.Result, SecondNumber=0)  # -> LargerThan, OrEqualTo; disabled
L = ClusterInput()
equals_2 = Equality(FirstNumber=A_2, SecondNumber=panel_3)  # -> Equality, Inequality; disabled
int_2 = Integer(equals_2.Equality)  # disabled
ma_2 = MassAddition(Input=int_2)  # -> Result, PartialResults; disabled
larger_2 = LargerThan(FirstNumber=ma_2.Result, SecondNumber=0)  # -> LargerThan, OrEqualTo; disabled
L_2 = ClusterInput()

# ---- group: if has this special id
bool = Boolean(larger.LargerThan)  # disabled

bool_2 = Boolean(bool)  # disabled

# ----
getcamera = GetCamera(GetCamera=bool_2)  # -> Location, Target, LensLength, UpDirection; disabled
ln = Line(StartPoint=getcamera.Location, EndPoint=getcamera.Target)  # disabled
getplanefrom2pts = GetPlaneFrom2pts(pt_2=getcamera.Location, pt=getcamera.Target)  # disabled
dispatch_3 = Dispatch(List=L, DispatchPattern=equals_2.Equality)  # -> ListA, ListB; disabled
dispatch_4 = Dispatch(List=L_2, DispatchPattern=equals.Equality)  # -> ListA, ListB; disabled
number_slider = Slider(6.4, range=0..10)  # disabled
number_slider_2 = Slider(14.4, range=0..100)  # disabled
pt_2 = ConstructPoint(XCoordinate=500, YCoordinate=500, ZCoordinate=20)  # disabled

# ---- group: if has this special id
bool_3 = Boolean(larger_2.LargerThan)  # disabled

bool_4 = Boolean(bool_3)  # disabled

# ----
getcamera_2 = GetCamera(GetCamera=bool_4)  # -> Location, Target, LensLength, UpDirection; disabled
ln_2 = Line(StartPoint=getcamera_2.Location, EndPoint=getcamera_2.Target)  # disabled
getplanefrom2pts_2 = GetPlaneFrom2pts(pt_2=getcamera_2.Location, pt=getcamera_2.Target)  # disabled
vec2pt = Vector2Pt(PointA=Point(0, 0, 0), PointB=dispatch_3.ListA, Unitize=False)  # -> Vector, Length; disabled
vec2pt_2 = Vector2Pt(PointA=Point(0, 0, 0), PointB=dispatch_4.ListA, Unitize=False)  # -> Vector, Length; disabled
pt_3 = Point(pt_2)  # disabled
move_2 = Move(Geometry=mesh_7, Motion=vec2pt.Vector)  # -> Geometry, Transform; disabled
move_3 = Move(Geometry=mesh_8, Motion=vec2pt_2.Vector)  # -> Geometry, Transform; disabled

# ---- group: current cam canvas pln
pln = Plane(getplanefrom2pts)  # disabled

pln_2 = Plane(getplanefrom2pts_2)  # disabled

# ----
xy = XYPlane(Origin=pt_3)  # disabled
number_slider_3 = Slider(0.01, range=0.001..1)  # disabled
number_slider_4 = Slider(0.01, range=0.001..1)  # disabled
number_slider_5 = Slider(0.81, range=0.001..101)  # disabled
movetoorgin_3 = MoveToOrgin(G=mjoin_3, num=number_slider)  # disabled
movetoorgin_4 = MoveToOrgin(G=mesh_6, num=number_slider_2)  # disabled
orient = Orient(Geometry=movetoorgin_4, Source=PlaneXY(0, 0, 0), Target=xy)  # -> Geometry, Transform; disabled
orient_2 = Orient(Geometry=movetoorgin_3, Source=PlaneXY(0, 0, 0), Target=pln)  # -> Geometry, Transform; disabled
orient_3 = Orient(Geometry=movetoorgin_4, Source=PlaneXY(0, 0, 0), Target=pln_2)  # -> Geometry, Transform; disabled
scale = Scale(Geometry=orient_2.Geometry, Center=getcamera.Location, Factor=number_slider_3)  # -> Geometry, Transform; disabled
scale_2 = Scale(Geometry=orient_3.Geometry, Center=getcamera_2.Location, Factor=number_slider_4)  # -> Geometry, Transform; disabled
scale_3 = Scale(Geometry=orient.Geometry, Center=pt_3, Factor=number_slider_5)  # -> Geometry, Transform; disabled
filter = StreamFilter(Gate=bool_2, Stream1=scale.Geometry)  # disabled
filter_2 = StreamFilter(Gate=bool_4, Stream1=scale_2.Geometry)  # disabled
filter_3 = StreamFilter(Gate=bool_4, Stream1=scale_3.Geometry)  # disabled

# ---- group: special JR
mesh_9 = Mesh(move_2.Geometry)  # disabled

# ---- group: on 3d view
mesh_10 = Mesh(filter)  # disabled

# ---- group: special Xin
mesh_11 = Mesh(move_3.Geometry)  # disabled

# ---- group: on 3d view
mesh_12 = Mesh(filter_2)  # disabled

# ---- group: on lego
mesh_13 = Mesh(filter_3)  # disabled

# ==== cluster RndReduceByRatio
L = ClusterInput()
B = ClusterInput()
lng = ListLength(List=L)
S = ClusterInput()
multiplication = Multiplication(A=lng, B=B)
reduce = RandomReduce(List=L, Reduction=multiplication, Seed=S)
L_2 = ClusterOutput(reduce)

# ==== cluster GeoBottomCenter
geo = ClusterInput()
geo_2 = Geometry(geo)
bbox = BoundingBox(Content=geo_2, Plane=PlaneXY(0, 0, 0))  # -> Box, Box_2
box_corners = BoxCorners(Box=bbox.Box)  # -> CornerA, CornerB, CornerC, CornerD, CornerE, CornerF, CornerG, CornerH
pdecon = Deconstruct(Point=box_corners.CornerA)  # -> XComponent, YComponent, ZComponent
pdecon_2 = Deconstruct(Point=box_corners.CornerC)  # -> XComponent, YComponent, ZComponent
addition = Addition(A=pdecon.XComponent, B=pdecon_2.XComponent)
addition_2 = Addition(A=pdecon.YComponent, B=pdecon_2.YComponent)
division = Division(A=addition, B=2)
division_2 = Division(A=addition_2, B=2)
pt = ConstructPoint(XCoordinate=division, YCoordinate=division_2, ZCoordinate=pdecon.ZComponent)
pt_2 = Point(pt)
pt_3 = ClusterOutput(pt_2)

# ==== cluster GetPlaneFrom2pts
pt = ClusterInput()
pt_2 = ClusterInput()

# ---- group: current cam tgt pos
pt_3 = Point(pt)

# ---- group: current cam pos
pt_4 = Point(pt_2)

# ----
Z = UnitZ(Factor=100)
move = Move(Geometry=pt_3, Motion=Z)  # -> Geometry, Transform
pl_3pt = Plane3Pt(PointA=pt_3, PointB=pt_4, PointC=move.Geometry)
pt_5 = PointOriented(BasePlane=pl_3pt, UComponent=0, VComponent=0, WComponent=-100)
pt_6 = PointOriented(BasePlane=pl_3pt, UComponent=0, VComponent=100, WComponent=0)
pl_3pt_2 = Plane3Pt(PointA=pt_3, PointB=pt_5, PointC=pt_6)
pln = Plane(pl_3pt_2)
pln_2 = ClusterOutput(pln)
