# Grasshopper definition 160406_Mesh Coloring and Block Inserting_archive.gh (Grasshopper 0.9.76)
# plug-ins: Python Interpreter, HDTReference

# ---- group: mesh coloring
swatch = ColourSwatch(SwatchColor=RGB(0, 0, 0))  # disabled
swatch_2 = ColourSwatch(SwatchColor=RGB(251, 255, 122))  # disabled
swatch_3 = ColourSwatch(SwatchColor=RGB(255, 255, 255))  # disabled
swatch_4 = ColourSwatch(SwatchColor=RGB(120, 120, 120))  # disabled
brep = Brep(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)  # disabled
swatch_5 = ColourSwatch(SwatchColor=RGB(255, 122, 122))  # disabled
brep_2 = Brep([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])  # disabled
brep_3 = Brep([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])  # disabled
brep_4 = Brep([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])  # disabled
brep_5 = Brep(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)  # disabled
jagged = SettingsSpeed()  # disabled
jagged_2 = SettingsSpeed()  # disabled
jagged_3 = SettingsSpeed()  # disabled
jagged_4 = SettingsSpeed()  # disabled
jagged_5 = SettingsSpeed()  # disabled
mesh = MeshBrep(Brep=brep, Settings=jagged)  # disabled
mesh_2 = MeshBrep(Brep=brep_2, Settings=jagged_2)  # disabled
mesh_3 = MeshBrep(Brep=brep_3, Settings=jagged_3)  # disabled
mesh_4 = MeshBrep(Brep=brep_5, Settings=jagged_4)  # disabled
mesh_5 = MeshBrep(Brep=brep_4, Settings=jagged_5)  # disabled
mjoin = MeshJoin(Meshes=mesh)  # disabled
mjoin_2 = MeshJoin(Meshes=mesh_2)  # disabled
mjoin_3 = MeshJoin(Meshes=mesh_3)  # disabled
mjoin_4 = MeshJoin(Meshes=mesh_4)  # disabled
mjoin_5 = MeshJoin(Meshes=mesh_5)  # disabled
mcol = MeshColours(Mesh=mjoin_3, Colours=swatch_3)  # disabled
mcol_2 = MeshColours(Mesh=mjoin, Colours=swatch_2)  # disabled
mcol_3 = MeshColours(Mesh=mjoin_2, Colours=swatch)  # disabled
mcol_4 = MeshColours(Mesh=mjoin_4, Colours=swatch_5)  # disabled
mcol_5 = MeshColours(Mesh=mjoin_5, Colours=swatch_4)  # disabled
merge = Merge(Data1=mcol_2, Data2=mcol_4, Data3=mcol, Data4=mcol_5, Data5=mcol_3)  # disabled
mjoin_6 = MeshJoin(Meshes=merge)  # disabled
mesh_6 = Mesh(mjoin_6)  # disabled

# ----
# CityMatrix
# 
# by Yan "Ryan" Zhang <ryanz@mit.edu>
# for MIT Media Lab, Changing Place Group, CityScope Project
# March.17th.2016
# LEGO Grid System (CityMatrix 16x16)
pt = Point(<point referenced from the Rhino model>)
pt_2 = Point(<point referenced from the Rhino model>)
dist = Distance(PointA=pt, PointB=pt_2)
# Parsing Colortizer Data (CityMatrix 16x16)
panel = Panel("C:\Users\RYAN\Documents\GitHub\CityMatrix\Data\colortizer_data.txt")
file = ReadFile(File=panel, PerLineParse=True)
split = SplitList(List=file, Index=9)  # -> ListA, ListB
pshift = ShiftPaths(Data=split.ListB, Offset=-1)
pshift_2 = ShiftPaths(Data=split.ListA, Offset=-1)
item = ListItem(List=pshift_2, Index=1, Wrap=False)
split_2 = TextSplit(Text=item, Separators="\t")
pshift_3 = ShiftPaths(Data=split_2, Offset=1)
item_2 = ListItem(List=pshift_3, Index=1, Wrap=False)
int = Integer(item_2)
division = Division(A=dist, B=int)
num = Number(division)
int_2 = Integer(item_2)
item_3 = ListItem(List=pshift_3, Index=2, Wrap=False)
int_3 = Integer(item_3)
multiplication = Multiplication(A=int_2, B=int_3)
split_3 = SplitList(List=pshift, Index=multiplication)  # -> ListA, ListB
pshift_4 = ShiftPaths(Data=split_3.ListA, Offset=-1)
split_4 = TextSplit(Text=pshift_4, Separators="\t")
pshift_5 = ShiftPaths(Data=split_4, Offset=1)
int_4 = Integer(pshift_5)
panel_2 = Panel(int_4)
item_4 = ListItem(List=panel_2, Index="1", Wrap=False)
item_5 = ListItem(List=panel_2, Index="2", Wrap=False)
pshift_6 = ShiftPaths(Data=item_4, Offset=-1)
pshift_7 = ShiftPaths(Data=item_5, Offset=-1)
int_5 = Integer(pshift_6)
int_6 = Integer(int_5)
int_7 = Integer(pshift_7)
int_8 = Integer(int_7)
modulecenter = ModuleCenter(pt=pt, num=num, int_2=int_6, int=int_8)  # -> pt_5, transform_2
xform = Transform(modulecenter.transform_2)

# ---- group: delete and insert block, doesn't work
division_2 = Division(A=num, B=num)  # disabled
panel_3 = Panel("blockBake")  # disabled
bool = Boolean(division_2)  # disabled
panel_4 = Panel("ttt")  # disabled
python = PythonScript(trigger=bool, name=panel_4)  # -> out, a; disabled
# ---------- python: Python ----------
import rhinoscriptsyntax as rs

if trigger:
    rs.Command("-selname ttt delete")

a = 0.0
# ---------- end python ----------
python_2 = PythonScript(trigger=bool, name=panel_4)  # -> out, a; disabled
# ---------- python_2: Python ----------
import rhinoscriptsyntax as rs
import scriptcontext
import Rhino
import time
scriptcontext.doc = Rhino.RhinoDoc.ActiveDoc
tb = rs.BlockInstances("module01_res_med")
if trigger:
    rs.EnableRedraw(False)
#    time.sleep(5)
#    rs.Command("-selname ttt delete")
#    for i in range(255):
#        tb = rs.BlockInstances("module01_res_med")
#        rs.ObjectName(tb, name)
#        rs.MoveObject(tb, [i,i,0.0])
#    rs.EnableRedraw(True)
a = 0.0

scriptcontext.doc = ghdoc
# ---------- end python_2 ----------
createatts = CreateAttributes(Name=panel_4, LayerName=panel_3, enableFullPath=False)  # disabled
panel_5 = Panel("module01_res_med")  # disabled
panel_6 = Panel("test_block_mesh")  # disabled
toggle = BooleanToggle(True)  # disabled
placeblock = PlaceBlock(BlockName=panel_5, Transform=xform, Bake=toggle, Attributes=createatts)  # disabled

# ==== cluster ModuleCenter
pt = ClusterInput()
int = ClusterInput()
num = ClusterInput()
int_2 = ClusterInput()

# ---- group: y
int_3 = Integer(int)

# ---- group: cell size
num_2 = Number(num)

# ---- group: x
int_4 = Integer(int_2)

# ---- group: center
pt_2 = Point(pt)

# ----
pt_3 = ConstructPoint(XCoordinate=0, YCoordinate=0, ZCoordinate=0)
addition = Addition(A=int_4, B=0.5)
vec2pt = Vector2Pt(PointA=pt_3, PointB=pt_2, Unitize=False)  # -> Vector, Length
addition_2 = Addition(A=int_3, B=0.5)
multiplication = Multiplication(A=addition, B=num_2)
lng = ListLength(List=int_4)
move = Move(Motion=vec2pt.Vector)  # -> Geometry, Transform
multiplication_2 = Multiplication(A=addition_2, B=num_2)
X = UnitX(Factor=multiplication)
repeat = RepeatData(Data=move.Transform, Length=lng)
neg = Negative(Value=multiplication_2)
move_2 = Move(Geometry=pt_2, Motion=X)  # -> Geometry, Transform
graft = GraftTree(Tree=move_2.Transform, IncludeEmptyLists=True, IncludeNullItems=True)
Y = UnitY(Factor=neg)
pshift = ShiftPaths(Data=repeat, Offset=-1)
move_3 = Move(Geometry=move_2.Geometry, Motion=Y)  # -> Geometry, Transform
graft_2 = GraftTree(Tree=move_3.Transform, IncludeEmptyLists=True, IncludeNullItems=True)
comp = Compound(Transforms=[graft, graft_2])
graft_3 = GraftTree(Tree=pshift, IncludeEmptyLists=True, IncludeNullItems=True)
comp_2 = Compound(Transforms=[comp, graft_3])

# ---- group: module center
pt_4 = Point(move_3.Geometry)

# ----
pshift_2 = ShiftPaths(Data=comp_2, Offset=-1)
transform = Transform(pshift_2)
pt_5 = ClusterOutput(pt_4)
transform_2 = ClusterOutput(transform)
