# Grasshopper definition 151231_Crv Pt for Processing.gh (Grasshopper 0.9.76)

number_slider = Slider(1, range=0.1..5)

# ---- group: RD CRV ONE WAY
crv = Curve(reparameterize([<curve referenced from the Rhino model> x108]))

# ---- group: RD CRV TWO WAY
crv_2 = Curve()

# ----
txt = Text("two way")
txt_2 = Text("one way")
txt_3 = Text("start")
txt_4 = Text("end")

# ---- group: STEP LENGTH
num = Number(Slider(0.5, range=0.1..5))

# ----
divlength = DivideLength(Curve=crv_2, Length=num)  # -> Points, Tangents, Parameters
lng = ListLength(List=crv)
lng_2 = ListLength(List=crv_2)
divlength_2 = DivideLength(Curve=crv, Length=num)  # -> Points, Tangents, Parameters
item = ListItem(List=divlength.Points, Index=Slider(100, range=0..100), Wrap=True)
repeat = RepeatData(Data=txt_3, Length=lng_2)  # -> graft(Data)
repeat_2 = RepeatData(Data=txt_3, Length=lng)  # -> graft(Data)
repeat_3 = RepeatData(Data=txt, Length=lng_2)  # -> graft(Data)
repeat_4 = RepeatData(Data=txt_4, Length=lng_2)  # -> graft(Data)
repeat_5 = RepeatData(Data=txt_2, Length=lng)  # -> graft(Data)
repeat_6 = RepeatData(Data=txt_4, Length=lng)  # -> graft(Data)
pt = Point(divlength_2.Points)
pt_2 = Point(divlength.Points)
pshift = ShiftPaths(Data=repeat_3, Offset=1)
pshift_2 = ShiftPaths(Data=repeat_4, Offset=1)
pshift_3 = ShiftPaths(Data=repeat_5, Offset=1)
pshift_4 = ShiftPaths(Data=repeat_6, Offset=1)
pshift_5 = ShiftPaths(Data=repeat, Offset=1)
pshift_6 = ShiftPaths(Data=repeat_2, Offset=1)
xz = XZPlane(Origin=Point(0, 0, 0))
xz_2 = XZPlane(Origin=Point(0, 0, 0))
mirror = Mirror(Geometry=pt_2, Plane=xz_2)  # -> Geometry, Transform
mirror_2 = Mirror(Geometry=pt, Plane=xz)  # -> Geometry, Transform
panel = Panel(mirror.Geometry)
panel_2 = Panel(mirror_2.Geometry)
rep = ReplaceText(Text=panel, Find=", ", Replace=",", RecursiveReplace=False)
rep_2 = ReplaceText(Text=panel_2, Find=", ", Replace=",", RecursiveReplace=False)
rep_3 = ReplaceText(Text=rep, Find="{", RecursiveReplace=False)
rep_4 = ReplaceText(Text=rep_2, Find="{", RecursiveReplace=False)
rep_5 = ReplaceText(Text=rep_3, Find="}", RecursiveReplace=False)
rep_6 = ReplaceText(Text=rep_4, Find="}", RecursiveReplace=False)
panel_3 = Panel(rep_5)
panel_4 = Panel(rep_6)
merge = Merge(Data1=pshift_5, Data2=pshift, Data3=panel_3, Data4=pshift_2)
merge_2 = Merge(Data1=pshift_6, Data2=pshift_3, Data3=panel_4, Data4=pshift_4)
flatten = FlattenTree(Tree=merge, Path="{0}")
flatten_2 = FlattenTree(Tree=merge_2, Path="{0}")
merge_3 = Merge(Data1=flatten_2, Data2=flatten)
panel_5 = Panel(merge_3)
