# Grasshopper definition 160329_PEV_Sim_Data.gh (Grasshopper 0.9.76)
# plug-ins: SonicStringDup

number_slider = Slider(1, range=0.1..5)
number_slider_2 = Slider(1000, range=1..10000)  # disabled
number_slider_3 = Slider(0, range=0..100)  # disabled

# ---- group: RD CRV ONE WAY
crv = Curve(reparameterize([<curve referenced from the Rhino model> x108]))

# ---- group: RD CRV TWO WAY
crv_2 = Curve()

# ----
multiplication = Multiplication(A="24", B="60")
txt = Text("two way")
txt_2 = Text("one way")
panel = Panel(multiplication)
txt_3 = Text("start")
txt_4 = Text("end")

# ---- group: STEP LENGTH
num = Number(Slider(0.5, range=0.1..5))

# ----
dom = ConstructDomain(DomainStart=0, DomainEnd=panel)
random = Random(Range=dom, Number=number_slider_2, Seed=number_slider_3)  # disabled
divlength = DivideLength(Curve=crv_2, Length=num)  # -> Points, Tangents, Parameters
lng = ListLength(List=crv)
lng_2 = ListLength(List=crv_2)
divlength_2 = DivideLength(Curve=crv, Length=num)  # -> Points, Tangents, Parameters
int = Integer(random)  # disabled
item = ListItem(List=divlength.Points, Index=Slider(100, range=0..100), Wrap=True)
range = Range(Domain=dom, Steps=panel)
repeat = RepeatData(Data=txt_3, Length=lng_2)  # -> graft(Data)
repeat_2 = RepeatData(Data=txt_3, Length=lng)  # -> graft(Data)
repeat_3 = RepeatData(Data=txt, Length=lng_2)  # -> graft(Data)
repeat_4 = RepeatData(Data=txt_4, Length=lng_2)  # -> graft(Data)
repeat_5 = RepeatData(Data=txt_2, Length=lng)  # -> graft(Data)
repeat_6 = RepeatData(Data=txt_4, Length=lng)  # -> graft(Data)
pt = Point(divlength_2.Points)
pt_2 = Point(divlength.Points)

# ---- group: all road pts
pt_3 = Point(flatten([pt, pt_2]))

# ----
lng_3 = ListLength(List=pt_3)
subtraction = Subtraction(A=lng_3, B=1)
dom_2 = ConstructDomain(DomainStart=0, DomainEnd=subtraction)
stringdup = StringDuplicates(String=int)  # -> R, i, P; disabled
shift = ShiftList(List=range, Shift=-1, Wrap=False)
pshift = ShiftPaths(Data=repeat_3, Offset=1)
pshift_2 = ShiftPaths(Data=repeat_4, Offset=1)
pshift_3 = ShiftPaths(Data=repeat_5, Offset=1)
pshift_4 = ShiftPaths(Data=repeat_6, Offset=1)
pshift_5 = ShiftPaths(Data=repeat, Offset=1)
pshift_6 = ShiftPaths(Data=repeat_2, Offset=1)
int_2 = Integer(shift)
sort = SortList(Keys=stringdup.R)  # -> Keys, ValuesA; disabled
xz = XZPlane(Origin=Point(0, 0, 0))
xz_2 = XZPlane(Origin=Point(0, 0, 0))
pshift_7 = ShiftPaths(Data=sort.Keys, Offset=-1)  # disabled
mirror = Mirror(Geometry=pt_2, Plane=xz_2)  # -> Geometry, Transform
mirror_2 = Mirror(Geometry=pt, Plane=xz)  # -> Geometry, Transform

# ---- group: none dup time
int_3 = Integer(pshift_7)  # disabled

# ----
lng_4 = ListLength(List=int_3)  # disabled
panel_2 = Panel(lng_4)  # disabled
panel_3 = Panel(mirror.Geometry)
panel_4 = Panel(mirror_2.Geometry)
panel_5 = Panel(int_3)  # disabled
graph = GraphMapper(
    int_2,
    x0=0,
    x1=1440,
    y0=0,
    y1=1,
    container_name="Sine Summation",
    Equation0_px=[0.4998726845, 0],
    Equation0_py=[0.1522498727, 0],
    Equation1_px=[0, 0.2534573674],
    Equation1_py=[0.08167254925, 0.3417996764])
rep = ReplaceText(Text=panel_3, Find=", ", Replace=",", RecursiveReplace=False)
rep_2 = ReplaceText(Text=panel_4, Find=", ", Replace=",", RecursiveReplace=False)
rep_3 = ReplaceText(Text=rep, Find="{", RecursiveReplace=False)
rep_4 = ReplaceText(Text=rep_2, Find="{", RecursiveReplace=False)
random_2 = Random(Range=Domain(0, 1), Number=panel, Seed=Slider(0, range=0..100))
rep_5 = ReplaceText(Text=rep_3, Find="}", RecursiveReplace=False)
rep_6 = ReplaceText(Text=rep_4, Find="}", RecursiveReplace=False)
panel_6 = Panel(graph)
panel_7 = Panel(random_2)
panel_8 = Panel(rep_5)
panel_9 = Panel(rep_6)
smaller = SmallerThan(FirstNumber=panel_7, SecondNumber=panel_6)  # -> SmallerThan, OrEqualTo
cull = CullPattern(List=int_2, CullPattern=smaller.OrEqualTo)
pshift_8 = ShiftPaths(Data=cull, Offset=-1)
merge = Merge(Data1=pshift_5, Data2=pshift, Data3=panel_8, Data4=pshift_2)
merge_2 = Merge(Data1=pshift_6, Data2=pshift_3, Data3=panel_9, Data4=pshift_4)

# ---- group: time that has requests
int_4 = Integer(pshift_8)

# ----
lng_5 = ListLength(List=int_4)
random_3 = Random(Range=dom_2, Number=lng_5, Seed=Slider(0, range=0..100))
random_4 = Random(Range=dom_2, Number=lng_5, Seed=Slider(1, range=0..1))
int_5 = Integer(random_4)
int_6 = Integer(random_3)
item_2 = ListItem(List=pt_3, Index=int_5, Wrap=True)
item_3 = ListItem(List=pt_3, Index=int_6, Wrap=True)
pshift_9 = ShiftPaths(Data=item_2, Offset=-1)
pshift_10 = ShiftPaths(Data=item_3, Offset=-1)

# ---- group: dropoff pts
pt_4 = Point(pshift_9)

# ---- group: pickup pts
pt_5 = Point(pshift_10)

# ----
pdecon = Deconstruct(Point=pt_4)  # -> XComponent, YComponent, ZComponent
pdecon_2 = Deconstruct(Point=pt_5)  # -> XComponent, YComponent, ZComponent
panel_10 = Panel(pdecon.XComponent)
panel_11 = Panel(pdecon.YComponent)
panel_12 = Panel(pdecon_2.XComponent)
panel_13 = Panel(pdecon_2.YComponent)
merge_3 = Merge(Data1=graft(int_4), Data2=graft(panel_12), Data3=graft(panel_13), Data4=graft(panel_10), Data5=graft(panel_11))
join = TextJoin(Text=merge_3, Join=",")
pshift_11 = ShiftPaths(Data=join, Offset=-1)
pshift_12 = ShiftPaths(Data=pshift_11, Offset=-1)
panel_14 = Panel(lng_5)
flatten = FlattenTree(Tree=merge, Path="{0}")
flatten_2 = FlattenTree(Tree=merge_2, Path="{0}")
merge_4 = Merge(Data1="Time,PickupX,PickupY,DropoffX,DropoffY", Data2=pshift_12)
panel_15 = Panel(int_4)
merge_5 = Merge(Data1=flatten_2, Data2=flatten)
panel_16 = Panel(merge_4)
panel_17 = Panel(merge_5)
