# Grasshopper definition traffic congestion heatmap.gh (Grasshopper 0.9.76)
# plug-ins: Python Interpreter

# ---- group: total resident #
int = Integer()

# ----
ppl = Slider(30000, range=700..30000)
ispev = BooleanToggle(False)
pt = Point([Point(906.25, 156.25, 0), Point(906.25, 531.25, 0), Point(906.25, 781.25, 0), Point(906.25, 656.25, 0), Point(906.25, 281.25, 0), Point(156.25, 906.25, 0)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])
bool = Boolean(ispev)
int_2 = Integer(ppl)
srf = Surface(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)
crossings = Point([Point(156.25, 281.25, 0), Point(468.75, 281.25, 0), Point(718.75, 281.25, 0), Point(156.25, 656.25, 0), Point(468.75, 656.25, 0), Point(718.75, 656.25, 0), Point(906.25, 906.25, 0), Point(718.75, 906.25, 0), Point(468.75, 906.25, 0), Point(156.25, 906.25, 0), Point(906.25, 281.25, 0), Point(906.25, 656.25, 0), Point(906.25, 781.25, 0), Point(906.25, 531.25, 0), Point(906.25, 156.25, 0)])
congestion = PythonScript(A=crossings, S=srf, P=pt, N=int_2, B=bool)  # -> out, C, t; inputs A: list, P: list
# ---------- congestion: Python ----------
import random 
import rhinoscriptsyntax as rs

ratio = float((N-700)/(35000.0-700.0))

C=[]
t=[]

#print ratio

hue = 50 - 50 * ratio
alpha = 255 * ratio

if B :
    hue += 45
    alpha /= float(3)

min_distance = []

for p in P:
    mind = 10000000
    for a in A:
        d = rs.Distance(a,p)
        if d < mind:
            mind = d
    distance =  (1-mind/250) * 0.2 
    hue += distance*2
    t.append(100-hue)
    C.append(rs.ColorHLSToRGB((hue+random.randint(-2,2),128,255,alpha+random.randint(-5,5))));
# ---------- end congestion ----------
move = Move(Geometry=srf, Motion=pt)  # -> Geometry, Transform
preview = CustomPreview(Geometry=move.Geometry, Shader=congestion.C)
